# Grasshopper definition 03_Grasshopper script for annotation tool.gh (Grasshopper 1.0.8)
# plug-ins: RhinoCodePluginGH

pipeline = GeometryPipeline(
    GroupByLayer=False,
    GroupByType=False,
    IncludeHidden=True,
    IncludeLocked=True,
    LayerFilter="balc_door_above_2nd",
    NameFilter="*",
    SublayerFiltering=True,
    TypeFilter=4)
panel = Panel(pipeline)

pipeline_2 = GeometryPipeline(
    GroupByLayer=False,
    GroupByType=False,
    IncludeHidden=True,
    IncludeLocked=True,
    LayerFilter="window_above_2nd",
    NameFilter="*",
    SublayerFiltering=True,
    TypeFilter=4)
panel_2 = Panel(pipeline_2)

# ----
# BALCONY
# DOOR,
# 2ND FLOOR
pipeline_3 = GeometryPipeline(
    GroupByLayer=False,
    GroupByType=False,
    IncludeHidden=True,
    IncludeLocked=True,
    LayerFilter="balc_door_2nd_floor",
    NameFilter="*",
    SublayerFiltering=True,
    TypeFilter=4)
panel_3 = Panel(pipeline_3)

# ----
# GLAZING,
# GROUND
pipeline_4 = GeometryPipeline(
    GroupByLayer=False,
    GroupByType=False,
    IncludeHidden=True,
    IncludeLocked=True,
    LayerFilter="glazing_ground",
    NameFilter="*",
    SublayerFiltering=True,
    TypeFilter=4)
panel_4 = Panel(pipeline_4)

# ----
# WINDOW,
# 2ND FLOOR
pipeline_5 = GeometryPipeline(
    GroupByLayer=False,
    GroupByType=False,
    IncludeHidden=True,
    IncludeLocked=True,
    LayerFilter="window_2nd_floor",
    NameFilter="*",
    SublayerFiltering=True,
    TypeFilter=4)
panel_5 = Panel(pipeline_5)

# ----
# WALL
pipeline_6 = GeometryPipeline(
    GroupByLayer=False,
    GroupByType=False,
    IncludeHidden=True,
    IncludeLocked=True,
    LayerFilter="wall",
    NameFilter="*",
    SublayerFiltering=True,
    TypeFilter=4)
panel_6 = Panel(pipeline_6)

# ----
# ROOF
pipeline_7 = GeometryPipeline(
    GroupByLayer=False,
    GroupByType=False,
    IncludeHidden=True,
    IncludeLocked=True,
    LayerFilter="roof",
    NameFilter="*",
    SublayerFiltering=True,
    TypeFilter=4)
panel_7 = Panel(pipeline_7)

# ----
# GARAGE
pipeline_8 = GeometryPipeline(
    GroupByLayer=False,
    GroupByType=False,
    IncludeHidden=True,
    IncludeLocked=True,
    LayerFilter="garage",
    NameFilter="*",
    SublayerFiltering=True,
    TypeFilter=4)
panel_8 = Panel(pipeline_8)

pipeline_9 = GeometryPipeline(
    GroupByLayer=False,
    GroupByType=False,
    IncludeHidden=True,
    IncludeLocked=True,
    LayerFilter="ortho_check_2nd",
    NameFilter="*",
    SublayerFiltering=True,
    TypeFilter=4)
item = ListItem(List=pipeline_9, Index="0", Wrap=True)
item_2 = ListItem(List=pipeline_9, Index="1", Wrap=True)
pi = Pi(Factor=1)
angle = Angle(VectorA=item, VectorB=item_2)  # -> Angle, Reflex
panel_9 = Panel(pipeline_9)
division = Division(A="180", B=pi)

pipeline_10 = GeometryPipeline(
    GroupByLayer=False,
    GroupByType=False,
    IncludeHidden=True,
    IncludeLocked=True,
    LayerFilter="ortho_check_top",
    NameFilter="*",
    SublayerFiltering=True,
    TypeFilter=4)
item_3 = ListItem(List=pipeline_10, Index="0", Wrap=True)
item_4 = ListItem(List=pipeline_10, Index="1", Wrap=True)
pi_2 = Pi(Factor=1)
angle_2 = Angle(VectorA=item_3, VectorB=item_4)  # -> Angle, Reflex
panel_10 = Panel(pipeline_10)
division_2 = Division(A="180", B=pi_2)

# ----
# AUTOMATIC LAYER
# IMPORTS FROM RHINO
pipeline_11 = GeometryPipeline(
    GroupByLayer=False,
    GroupByType=False,
    IncludeHidden=True,
    IncludeLocked=True,
    LayerFilter="image",
    NameFilter="*",
    SublayerFiltering=True,
    TypeFilter=1073741848)
panel_11 = Panel(pipeline_11)

py3 = Python3Script(x=angle_2.Angle, y=division_2)  # -> out, a
# ---------- py3: Python ----------
"""Grasshopper Script"""

if x != None:
    perp_check = x * y
    perp_check_less_180 = abs(perp_check - 180)
    if perp_check_less_180 < perp_check:
        perp_check = perp_check_less_180
else:
    perp_check = 'n/a'

print("Difference between upper floor")
print("and orthogonal (degrees): ")
print(perp_check)
# ---------- end py3 ----------

# ----
# IMAGE
# OUTLINE
# PERPENDICULAR
# ANGLE
# CHECKS
# WINDOW,
# ABOVE
# 2ND FLOOR
# BALCONY
# DOOR,
# ABOVE
# 2ND FLOOR
py3_2 = Python3Script(x=angle.Angle, y=division)  # -> out, a
# ---------- py3_2: Python ----------
"""Grasshopper Script"""

if x != None:
    perp_check = x * y
    perp_check_less_180 = abs(perp_check - 180)
    if perp_check_less_180 < perp_check:
        perp_check = perp_check_less_180
else:
    perp_check = 'n/a'

print("Difference between 2nd floor")
print("and orthogonal (degrees): ")
print(perp_check)
# ---------- end py3_2 ----------

# ----
# subtractions from wall area
# (itemized if multiple sections)
# (m2)
area = Area(Geometry=pipeline_8)  # -> Area, Centroid
panel_12 = Panel(area.Area)
ma = MassAddition(Input=area.Area)  # -> Result, PartialResults
panel_13 = Panel(ma.Result)
# Points: garage
explode = Explode(Curve=pipeline_8, Recursive=True)  # -> Segments, Vertices
pdecon = Deconstruct(Point=explode.Vertices)  # -> XComponent, YComponent, ZComponent
panel_14 = Panel(pdecon.XComponent)
panel_15 = Panel(pdecon.YComponent)

# ----
# Project name/
# folder name
# Image source
# Is the annotation
# segmented?
# Save as JSON
# or XML?
# Save directory
write_file = BooleanToggle(False)
confirm_img_path = BooleanToggle(False)
img_path = FilePath("C:\images\1069198750_1.jpg")
panel_16 = Panel(img_path)
list = ValueList({"json": 1, "xml": 2}, selected="xml")
list_2 = ValueList({"no": 0, "yes": 1}, selected="no")

# ----
# wall area
# (itemized if multiple sections)
# (m2)
# wall area,
# total,
# net of subtractions
# (m2)
# ground-floor glazing area,
# total
# (m2)
# ground-floor glazing area,
# itemized
# (m2)
# WINDOW WALL RATIO (WWR)
# glazing area,
# total
# (m2)
# 2nd-floor window area,
# itemized
# (m2)
# 2nd-floor window area,
# total
# (m2)
# 2nd-floor balcony door area
# total
# (m2)
# 2nd-floor balcony door area
# itemized
# (m2)
# above-2nd-floor window area,
# total
# (m2)
# above-2nd-floor window area,
# itemized
# (m2)
# above-2nd-floor balcony door area
# total
# (m2)
# above-2nd-floor balcony door area
# itemized
# (m2)
area_2 = Area(Geometry=pipeline_6)  # -> Area, Centroid
area_3 = Area(Geometry=pipeline_4)  # -> Area, Centroid
area_4 = Area(Geometry=pipeline_2)  # -> Area, Centroid
area_5 = Area(Geometry=pipeline_5)  # -> Area, Centroid
area_6 = Area(Geometry=pipeline)  # -> Area, Centroid
area_7 = Area(Geometry=pipeline_3)  # -> Area, Centroid
panel_17 = Panel(area_2.Area)
panel_18 = Panel(area_4.Area)
panel_19 = Panel(area_3.Area)
panel_20 = Panel(area_5.Area)
panel_21 = Panel(area_6.Area)
panel_22 = Panel(area_7.Area)
ma_2 = MassAddition(Input=area_2.Area)  # -> Result, PartialResults
# WINDOW WALL RATIO
# (WWR) CALCULATIONS
panel_23 = Panel(ma_2.Result)
ma_3 = MassAddition(Input=area_3.Area)  # -> Result, PartialResults
ma_4 = MassAddition(Input=area_4.Area)  # -> Result, PartialResults
ma_5 = MassAddition(Input=area_5.Area)  # -> Result, PartialResults
ma_6 = MassAddition(Input=area_6.Area)  # -> Result, PartialResults
ma_7 = MassAddition(Input=area_7.Area)  # -> Result, PartialResults
panel_24 = Panel(ma_3.Result)
panel_25 = Panel(ma_4.Result)
panel_26 = Panel(ma_6.Result)
panel_27 = Panel(ma_7.Result)
panel_28 = Panel(ma_5.Result)
ma_8 = MassAddition(Input=[ma_3.Result, ma_5.Result, ma_7.Result, ma_4.Result, ma_6.Result])  # -> Result, PartialResults

subtraction = Subtraction(A=ma_2.Result, B=ma.Result)
py3_3 = Python3Script(x=ma_8.Result)  # -> out, a
# ---------- py3_3: Python ----------
"""Grasshopper Script"""

if x == None:
    a = 0

else:
    a = x

print(a)
# ---------- end py3_3 ----------
panel_29 = Panel(subtraction)
panel_30 = Panel(py3_3.out)

division_3 = Division(A=py3_3.a, B=subtraction)

panel_31 = Panel(division_3)

py3_4 = Python3Script(
    wall=pipeline_6,
    roof=pipeline_7,
    garage=pipeline_8,
    glazing_ground=pipeline_4,
    window_2nd_floor=pipeline_5,
    balc_door_2nd_floor=pipeline_3,
    window_above_2nd=pipeline_2,
    balc_door_above_2nd=pipeline)  # -> out, count_wall, count_roof, count_garage, count_open_area, count_glazing_ground, count_window_2nd_floor, count_balc_door_2nd_floor, count_window_above_2nd, count_balc_door_above_2nd; inputs wall: tree, roof: tree, garage: tree, open_area: tree, glazing_ground: tree, window_2nd_floor: tree, balc_door_2nd_floor: tree, window_above_2nd: tree, balc_door_above_2nd: tree
# ---------- py3_4: Python ----------
"""Grasshopper Script"""
a = "Hello Python 3 in Grasshopper!"

import ghpythonlib.treehelpers as th

try:  
    wall = th.tree_to_list(wall)
    count_wall = len(wall)
except:
    count_wall = 0    
print('count wall: ', count_wall)

try:  
    roof = th.tree_to_list(roof)
    count_roof = len(roof)
except:
    count_roof = 0    
print('count roof: ', count_roof)

try:  
    garage = th.tree_to_list(garage)
    count_garage = len(garage)
except:
    count_garage = 0    
print('count garage: ', count_garage)

# try:  
#     open_area = th.tree_to_list(open_area)
#     count_open_area = len(open_area)
# except:
#     count_open_area = 0    
# print('count open_area: ', count_open_area)



try:  
    glazing_ground = th.tree_to_list(glazing_ground)
    count_glazing_ground = len(glazing_ground)
except:
    count_glazing_ground = 0    
print('count glazing_ground: ', count_glazing_ground)

try:  
    window_2nd_floor = th.tree_to_list(window_2nd_floor)
    count_window_2nd_floor = len(window_2nd_floor)
except:
    count_window_2nd_floor = 0    
print('count window_2nd_floor: ', count_window_2nd_floor)

try:  
    balc_door_2nd_floor = th.tree_to_list(balc_door_2nd_floor)
    count_balc_door_2nd_floor = len(balc_door_2nd_floor)
except:
    count_balc_door_2nd_floor = 0
print('count balc_door_2nd_floor: ', count_balc_door_2nd_floor)

try:  
    window_above_2nd = th.tree_to_list(window_above_2nd)
    count_window_above_2nd = len(window_above_2nd)
except:
    count_window_above_2nd = 0    
print('count window_above_2nd: ', count_window_above_2nd)

try:  
    balc_door_above_2nd = th.tree_to_list(balc_door_above_2nd)
    count_balc_door_above_2nd = len(balc_door_above_2nd)
except:
    count_balc_door_above_2nd = 0
print('count balc_door_above_2nd: ', count_balc_door_above_2nd)
# ---------- end py3_4 ----------
# CHECK BEFORE WRITING FILE
# SET PARAMETERS
# BEFORE WRITING
# XML/JSON FILE
item_counts = Panel(py3_4.out)
panel_32 = Panel(py3_2.out)
panel_33 = Panel(py3.out)

# ----
# Points: roof
# Points: glazing, ground-floor
# Points: windows, 2nd floor
# Points: balcony door,
# 2nd floor
# Points: windows,
# ABOVE 2nd floor
# Points: balcony door,
# ABOVE 2nd floor
explode_2 = Explode(Curve=pipeline_11, Recursive=True)  # -> Segments, Vertices
# Points: wall
explode_3 = Explode(Curve=pipeline_6, Recursive=True)  # -> Segments, Vertices
explode_4 = Explode(Curve=pipeline_7, Recursive=True)  # -> Segments, Vertices
explode_5 = Explode(Curve=pipeline_4, Recursive=True)  # -> Segments, Vertices
explode_6 = Explode(Curve=pipeline_5, Recursive=True)  # -> Segments, Vertices
explode_7 = Explode(Curve=pipeline_3, Recursive=True)  # -> Segments, Vertices
explode_8 = Explode(Curve=pipeline_2, Recursive=True)  # -> Segments, Vertices
explode_9 = Explode(Curve=pipeline, Recursive=True)  # -> Segments, Vertices
# Points: image
pdecon_2 = Deconstruct(Point=explode_2.Vertices)  # -> XComponent, YComponent, ZComponent
pdecon_3 = Deconstruct(Point=explode_3.Vertices)  # -> XComponent, YComponent, ZComponent
pdecon_4 = Deconstruct(Point=explode_4.Vertices)  # -> XComponent, YComponent, ZComponent
pdecon_5 = Deconstruct(Point=explode_5.Vertices)  # -> XComponent, YComponent, ZComponent
pdecon_6 = Deconstruct(Point=explode_6.Vertices)  # -> XComponent, YComponent, ZComponent
pdecon_7 = Deconstruct(Point=explode_7.Vertices)  # -> XComponent, YComponent, ZComponent
pdecon_8 = Deconstruct(Point=explode_8.Vertices)  # -> XComponent, YComponent, ZComponent
pdecon_9 = Deconstruct(Point=explode_9.Vertices)  # -> XComponent, YComponent, ZComponent
# CONVERT BOUNDING BOXES
# INTO NORMALIZED COORDINATES
panel_34 = Panel(pdecon_2.XComponent)
panel_35 = Panel(pdecon_3.XComponent)
panel_36 = Panel(pdecon_2.YComponent)
panel_37 = Panel(pdecon_3.YComponent)
panel_38 = Panel(pdecon_4.XComponent)
panel_39 = Panel(pdecon_4.YComponent)
panel_40 = Panel(pdecon_5.XComponent)
panel_41 = Panel(pdecon_5.YComponent)
panel_42 = Panel(pdecon_6.XComponent)
panel_43 = Panel(pdecon_6.YComponent)
panel_44 = Panel(pdecon_7.XComponent)
panel_45 = Panel(pdecon_8.XComponent)
panel_46 = Panel(pdecon_7.YComponent)
panel_47 = Panel(pdecon_8.YComponent)
panel_48 = Panel(pdecon_9.XComponent)
panel_49 = Panel(pdecon_9.YComponent)

multiplication = Multiplication(A=pdecon_2.YComponent, B="-1")
py3_5 = Python3Script(x=pdecon_2.XComponent, y=multiplication)  # -> out, a, b; inputs x: tree, y: tree
# ---------- py3_5: Python ----------
"""Grasshopper Script"""
# r: numpy
import ghpythonlib.treehelpers as th
import numpy as np

lst_x = th.tree_to_list(x)
lst_y = th.tree_to_list(y)
array_x = np.array(lst_x)
array_y = np.array(lst_y)

max_x = np.max(array_x)
max_y = np.max(array_y)

a = [max_x]
a = th.list_to_tree(a)
b = [max_y]
b = th.list_to_tree(b)

print('maximum x (meters): ', max_x)
print('maximum y (meters): ', max_y)
# ---------- end py3_5 ----------
division_4 = Division(A=pdecon_3.YComponent, B=py3_5.b)
division_5 = Division(A=pdecon_3.XComponent, B=py3_5.a)
division_6 = Division(A=pdecon.YComponent, B=py3_5.b)
division_7 = Division(A=pdecon.XComponent, B=py3_5.a)
multiplication_2 = Multiplication(A=division_4, B="-1")

division_8 = Division(A=pdecon_4.YComponent, B=py3_5.b)
division_9 = Division(A=pdecon_4.XComponent, B=py3_5.a)
division_10 = Division(A=pdecon_6.XComponent, B=py3_5.a)
division_11 = Division(A=pdecon_6.YComponent, B=py3_5.b)
division_12 = Division(A=pdecon_5.XComponent, B=py3_5.a)
division_13 = Division(A=pdecon_5.YComponent, B=py3_5.b)
division_14 = Division(A=pdecon_8.XComponent, B=py3_5.a)
division_15 = Division(A=pdecon_8.YComponent, B=py3_5.b)
division_16 = Division(A=pdecon_7.XComponent, B=py3_5.a)
division_17 = Division(A=pdecon_7.YComponent, B=py3_5.b)
division_18 = Division(A=pdecon_9.XComponent, B=py3_5.a)
division_19 = Division(A=pdecon_9.YComponent, B=py3_5.b)
multiplication_3 = Multiplication(A=division_8, B="-1")
multiplication_4 = Multiplication(A=division_11, B="-1")
multiplication_5 = Multiplication(A=division_13, B="-1")
multiplication_6 = Multiplication(A=division_15, B="-1")
multiplication_7 = Multiplication(A=division_17, B="-1")
multiplication_8 = Multiplication(A=division_19, B="-1")
panel_50 = Panel(py3_5.out)
py3_6 = Python3Script(x=division_9, y=multiplication_3, count=py3_4.count_roof)  # -> out, lst_x, lst_y, ct_item; inputs x: tree, y: tree
# ---------- py3_6: Python ----------
"""Grasshopper Script"""

import ghpythonlib.treehelpers as th

ct_item = count
print('item count: ', ct_item)

if ct_item > 0:
    lst_x = th.tree_to_list(x)
    lst_y = th.tree_to_list(y)
    lst_x = lst_x
    lst_y = lst_y

else:
    lst_x = 0
    lst_y = 0

print('\n')
print("relative x (normalized coordinates):")
print(lst_x)
print("relative y (normalized coordinates):")
print(lst_y)
# ---------- end py3_6 ----------
py3_7 = Python3Script(x=division_12, y=multiplication_5, count=py3_4.count_glazing_ground)  # -> out, lst_x, lst_y, ct_item; inputs x: tree, y: tree
# ---------- py3_7: Python ----------
"""Grasshopper Script"""
# r: numpy
import numpy as np
import ghpythonlib.treehelpers as th

ct_item = count
print('item count: ', ct_item)

if ct_item > 0:
    lst_x = th.tree_to_list(x)
    lst_y = th.tree_to_list(y)
    lst_x = lst_x
    lst_y = lst_y
else:
    lst_x = 0
    lst_y = 0

print('\n')
print("relative x (normalized coordinates):")
print(lst_x)
print("relative y (normalized coordinates):")
print(lst_y)
# ---------- end py3_7 ----------
py3_8 = Python3Script(x=division_5, y=multiplication_2, count=py3_4.count_wall)  # -> out, lst_x, lst_y, ct_item; inputs x: tree, y: tree
# ---------- py3_8: Python ----------
"""Grasshopper Script"""
# r: numpy
import numpy as np
import ghpythonlib.treehelpers as th

ct_item = count
print('item count: ', ct_item)

if ct_item > 0:
    lst_x = th.tree_to_list(x)
    lst_y = th.tree_to_list(y)
    lst_x = lst_x
    lst_y = lst_y

else:
    lst_x = 0
    lst_y = 0

print('\n')
print("relative x (normalized coordinates):")
print(lst_x)
print("relative y (normalized coordinates):")
print(lst_y)
# ---------- end py3_8 ----------
py3_9 = Python3Script(x=division_16, y=multiplication_7, count=py3_4.count_balc_door_2nd_floor)  # -> out, lst_x, lst_y, ct_item; inputs x: tree, y: tree; same code as py3_8
py3_10 = Python3Script(x=division_10, y=multiplication_4, count=py3_4.count_window_2nd_floor)  # -> out, lst_x, lst_y, ct_item; inputs x: tree, y: tree; same code as py3_8
py3_11 = Python3Script(x=division_18, y=multiplication_8, count=py3_4.count_balc_door_above_2nd)  # -> out, lst_x, lst_y, ct_item; inputs x: tree, y: tree; same code as py3_8
py3_12 = Python3Script(x=division_14, y=multiplication_6, count=py3_4.count_window_above_2nd)  # -> out, lst_x, lst_y, ct_item; inputs x: tree, y: tree; same code as py3_8
panel_51 = Panel(py3_8.out)
panel_52 = Panel(py3_6.out)
panel_53 = Panel(py3_7.out)
panel_54 = Panel(py3_9.out)
panel_55 = Panel(py3_10.out)
panel_56 = Panel(py3_11.out)
panel_57 = Panel(py3_12.out)

multiplication_9 = Multiplication(A=division_6, B="-1")
py3_13 = Python3Script(x=division_7, y=multiplication_9, count=py3_4.count_garage)  # -> out, lst_x, lst_y, ct_item; inputs x: tree, y: tree; same code as py3_8
panel_58 = Panel(py3_13.out)

# ----
# CREATE PYTHON DICTIONARY
# FOR CONVERSION TO XML (OR JSON)
py3_14 = Python3Script(
    perp_check_2nd=py3_2.out,
    perp_check_top=py3.out,
    x_wall=py3_8.lst_x,
    y_wall=py3_8.lst_y,
    ct_wall=py3_8.ct_item,
    x_roof=py3_6.lst_x,
    y_roof=py3_6.lst_y,
    ct_roof=py3_6.ct_item,
    x_garage=py3_13.lst_x,
    y_garage=py3_13.lst_y,
    ct_garage=py3_13.ct_item,
    x_glazing_ground=py3_7.lst_x,
    y_glazing_ground=py3_7.lst_y,
    ct_glazing_ground=py3_7.ct_item,
    x_window_2nd_floor=py3_10.lst_x,
    y_window_2nd_floor=py3_10.lst_y,
    ct_window_2nd_floor=py3_10.ct_item,
    x_balc_door_2nd_floor=py3_9.lst_x,
    y_balc_door_2nd_floor=py3_9.lst_y,
    ct_balc_door_2nd_floor=py3_9.ct_item,
    x_window_above_2nd=py3_12.lst_x,
    y_window_above_2nd=py3_12.lst_y,
    ct_window_above_2nd=py3_12.ct_item,
    x_balc_door_above_2nd=py3_11.lst_x,
    y_balc_door_above_2nd=py3_11.lst_y,
    ct_balc_door_above_2nd=py3_11.ct_item,
    bldg_WWR=division_3,
    PROJECT_NAME="GSV_Facades",
    IMG_SOURCE="GoogleStreetView",
    SEGMENTED=list_2,
    SAVE_DIR="C:\XML_exports\",
    SAVE_FILE_TYPE=list,
    IMG_PATH=img_path,
    CONFIRM_IMG_PATH=confirm_img_path,
    WRITE_FILE=write_file)  # -> out, a; inputs x_wall: list, y_wall: list, ct_wall: list, x_roof: list, y_roof: list, ct_roof: list, x_garage: list, y_garage: list, ct_garage: list, x_open_area: list, y_open_area: list, ct_open_area: list, x_glazing_ground: list, y_glazing_ground: list, ct_glazing_ground: list, x_window_2nd_floor: list, y_window_2nd_floor: list, ct_window_2nd_floor: list, x_balc_door_2nd_floor: list, y_balc_door_2nd_floor: list, ct_balc_door_2nd_floor: list, x_window_above_2nd: list, y_window_above_2nd: list, ct_window_above_2nd: list, x_balc_door_above_2nd: list, y_balc_door_above_2nd: list, ct_balc_door_above_2nd: list
# ---------- py3_14: Python ----------
"""Grasshopper Script"""

# r: xmltodict
# r: opencv-python

import rhinoscriptsyntax as rs
import Rhino.Geometry as rg
import ghpythonlib.treehelpers as th
import xmltodict
import json
import cv2
import os
from collections import OrderedDict

CLASS_IDS = {'wall': 1, 'roof':2, 'glazing_ground': 3, 'window_2nd_floor': 4, 'balcony_door_2nd_floor': 5, 'window_above_2nd': 6, 'balcony_door_above_2nd': 7, 'garage':8}

print('image path: ', IMG_PATH)
if CONFIRM_IMG_PATH != True:
    print('CONFIRM IMAGE PATH BEFORE CONTINUING')

filename_no_ext, ext = os.path.splitext(os.path.basename(IMG_PATH))
filename_w_ext = filename_no_ext + ext

img_read = cv2.imread(IMG_PATH)
img_height = img_read.shape[0]
img_width = img_read.shape[1]
img_color = img_read.shape[2]

def segmentation_to_bbox(pts_x_lst, pts_y_lst):
# returns a bounding box in xyxy format, given two lists of x- and y- points
  bbox_lst = []
  xmin = min(pts_x_lst)
  ymin = min(pts_y_lst)
  xmax = max(pts_x_lst)
  ymax = max(pts_y_lst)
  return xmin, ymin, xmax, ymax

def format_segmentation(pts_x_lst, pts_y_lst):
# zips two separate lists of x- and y- points into a list of (x,y) tuples
  zipped_lst = list(zip(pts_x_lst,pts_y_lst))
  return zipped_lst

def create_object_entry(name, pts_x_lst, pts_y_lst):
# creates a dictionary entry for the object based on x- and y- points using
# format_segmentation and segmentation_to_bounding box functions
  assert len(pts_x_lst) == len(pts_y_lst), "length of lst_x and lst_y must be equal"

  obj_dict = {}
  global IDX_CURRENT
  for i in range(len(pts_x_lst)):
    #print('IDX_CURRENT: ', IDX_CURRENT)
    obj_dict['object'+str(IDX_CURRENT)] = {}
    obj_dict['object'+str(IDX_CURRENT)]['name'] = name
    obj_dict['object'+str(IDX_CURRENT)]['class_id'] = CLASS_IDS[name]
    xmin, ymin, xmax, ymax = segmentation_to_bbox(pts_x_lst[i], pts_y_lst[i])
    obj_dict['object'+str(IDX_CURRENT)]['bndbox'] = {'xmin':xmin, 'ymin':ymin, 'xmax':xmax, 'ymax':ymax}
    obj_dict['object'+str(IDX_CURRENT)]['segmentation'] = {}
    segmentation_lst = format_segmentation(pts_x_lst[i], pts_y_lst[i])
    for j in range(len(segmentation_lst)):
      idx = j + 1
      obj_dict['object'+str(IDX_CURRENT)]['segmentation']['x'+str(idx)] = segmentation_lst[j][0]
      obj_dict['object'+str(IDX_CURRENT)]['segmentation']['y'+str(idx)] = segmentation_lst[j][1]

    IDX_CURRENT += 1
  return obj_dict


outer_dict = OrderedDict()
outer_dict["annotation"] = {}
outer_dict["annotation"]["folder"] = PROJECT_NAME
outer_dict["annotation"]["filename"] = filename_w_ext
outer_dict["annotation"]["source"] = IMG_SOURCE
outer_dict["annotation"]["size"] = {'width':img_width, 'height': img_height, 'depth': img_color}
outer_dict["annotation"]["segmented"] = SEGMENTED
outer_dict["annotation"]["buildingWWR"] = bldg_WWR
outer_dict["annotation"]["deviationFromPerpAt2ndLevel"] = perp_check_2nd
outer_dict["annotation"]["deviationFromPerpAtTopLevel"] = perp_check_top

# Set global variable for index, e.g. Object1, Object2, etc.
IDX_CURRENT = 1

if ct_wall[0] > 0:
  obj_name = 'wall'
  wall_obj_dict = create_object_entry(obj_name, x_wall, y_wall)
  outer_dict['annotation'].update(wall_obj_dict)
if ct_roof[0] > 0:
  obj_name = 'roof'
  roof_obj_dict = create_object_entry(obj_name, x_roof, y_roof)
  outer_dict['annotation'].update(roof_obj_dict)
if ct_garage[0] > 0:
  obj_name = 'garage'
  garage_obj_dict = create_object_entry(obj_name, x_garage, y_garage)
  outer_dict['annotation'].update(garage_obj_dict)
if ct_glazing_ground[0] > 0:
  obj_name = 'glazing_ground'
  glazing_ground_obj_dict = create_object_entry(obj_name, x_glazing_ground, y_glazing_ground)
  outer_dict['annotation'].update(glazing_ground_obj_dict)
if ct_window_2nd_floor[0] > 0:
  obj_name = 'window_2nd_floor'
  window_2nd_floor_obj_dict = create_object_entry(obj_name, x_window_2nd_floor, y_window_2nd_floor)
  outer_dict['annotation'].update(window_2nd_floor_obj_dict)
if ct_balc_door_2nd_floor[0] > 0:
  obj_name = 'balcony_door_2nd_floor'
  balc_door_2nd_floor_obj_dict = create_object_entry(obj_name, x_balc_door_2nd_floor, y_balc_door_2nd_floor)
  outer_dict['annotation'].update(balc_door_2nd_floor_obj_dict)
if ct_window_above_2nd[0] > 0:
  obj_name = 'window_above_2nd'
  window_above_2nd_obj_dict = create_object_entry(obj_name, x_window_above_2nd, y_window_above_2nd)
  outer_dict['annotation'].update(window_above_2nd_obj_dict)
if ct_balc_door_above_2nd[0] > 0:
  obj_name = 'balcony_door_above_2nd'
  balc_door_above_2nd_obj_dict = create_object_entry(obj_name, x_balc_door_above_2nd, y_balc_door_above_2nd)
  outer_dict['annotation'].update(balc_door_above_2nd_obj_dict)

print(outer_dict)

# Save file in save directory
os.chdir(SAVE_DIR)

if CONFIRM_IMG_PATH == True:
    if WRITE_FILE == True:
        if SAVE_FILE_TYPE == 1:
            with open(filename_no_ext+'.json', 'w') as f:
                json.dump(outer_dict, f, indent=2)
                f.close()
            print(filename_no_ext+'.json created')
        elif SAVE_FILE_TYPE == 2:
            xml_format= xmltodict.unparse(outer_dict,pretty=True)
            with open(filename_no_ext+'.xml', "w") as f:
                f.write(xml_format)
                f.close()
            print(filename_no_ext+'.xml created')

else:
    print('CONFIRM IMAGE PATH BEFORE CONTINUING TO WRITE FILE')
# ---------- end py3_14 ----------
panel_59 = Panel(py3_14.out)
