# Grasshopper definition 08_Grasshopper_script_Dragonfly_UrbanOpt_UBEM.gh (Grasshopper 1.0.8)
# plug-ins: Urbano, LadybugGrasshopper

# ----
# Building ID
# Building Height
# Number of Floors
# WWR - North
# WWR - East
# WWR - South
# WWR - West
panel = Panel("12")
# INDEX NUMBERS
# TO APPLY TO
# EACH ARCHETYPE:
panel_2 = Panel("0")

# ----
# Save data in GEOMETRY
# and internalize data
# Save data in GEOMETRY
# and internalize data
# Bldg Name
# Save in Data
# Internalize data
# Divide:
# UV_Height by
# Flrs_Rnd (round up)
# Result: Flr-Flr Height
# FOR 1st STEP, FOOTPRINT TO 3D:
# Multiply Flr-Flr Ht by
# Flrs_Rnd (up)
# Save in Data
# Internalize data
# Save data in GEOMETRY
# and internalize data
# Bldg Name
# Save in Data
# Internalize data
# Divide:
# UV_Height by
# Flrs_Rnd (round up)
# Result: Flr-Flr Height
# FOR 1st STEP, FOOTPRINT TO 3D:
# Multiply Flr-Flr Ht by
# Flrs_Rnd (up)
# Save in Data
# Internalize data
# Save data GEOMETRY
# and internalize data
# Bldg Name
# Save in Data
# Internalize data
# Divide:
# UV_Height by
# Flrs_Rnd (round up)
# Result: Flr-Flr Height
# FOR 1st STEP, FOOTPRINT TO 3D:
# Multiply Flr-Flr Ht by
# Flrs_Rnd (up)
# Save in Data
# Internalize data
# Save data GEOMETRY
# and internalize data
# Bldg Name
# Save in Data
# Internalize data
# Divide:
# UV_Height by
# Flrs_Rnd (round up)
# Result: Flr-Flr Height
# FOR 1st STEP, FOOTPRINT TO 3D:
# Multiply Flr-Flr Ht by
# Flrs_Rnd (up)
# Save in Data
# Internalize data
# Save data GEOMETRY
# and internalize data
# Bldg Name
# Save in Data
# Internalize data
# Divide:
# UV_Height by
# Flrs_Rnd (round up)
# Result: Flr-Flr Height
# FOR 1st STEP, FOOTPRINT TO 3D:
# Multiply Flr-Flr Ht by
# Flrs_Rnd (up)
# Save in Data
# Internalize data
# Save data GEOMETRY
# and internalize data
# Bldg Name
# Save in Data
# Internalize data
# Divide:
# UV_Height by
# Flrs_Rnd (round up)
# Result: Flr-Flr Height
# FOR 1st STEP, FOOTPRINT TO 3D:
# Multiply Flr-Flr Ht by
# Flrs_Rnd (up)
# Save in Data
# Internalize data
# Save data GEOMETRY
# and internalize data
# Bldg Name
# Save in Data
# Internalize data
# Divide:
# UV_Height by
# Flrs_Rnd (round up)
# Result: Flr-Flr Height
# FOR 1st STEP, FOOTPRINT TO 3D:
# Multiply Flr-Flr Ht by
# Flrs_Rnd (up)
# Save in Data
# Internalize data
# Save data GEOMETRY
# and internalize data
# Bldg Name
# Save in Data
# Internalize data
# Divide:
# UV_Height by
# Flrs_Rnd (round up)
# Result: Flr-Flr Height
# FOR 1st STEP, FOOTPRINT TO 3D:
# Multiply Flr-Flr Ht by
# Flrs_Rnd (up)
# Save in Data
# Internalize data
# Save data GEOMETRY
# and internalize data
# Bldg Name
# Save in Data
# Internalize data
# Divide:
# UV_Height by
# Flrs_Rnd (round up)
# Result: Flr-Flr Height
# FOR 1st STEP, FOOTPRINT TO 3D:
# Multiply Flr-Flr Ht by
# Flrs_Rnd (up)
# Save in Data
# Internalize data
# Save data GEOMETRY
# and internalize data
# Bldg Name
# Save in Data
# Internalize data
# Divide:
# UV_Height by
# Flrs_Rnd (round up)
# Result: Flr-Flr Height
# FOR 1st STEP, FOOTPRINT TO 3D:
# Multiply Flr-Flr Ht by
# Flrs_Rnd (up)
# Save in Data
# Internalize data
# Save data GEOMETRY
# and internalize data
# Bldg Name
# Save in Data
# Internalize data
# Divide:
# UV_Height by
# Flrs_Rnd (round up)
# Result: Flr-Flr Height
# FOR 1st STEP, FOOTPRINT TO 3D:
# Multiply Flr-Flr Ht by
# Flrs_Rnd (up)
# Save in Data
# Internalize data
# Save data GEOMETRY
# and internalize data
# Bldg Name
# Save in Data
# Internalize data
# Divide:
# UV_Height by
# Flrs_Rnd (round up)
# Result: Flr-Flr Height
# FOR 1st STEP, FOOTPRINT TO 3D:
# Multiply Flr-Flr Ht by
# Flrs_Rnd (up)
# Save in Data
# Internalize data
# Save data GEOMETRY
# and internalize data
# Bldg Name
# Save in Data
# Internalize data
# Divide:
# UV_Height by
# Flrs_Rnd (round up)
# Result: Flr-Flr Height
# FOR 1st STEP, FOOTPRINT TO 3D:
# Multiply Flr-Flr Ht by
# Flrs_Rnd (up)
# Save in Data
# Internalize data
# Save data GEOMETRY
# and internalize data
# Bldg Name
# Save in Data
# Internalize data
# Divide:
# UV_Height by
# Flrs_Rnd (round up)
# Result: Flr-Flr Height
# FOR 1st STEP, FOOTPRINT TO 3D:
# Multiply Flr-Flr Ht by
# Flrs_Rnd (up)
# Save in Data
# Internalize data
# Save data GEOMETRY
# and internalize data
# Bldg Name
# Save in Data
# Internalize data
# Divide:
# UV_Height by
# Flrs_Rnd (round up)
# Result: Flr-Flr Height
# FOR 1st STEP, FOOTPRINT TO 3D:
# Multiply Flr-Flr Ht by
# Flrs_Rnd (up)
# Save in Data
# Internalize data
# Save data GEOMETRY
# and internalize data
# Bldg Name
# Save in Data
# Internalize data
# Divide:
# UV_Height by
# Flrs_Rnd (round up)
# Result: Flr-Flr Height
# FOR 1st STEP, FOOTPRINT TO 3D:
# Multiply Flr-Flr Ht by
# Flrs_Rnd (up)
# Save in Data
# Internalize data
# Save data GEOMETRY
# and internalize data
# Bldg Name
# Save in Data
# Internalize data
# Divide:
# UV_Height by
# Flrs_Rnd (round up)
# Result: Flr-Flr Height
# FOR 1st STEP, FOOTPRINT TO 3D:
# Multiply Flr-Flr Ht by
# Flrs_Rnd (up)
# Save in Data
# Internalize data
# Save data GEOMETRY
# and internalize data
# Bldg Name
# Save in Data
# Internalize data
# Divide:
# UV_Height by
# Flrs_Rnd (round up)
# Result: Flr-Flr Height
# FOR 1st STEP, FOOTPRINT TO 3D:
# Multiply Flr-Flr Ht by
# Flrs_Rnd (up)
# Save in Data
# Internalize data
# Save data GEOMETRY
# and internalize data
# Bldg Name
# Save in Data
# Internalize data
# Divide:
# UV_Height by
# Flrs_Rnd (round up)
# Result: Flr-Flr Height
# FOR 1st STEP, FOOTPRINT TO 3D:
# Multiply Flr-Flr Ht by
# Flrs_Rnd (up)
# Save in Data
# Internalize data
# Save data GEOMETRY
# and internalize data
# Bldg Name
# Save in Data
# Internalize data
# Divide:
# UV_Height by
# Flrs_Rnd (round up)
# Result: Flr-Flr Height
# FOR 1st STEP, FOOTPRINT TO 3D:
# Multiply Flr-Flr Ht by
# Flrs_Rnd (up)
# Save in Data
# Internalize data
# Save data GEOMETRY
# and internalize data
# Bldg Name
# Save in Data
# Internalize data
# R7AB
# Divide:
# UV_Height by
# Flrs_Rnd (round up)
# Result: Flr-Flr Height
# FOR 1st STEP, FOOTPRINT TO 3D:
# Multiply Flr-Flr Ht by
# Flrs_Rnd (up)
# Save in Data
# Internalize data
# Save data GEOMETRY
# and internalize data
# Bldg Name
# Save in Data
# Internalize data
# Divide:
# UV_Height by
# Flrs_Rnd (round up)
# Result: Flr-Flr Height
# FOR 1st STEP, FOOTPRINT TO 3D:
# Multiply Flr-Flr Ht by
# Flrs_Rnd (up)
# Save in Data
# Internalize data
# Save data GEOMETRY
# and internalize data
# Bldg Name
# Save in Data
# Internalize data
# Divide:
# UV_Height by
# Flrs_Rnd (round up)
# Result: Flr-Flr Height
# FOR 1st STEP, FOOTPRINT TO 3D:
# Multiply Flr-Flr Ht by
# Flrs_Rnd (up)
# Save in Data
# Internalize data
# Save data GEOMETRY
# and internalize data
# Bldg Name
# Save in Data
# Internalize data
# Divide:
# UV_Height by
# Flrs_Rnd (round up)
# Result: Flr-Flr Height
# FOR 1st STEP, FOOTPRINT TO 3D:
# Multiply Flr-Flr Ht by
# Flrs_Rnd (up)
# Save in Data
# Internalize data
# Save data GEOMETRY
# and internalize data
# Bldg Name
# Save in Data
# Internalize data
# Divide:
# UV_Height by
# Flrs_Rnd (round up)
# Result: Flr-Flr Height
# FOR 1st STEP, FOOTPRINT TO 3D:
# Multiply Flr-Flr Ht by
# Flrs_Rnd (up)
# Save in Data
# Internalize data
# Save data GEOMETRY
# and internalize data
# Bldg Name
# Save in Data
# Internalize data
# Divide:
# UV_Height by
# Flrs_Rnd (round up)
# Result: Flr-Flr Height
# FOR 1st STEP, FOOTPRINT TO 3D:
# Multiply Flr-Flr Ht by
# Flrs_Rnd (up)
# Save in Data
# Internalize data
# Save data GEOMETRY
# and internalize data
# Bldg Name
# Save in Data
# Internalize data
# Divide:
# UV_Height by
# Flrs_Rnd (round up)
# Result: Flr-Flr Height
# FOR 1st STEP, FOOTPRINT TO 3D:
# Multiply Flr-Flr Ht by
# Flrs_Rnd (up)
# Save in Data
# Internalize data
# Save data GEOMETRY
# and internalize data
# Bldg Name
# Save in Data
# Internalize data
# Divide:
# UV_Height by
# Flrs_Rnd (round up)
# Result: Flr-Flr Height
# FOR 1st STEP, FOOTPRINT TO 3D:
# Multiply Flr-Flr Ht by
# Flrs_Rnd (up)
# Save in Data
# Internalize data
# Save data GEOMETRY
# and internalize data
# Bldg Name
# Save in Data
# Internalize data
# Bldg Height
# Save in Data
# Internalize Data
# Save data GEOMETRY
# and internalize data
# Bldg Name
# Save in Data
# Internalize data
# Bldg Height
# Save in Data
# Internalize Data
toggle = BooleanToggle(True)
file_path = FilePath()
# R6TH
toggle_2 = BooleanToggle(True)
# R6SF
# NOT PRESENT IN CASE STUDY
toggle_3 = BooleanToggle(True)  # disabled
# R2AB
toggle_4 = BooleanToggle(True)
file_path_2 = FilePath()
# R2MF
toggle_5 = BooleanToggle(True)
file_path_3 = FilePath()  # disabled
# R5AB
toggle_6 = BooleanToggle(True)
# R4AB
toggle_7 = BooleanToggle(True)
# R5SF
# NOT PRESENT IN CASE STUDY
toggle_8 = BooleanToggle(True)  # disabled
file_path_4 = FilePath()
# R7MF
toggle_9 = BooleanToggle(True)
# R4TH
toggle_10 = BooleanToggle(True)
# R7TH
toggle_11 = BooleanToggle(True)
# R2TH
toggle_12 = BooleanToggle(True)
# R2SF
# NOT PRESENT IN CASE STUDY
toggle_13 = BooleanToggle(True)  # disabled
# R6AB
toggle_14 = BooleanToggle(True)
# R3SF
toggle_15 = BooleanToggle(True)
# R3TH
toggle_16 = BooleanToggle(True)
# R6MF
toggle_17 = BooleanToggle(True)
file_path_5 = FilePath()
# R7SF
# NOT PRESENT IN CASE STUDY
toggle_18 = BooleanToggle(True)  # disabled
# R4MF
toggle_19 = BooleanToggle(True)
file_path_6 = FilePath()
path_to_shapefile = Panel(file_path)
# R3MF
toggle_20 = BooleanToggle(True)
# R4SF
toggle_21 = BooleanToggle(True)
file_path_7 = FilePath()  # disabled
file_path_8 = FilePath()
file_path_9 = FilePath()
file_path_10 = FilePath()
# R3AB
toggle_22 = BooleanToggle(True)
# R5MF
toggle_23 = BooleanToggle(True)
file_path_11 = FilePath()
file_path_12 = FilePath()  # disabled
file_path_13 = FilePath()
file_path_14 = FilePath()
file_path_15 = FilePath()
file_path_16 = FilePath()
file_path_17 = FilePath()
panel_3 = Panel("32T")  # disabled
file_path_18 = FilePath()
file_path_19 = FilePath()  # disabled
file_path_20 = FilePath()
file_path_21 = FilePath()
file_path_22 = FilePath()
path_to_shapefile_2 = Panel(file_path_19)  # disabled
file_path_23 = FilePath()
path_to_shapefile_3 = Panel(file_path_15)
file_path_24 = FilePath()
# R5TH
path_to_shapefile_4 = Panel(file_path_24)
panel_4 = Panel("32T")  # disabled
# R8TH
toggle_24 = BooleanToggle(True)
path_to_shapefile_5 = Panel(file_path_2)
# R8AB
toggle_25 = BooleanToggle(True)
path_to_shapefile_6 = Panel(file_path_13)
panel_5 = Panel("32T")  # disabled
path_to_shapefile_7 = Panel(file_path_4)
path_to_shapefile_8 = Panel(file_path_6)
# R8MF
# NOT PRESENT IN CASE STUDY
toggle_26 = BooleanToggle(True)  # disabled
# DISTRICT
# BORDER
toggle_27 = BooleanToggle(True)
path_to_shapefile_9 = Panel(file_path_10)
panel_6 = Panel("32T")  # disabled
path_to_shapefile_10 = Panel(file_path_14)
path_to_shapefile_11 = Panel(file_path_5)
path_to_shapefile_12 = Panel(file_path_8)
file_path_25 = FilePath()
path_to_shapefile_13 = Panel(file_path_7)  # disabled
file_path_26 = FilePath()
path_to_shapefile_14 = Panel(file_path_20)
path_to_shapefile_15 = Panel(file_path_21)
file_path_27 = FilePath()
path_to_shapefile_16 = Panel(file_path_12)  # disabled
file_path_28 = FilePath()  # disabled
path_to_shapefile_17 = Panel(file_path_22)
path_to_shapefile_18 = Panel(file_path_3)  # disabled
path_to_shapefile_19 = Panel(file_path_9)
path_to_shapefile_20 = Panel(file_path_23)
import_shapefile_features_r2ab = ImportShapefileFeatures(ShapefilePath=file_path_4, Reproject=toggle_4, UTMZone="32T")  # -> Points, Metadata, UTMZone, TranslationVectorR2AB
import_shapefile_features = ImportShapefileFeatures(
    ShapefilePath=file_path,
    Reproject=toggle,
    UTMZone="32T",
    TranslationVector=import_shapefile_features_r2ab.TranslationVectorR2AB)  # -> Points, Metadata, UTMZone, TranslationVector
import_shapefile_features_2 = ImportShapefileFeatures(
    ShapefilePath=file_path_2,
    Reproject=toggle_2,
    UTMZone="32T",
    TranslationVector=import_shapefile_features_r2ab.TranslationVectorR2AB)  # -> Points, Metadata, UTMZone, TranslationVector
import_shapefile_features_3 = ImportShapefileFeatures(
    ShapefilePath=file_path_3,
    Reproject=toggle_3,
    UTMZone=panel_3,
    TranslationVector=import_shapefile_features_r2ab.TranslationVectorR2AB)  # -> Points, Metadata, UTMZone, TranslationVector; disabled
path_to_shapefile_21 = Panel(file_path_11)
# R8SF
# NOT PRESENT IN CASE STUDY
toggle_28 = BooleanToggle(True)  # disabled
import_shapefile_features_4 = ImportShapefileFeatures(
    ShapefilePath=file_path_5,
    Reproject=toggle_5,
    UTMZone="32T",
    TranslationVector=import_shapefile_features_r2ab.TranslationVectorR2AB)  # -> Points, Metadata, UTMZone, TranslationVector
import_shapefile_features_5 = ImportShapefileFeatures(
    ShapefilePath=file_path_8,
    Reproject=toggle_7,
    UTMZone="32T",
    TranslationVector=import_shapefile_features_r2ab.TranslationVectorR2AB)  # -> Points, Metadata, UTMZone, TranslationVector
path_to_shapefile_22 = Panel(file_path_18)
path_to_shapefile_23 = Panel(file_path_17)
import_shapefile_features_6 = ImportShapefileFeatures(
    ShapefilePath=file_path_6,
    Reproject=toggle_6,
    UTMZone="32T",
    TranslationVector=import_shapefile_features_r2ab.TranslationVectorR2AB)  # -> Points, Metadata, UTMZone, TranslationVector
import_shapefile_features_7 = ImportShapefileFeatures(
    ShapefilePath=file_path_7,
    Reproject=toggle_8,
    UTMZone=panel_4,
    TranslationVector=import_shapefile_features_r2ab.TranslationVectorR2AB)  # -> Points, Metadata, UTMZone, TranslationVector; disabled
import_shapefile_features_8 = ImportShapefileFeatures(
    ShapefilePath=file_path_10,
    Reproject=toggle_9,
    UTMZone="32T",
    TranslationVector=import_shapefile_features_r2ab.TranslationVectorR2AB)  # -> Points, Metadata, UTMZone, TranslationVector
import_shapefile_features_9 = ImportShapefileFeatures(
    ShapefilePath=file_path_9,
    Reproject=toggle_10,
    UTMZone="32T",
    TranslationVector=import_shapefile_features_r2ab.TranslationVectorR2AB)  # -> Points, Metadata, UTMZone, TranslationVector
panel_7 = Panel("32T")  # disabled
file_path_29 = FilePath()  # disabled
import_shapefile_features_10 = ImportShapefileFeatures(
    ShapefilePath=file_path_13,
    Reproject=toggle_11,
    UTMZone="32T",
    TranslationVector=import_shapefile_features_r2ab.TranslationVectorR2AB)  # -> Points, Metadata, UTMZone, TranslationVector
import_shapefile_features_11 = ImportShapefileFeatures(
    ShapefilePath=file_path_11,
    Reproject=toggle_12,
    UTMZone="32T",
    TranslationVector=import_shapefile_features_r2ab.TranslationVectorR2AB)  # -> Points, Metadata, UTMZone, TranslationVector
import_shapefile_features_12 = ImportShapefileFeatures(
    ShapefilePath=file_path_12,
    Reproject=toggle_13,
    UTMZone=panel_5,
    TranslationVector=import_shapefile_features_r2ab.TranslationVectorR2AB)  # -> Points, Metadata, UTMZone, TranslationVector; disabled
import_shapefile_features_13 = ImportShapefileFeatures(
    ShapefilePath=file_path_16,
    Reproject=toggle_14,
    UTMZone="32T",
    TranslationVector=import_shapefile_features_r2ab.TranslationVectorR2AB)  # -> Points, Metadata, UTMZone, TranslationVector
import_shapefile_features_14 = ImportShapefileFeatures(
    ShapefilePath=file_path_14,
    Reproject=toggle_15,
    UTMZone="32T",
    TranslationVector=import_shapefile_features_r2ab.TranslationVectorR2AB)  # -> Points, Metadata, UTMZone, TranslationVector
import_shapefile_features_15 = ImportShapefileFeatures(
    ShapefilePath=file_path_15,
    Reproject=toggle_16,
    UTMZone="32T",
    TranslationVector=import_shapefile_features_r2ab.TranslationVectorR2AB)  # -> Points, Metadata, UTMZone, TranslationVector
path_to_shapefile_24 = Panel(file_path_16)
import_shapefile_features_16 = ImportShapefileFeatures(
    ShapefilePath=file_path_17,
    Reproject=toggle_17,
    UTMZone="32T",
    TranslationVector=import_shapefile_features_r2ab.TranslationVectorR2AB)  # -> Points, Metadata, UTMZone, TranslationVector
import_shapefile_features_17 = ImportShapefileFeatures(
    ShapefilePath=file_path_19,
    Reproject=toggle_18,
    UTMZone=panel_6,
    TranslationVector=import_shapefile_features_r2ab.TranslationVectorR2AB)  # -> Points, Metadata, UTMZone, TranslationVector; disabled
import_shapefile_features_18 = ImportShapefileFeatures(
    ShapefilePath=file_path_18,
    Reproject=toggle_19,
    UTMZone="32T",
    TranslationVector=import_shapefile_features_r2ab.TranslationVectorR2AB)  # -> Points, Metadata, UTMZone, TranslationVector
import_shapefile_features_19 = ImportShapefileFeatures(
    ShapefilePath=file_path_20,
    Reproject=toggle_20,
    UTMZone="32T",
    TranslationVector=import_shapefile_features_r2ab.TranslationVectorR2AB)  # -> Points, Metadata, UTMZone, TranslationVector
import_shapefile_features_20 = ImportShapefileFeatures(
    ShapefilePath=file_path_21,
    Reproject=toggle_21,
    UTMZone="32T",
    TranslationVector=import_shapefile_features_r2ab.TranslationVectorR2AB)  # -> Points, Metadata, UTMZone, TranslationVector
path_to_shapefile_25 = Panel(file_path_26)
import_shapefile_features_21 = ImportShapefileFeatures(
    ShapefilePath=file_path_22,
    Reproject=toggle_22,
    UTMZone="32T",
    TranslationVector=import_shapefile_features_r2ab.TranslationVectorR2AB)  # -> Points, Metadata, UTMZone, TranslationVector
import_shapefile_features_22 = ImportShapefileFeatures(
    ShapefilePath=file_path_23,
    Reproject=toggle_23,
    UTMZone="32T",
    TranslationVector=import_shapefile_features_r2ab.TranslationVectorR2AB)  # -> Points, Metadata, UTMZone, TranslationVector
path_to_shapefile_26 = Panel(file_path_28)  # disabled
path_to_shapefile_27 = Panel(file_path_25)
import_shapefile_features_23 = ImportShapefileFeatures(
    ShapefilePath=file_path_24,
    Reproject=Toggle(True),
    UTMZone="32T",
    TranslationVector=import_shapefile_features_r2ab.TranslationVectorR2AB)  # -> Points, Metadata, UTMZone, TranslationVector
# GIS WORKFLOW USING URBANO TOOLSET:
# IMPORT SHP POINTS, CONVERT TO POLYGONS
#      --> STORE IN GEOMETRY AND INTERNALIZE DATA
# IMPORT METADATA FOR STORIES, OVERALL HEIGHT & FLR-FLR HEIGHT
#      --> STORE IN DATA AND INTERNALIZE DATA
path_to_shapefile_28 = Panel(file_path_27)
polyline = PolyLine(Vertices=import_shapefile_features.Points, Closed=False)  # -> simplify(Polyline)
panel_8 = Panel("32T")  # disabled
import_shapefile_features_24 = ImportShapefileFeatures(
    ShapefilePath=file_path_25,
    Reproject=toggle_24,
    UTMZone="32T",
    TranslationVector=import_shapefile_features_r2ab.TranslationVectorR2AB)  # -> Points, Metadata, UTMZone, TranslationVector
polyline_2 = PolyLine(Vertices=import_shapefile_features_2.Points, Closed=False)  # -> simplify(Polyline)
import_shapefile_features_25 = ImportShapefileFeatures(
    ShapefilePath=file_path_26,
    Reproject=toggle_25,
    UTMZone="32T",
    TranslationVector=import_shapefile_features_r2ab.TranslationVectorR2AB)  # -> Points, Metadata, UTMZone, TranslationVector
import_shapefile_features_26 = ImportShapefileFeatures(
    ShapefilePath=file_path_27,
    Reproject=toggle_27,
    UTMZone="32T",
    TranslationVector=import_shapefile_features_r2ab.TranslationVectorR2AB)  # -> Points, Metadata, UTMZone, TranslationVector
import_shapefile_features_27 = ImportShapefileFeatures(
    ShapefilePath=file_path_28,
    Reproject=toggle_26,
    UTMZone=panel_7,
    TranslationVector=import_shapefile_features_r2ab.TranslationVectorR2AB)  # -> Points, Metadata, UTMZone, TranslationVector; disabled
polyline_3 = PolyLine(Vertices=import_shapefile_features_3.Points, Closed=False)  # -> simplify(Polyline); disabled
path_to_shapefile_29 = Panel(file_path_29)  # disabled
polyline_4 = PolyLine(Vertices=import_shapefile_features_r2ab.Points, Closed=False)  # -> simplify(Polyline)
polyline_5 = PolyLine(Vertices=import_shapefile_features_6.Points, Closed=False)  # -> simplify(Polyline)
polyline_6 = PolyLine(Vertices=import_shapefile_features_5.Points, Closed=False)  # -> simplify(Polyline)
polyline_7 = PolyLine(Vertices=import_shapefile_features_7.Points, Closed=False)  # -> simplify(Polyline); disabled
polyline_8 = PolyLine(Vertices=import_shapefile_features_8.Points, Closed=False)  # -> simplify(Polyline)
polyline_9 = PolyLine(Vertices=import_shapefile_features_9.Points, Closed=False)  # -> simplify(Polyline)
polyline_10 = PolyLine(Vertices=import_shapefile_features_4.Points, Closed=False)  # -> simplify(Polyline)
polyline_11 = PolyLine(Vertices=import_shapefile_features_10.Points, Closed=False)  # -> simplify(Polyline)
polyline_12 = PolyLine(Vertices=import_shapefile_features_11.Points, Closed=False)  # -> simplify(Polyline)
polyline_13 = PolyLine(Vertices=import_shapefile_features_12.Points, Closed=False)  # -> simplify(Polyline); disabled
polyline_14 = PolyLine(Vertices=import_shapefile_features_13.Points, Closed=False)  # -> simplify(Polyline)
polyline_15 = PolyLine(Vertices=import_shapefile_features_14.Points, Closed=False)  # -> simplify(Polyline)
polyline_16 = PolyLine(Vertices=import_shapefile_features_15.Points, Closed=False)  # -> simplify(Polyline)
polyline_17 = PolyLine(Vertices=import_shapefile_features_16.Points, Closed=False)  # -> simplify(Polyline)
import_shapefile_features_28 = ImportShapefileFeatures(
    ShapefilePath=file_path_29,
    Reproject=toggle_28,
    UTMZone=panel_8,
    TranslationVector=import_shapefile_features_r2ab.TranslationVectorR2AB)  # -> Points, Metadata, UTMZone, TranslationVector; disabled
polyline_18 = PolyLine(Vertices=import_shapefile_features_17.Points, Closed=False)  # -> simplify(Polyline); disabled
polyline_19 = PolyLine(Vertices=import_shapefile_features_18.Points, Closed=False)  # -> simplify(Polyline)
polyline_20 = PolyLine(Vertices=import_shapefile_features_19.Points, Closed=False)  # -> simplify(Polyline)
polyline_21 = PolyLine(Vertices=import_shapefile_features_20.Points, Closed=False)  # -> simplify(Polyline)
polyline_22 = PolyLine(Vertices=import_shapefile_features_21.Points, Closed=False)  # -> simplify(Polyline)
polyline_23 = PolyLine(Vertices=import_shapefile_features_22.Points, Closed=False)  # -> simplify(Polyline)
polyline_24 = PolyLine(Vertices=import_shapefile_features_23.Points, Closed=False)  # -> simplify(Polyline)
# CONTEXT BUILDINGS -
# Non-Res
toggle_29 = BooleanToggle(True)
# CONTEXT BUILDINGS -
# Res
toggle_30 = BooleanToggle(True)
polyline_25 = PolyLine(Vertices=import_shapefile_features_24.Points, Closed=False)  # -> simplify(Polyline)
polyline_26 = PolyLine(Vertices=import_shapefile_features_25.Points, Closed=False)  # -> simplify(Polyline)
path = FilePath()
path_2 = FilePath()
polyline_27 = PolyLine(Vertices=import_shapefile_features_27.Points, Closed=False)  # -> simplify(Polyline); disabled
deconstruct_metadata = DeconstructMetadata(Metadata=import_shapefile_features.Metadata)  # -> Keys, Values
deconstruct_metadata_2 = DeconstructMetadata(Metadata=import_shapefile_features_r2ab.Metadata)  # -> Keys, Values
polyline_28 = PolyLine(Vertices=import_shapefile_features_28.Points, Closed=False)  # -> simplify(Polyline); disabled
deconstruct_metadata_3 = DeconstructMetadata(Metadata=import_shapefile_features_2.Metadata)  # -> Keys, Values
deconstruct_metadata_4 = DeconstructMetadata(Metadata=import_shapefile_features_3.Metadata)  # -> Keys, Values; disabled
deconstruct_metadata_5 = DeconstructMetadata(Metadata=import_shapefile_features_4.Metadata)  # -> Keys, Values
import_shapefile_features_29 = ImportShapefileFeatures(
    ShapefilePath=path,
    Reproject=toggle_29,
    UTMZone="32T",
    TranslationVector=import_shapefile_features_r2ab.TranslationVectorR2AB)  # -> Points, Metadata, UTMZone, TranslationVector
deconstruct_metadata_6 = DeconstructMetadata(Metadata=import_shapefile_features_6.Metadata)  # -> Keys, Values
import_shapefile_features_30 = ImportShapefileFeatures(
    ShapefilePath=path_2,
    Reproject=toggle_30,
    UTMZone="32T",
    TranslationVector=import_shapefile_features_r2ab.TranslationVectorR2AB)  # -> Points, Metadata, UTMZone, TranslationVector
deconstruct_metadata_7 = DeconstructMetadata(Metadata=import_shapefile_features_5.Metadata)  # -> Keys, Values
deconstruct_metadata_8 = DeconstructMetadata(Metadata=import_shapefile_features_7.Metadata)  # -> Keys, Values; disabled
deconstruct_metadata_9 = DeconstructMetadata(Metadata=import_shapefile_features_8.Metadata)  # -> Keys, Values
deconstruct_metadata_10 = DeconstructMetadata(Metadata=import_shapefile_features_9.Metadata)  # -> Keys, Values
path_to_shapefile_30 = Panel(path)
path_to_shapefile_31 = Panel(path_2)
deconstruct_metadata_11 = DeconstructMetadata(Metadata=import_shapefile_features_10.Metadata)  # -> Keys, Values
deconstruct_metadata_12 = DeconstructMetadata(Metadata=import_shapefile_features_11.Metadata)  # -> Keys, Values
deconstruct_metadata_13 = DeconstructMetadata(Metadata=import_shapefile_features_12.Metadata)  # -> Keys, Values; disabled
deconstruct_metadata_14 = DeconstructMetadata(Metadata=import_shapefile_features_13.Metadata)  # -> Keys, Values
deconstruct_metadata_15 = DeconstructMetadata(Metadata=import_shapefile_features_14.Metadata)  # -> Keys, Values
deconstruct_metadata_16 = DeconstructMetadata(Metadata=import_shapefile_features_15.Metadata)  # -> Keys, Values
deconstruct_metadata_17 = DeconstructMetadata(Metadata=import_shapefile_features_16.Metadata)  # -> Keys, Values
deconstruct_metadata_18 = DeconstructMetadata(Metadata=import_shapefile_features_17.Metadata)  # -> Keys, Values; disabled
deconstruct_metadata_19 = DeconstructMetadata(Metadata=import_shapefile_features_18.Metadata)  # -> Keys, Values
deconstruct_metadata_20 = DeconstructMetadata(Metadata=import_shapefile_features_19.Metadata)  # -> Keys, Values
deconstruct_metadata_21 = DeconstructMetadata(Metadata=import_shapefile_features_20.Metadata)  # -> Keys, Values
panel_9 = Panel(polyline_4)
deconstruct_metadata_22 = DeconstructMetadata(Metadata=import_shapefile_features_21.Metadata)  # -> Keys, Values
deconstruct_metadata_23 = DeconstructMetadata(Metadata=import_shapefile_features_22.Metadata)  # -> Keys, Values
deconstruct_metadata_24 = DeconstructMetadata(Metadata=import_shapefile_features_23.Metadata)  # -> Keys, Values
deconstruct_metadata_25 = DeconstructMetadata(Metadata=import_shapefile_features_24.Metadata)  # -> Keys, Values
deconstruct_metadata_26 = DeconstructMetadata(Metadata=import_shapefile_features_25.Metadata)  # -> Keys, Values
deconstruct_metadata_27 = DeconstructMetadata(Metadata=import_shapefile_features_27.Metadata)  # -> Keys, Values; disabled
polyline_29 = PolyLine(Vertices=import_shapefile_features_26.Points, Closed=False)
panel_10 = Panel(deconstruct_metadata.Keys)
panel_11 = Panel(deconstruct_metadata_3.Keys)
deconstruct_metadata_28 = DeconstructMetadata(Metadata=import_shapefile_features_28.Metadata)  # -> Keys, Values; disabled
panel_12 = Panel(deconstruct_metadata_2.Keys)
panel_13 = Panel(deconstruct_metadata_4.Keys)  # disabled
panel_14 = Panel(deconstruct_metadata_5.Keys)
panel_15 = Panel(deconstruct_metadata_6.Keys)
panel_16 = Panel(deconstruct_metadata_8.Keys)  # disabled
panel_17 = Panel(deconstruct_metadata_7.Keys)
panel_18 = Panel(deconstruct_metadata_10.Keys)
panel_19 = Panel(deconstruct_metadata_9.Keys)
panel_20 = Panel(deconstruct_metadata_12.Keys)
panel_21 = Panel(deconstruct_metadata_11.Keys)
panel_22 = Panel(deconstruct_metadata_13.Keys)  # disabled
panel_23 = Panel(deconstruct_metadata_15.Keys)
panel_24 = Panel(deconstruct_metadata_16.Keys)
panel_25 = Panel(deconstruct_metadata_14.Keys)
panel_26 = Panel(deconstruct_metadata_17.Keys)
panel_27 = Panel(deconstruct_metadata_19.Keys)
panel_28 = Panel(deconstruct_metadata_20.Keys)
panel_29 = Panel(deconstruct_metadata_18.Keys)  # disabled
panel_30 = Panel(deconstruct_metadata_21.Keys)
panel_31 = Panel(deconstruct_metadata_22.Keys)
panel_32 = Panel(deconstruct_metadata_23.Keys)
panel_33 = Panel(deconstruct_metadata_24.Keys)
panel_34 = Panel(deconstruct_metadata_25.Keys)
panel_35 = Panel(deconstruct_metadata_26.Keys)
panel_36 = Panel(deconstruct_metadata_27.Keys)  # disabled
panel_37 = Panel(deconstruct_metadata.Values)
deconstruct_metadata_29 = DeconstructMetadata(Metadata=graft(import_shapefile_features_29.Metadata))  # -> simplify(Keys), simplify(Values)
deconstruct_metadata_30 = DeconstructMetadata(Metadata=graft(import_shapefile_features_30.Metadata))  # -> simplify(Keys), simplify(Values)
panel_38 = Panel(deconstruct_metadata_3.Values)
panel_39 = Panel(deconstruct_metadata_28.Keys)  # disabled
trim = TrimTree(Tree=import_shapefile_features_29.Points, Depth=1)
trim_2 = TrimTree(Tree=import_shapefile_features_30.Points, Depth=1)
panel_40 = Panel(deconstruct_metadata_4.Values)  # disabled
panel_41 = Panel(deconstruct_metadata_2.Values)
panel_42 = Panel(deconstruct_metadata_6.Values)
panel_43 = Panel(deconstruct_metadata_8.Values)  # disabled
panel_44 = Panel(deconstruct_metadata_7.Values)
panel_45 = Panel(deconstruct_metadata_10.Values)
panel_46 = Panel(deconstruct_metadata_9.Values)
panel_47 = Panel(deconstruct_metadata_5.Values)
panel_48 = Panel(deconstruct_metadata_12.Values)
panel_49 = Panel(deconstruct_metadata_11.Values)
panel_50 = Panel(deconstruct_metadata_13.Values)  # disabled
panel_51 = Panel(deconstruct_metadata_15.Values)
panel_52 = Panel(deconstruct_metadata_16.Values)
panel_53 = Panel(deconstruct_metadata_14.Values)
panel_54 = Panel(deconstruct_metadata_17.Values)
panel_55 = Panel(deconstruct_metadata_19.Values)
panel_56 = Panel(deconstruct_metadata_18.Values)  # disabled
panel_57 = Panel(deconstruct_metadata_20.Values)
panel_58 = Panel(deconstruct_metadata_21.Values)
panel_59 = Panel(deconstruct_metadata_22.Values)
panel_60 = Panel(deconstruct_metadata_23.Values)
panel_61 = Panel(deconstruct_metadata_24.Values)
panel_62 = Panel(deconstruct_metadata_25.Values)
panel_63 = Panel(deconstruct_metadata_26.Values)
panel_64 = Panel(deconstruct_metadata_27.Values)  # disabled
panel_65 = Panel(trim)
panel_66 = Panel(trim_2)
panel_67 = Panel(deconstruct_metadata_28.Values)  # disabled
panel_68 = Panel(deconstruct_metadata_29.Keys)
panel_69 = Panel(deconstruct_metadata_30.Keys)
num_flrs_rndup = ListItem(List=deconstruct_metadata.Values, Index="10", Wrap=True)
uv_height = ListItem(List=deconstruct_metadata.Values, Index="11", Wrap=True)
bldg_name = ListItem(List=deconstruct_metadata.Values, Index=panel_2, Wrap=True)  # -> simplify(Item)
num_flrs_rndup_2 = ListItem(List=deconstruct_metadata_3.Values, Index="10", Wrap=True)
uv_height_2 = ListItem(List=deconstruct_metadata_3.Values, Index="11", Wrap=True)
bldg_name_2 = ListItem(List=deconstruct_metadata_3.Values, Index=panel_2, Wrap=True)  # -> simplify(Item)
num_flrs_rndup_3 = ListItem(List=deconstruct_metadata_2.Values, Index="10", Wrap=True)
uv_height_3 = ListItem(List=deconstruct_metadata_2.Values, Index="11", Wrap=True)
bldg_name_3 = ListItem(List=deconstruct_metadata_2.Values, Index=panel_2, Wrap=True)  # -> simplify(Item)
num_flrs_rndup_4 = ListItem(List=deconstruct_metadata_11.Values, Index="10", Wrap=True)
uv_height_4 = ListItem(List=deconstruct_metadata_11.Values, Index="11", Wrap=True)
bldg_name_4 = ListItem(List=deconstruct_metadata_11.Values, Index=panel_2, Wrap=True)  # -> simplify(Item)
num_flrs_rndup_5 = ListItem(List=deconstruct_metadata_13.Values, Index="10", Wrap=True)  # disabled
num_flrs_rndup_6 = ListItem(List=deconstruct_metadata_18.Values, Index="10", Wrap=True)  # disabled
uv_height_5 = ListItem(List=deconstruct_metadata_13.Values, Index="11", Wrap=True)  # disabled
uv_height_6 = ListItem(List=deconstruct_metadata_18.Values, Index="11", Wrap=True)  # disabled
bldg_name_5 = ListItem(List=deconstruct_metadata_13.Values, Index=panel_2, Wrap=True)  # -> simplify(Item); disabled
num_flrs_rndup_7 = ListItem(List=deconstruct_metadata_9.Values, Index="10", Wrap=True)
bldg_name_6 = ListItem(List=deconstruct_metadata_18.Values, Index=panel_2, Wrap=True)  # -> simplify(Item); disabled
uv_height_7 = ListItem(List=deconstruct_metadata_9.Values, Index="11", Wrap=True)
bldg_name_7 = ListItem(List=deconstruct_metadata_9.Values, Index=panel_2, Wrap=True)  # -> simplify(Item)
num_flrs_rndup_8 = ListItem(List=deconstruct_metadata_16.Values, Index="10", Wrap=True)
uv_height_8 = ListItem(List=deconstruct_metadata_16.Values, Index="11", Wrap=True)
num_flrs_rndup_9 = ListItem(List=deconstruct_metadata_8.Values, Index="10", Wrap=True)  # disabled
bldg_name_8 = ListItem(List=deconstruct_metadata_16.Values, Index=panel_2, Wrap=True)  # -> simplify(Item)
uv_height_9 = ListItem(List=deconstruct_metadata_8.Values, Index="11", Wrap=True)  # disabled
bldg_name_9 = ListItem(List=deconstruct_metadata_8.Values, Index=panel_2, Wrap=True)  # -> simplify(Item); disabled
num_flrs_rndup_10 = ListItem(List=deconstruct_metadata_14.Values, Index="10", Wrap=True)
uv_height_10 = ListItem(List=deconstruct_metadata_14.Values, Index="11", Wrap=True)
num_flrs_rndup_11 = ListItem(List=deconstruct_metadata_4.Values, Index="10", Wrap=True)  # disabled
uv_height_11 = ListItem(List=deconstruct_metadata_4.Values, Index="11", Wrap=True)  # disabled
polyline_30 = PolyLine(Vertices=trim, Closed=False)  # -> simplify(Polyline)
bldg_name_10 = ListItem(List=deconstruct_metadata_14.Values, Index=panel_2, Wrap=True)  # -> simplify(Item)
bldg_name_11 = ListItem(List=deconstruct_metadata_4.Values, Index=panel_2, Wrap=True)  # -> simplify(Item); disabled
polyline_31 = PolyLine(Vertices=trim_2, Closed=False)  # -> simplify(Polyline)
num_flrs_rndup_12 = ListItem(List=deconstruct_metadata_22.Values, Index="10", Wrap=True)
uv_height_12 = ListItem(List=deconstruct_metadata_22.Values, Index="11", Wrap=True)
num_flrs_rndup_13 = ListItem(List=deconstruct_metadata_5.Values, Index="10", Wrap=True)
uv_height_13 = ListItem(List=deconstruct_metadata_5.Values, Index="11", Wrap=True)
bldg_name_12 = ListItem(List=deconstruct_metadata_22.Values, Index=panel_2, Wrap=True)  # -> simplify(Item)
bldg_name_13 = ListItem(List=deconstruct_metadata_5.Values, Index=panel_2, Wrap=True)  # -> simplify(Item)
num_flrs_rndup_14 = ListItem(List=deconstruct_metadata_7.Values, Index="10", Wrap=True)
uv_height_14 = ListItem(List=deconstruct_metadata_7.Values, Index="11", Wrap=True)
num_flrs_rndup_15 = ListItem(List=deconstruct_metadata_10.Values, Index="10", Wrap=True)
num_flrs_rndup_16 = ListItem(List=deconstruct_metadata_6.Values, Index="10", Wrap=True)
num_flrs_rndup_17 = ListItem(List=deconstruct_metadata_17.Values, Index="10", Wrap=True)
bldg_name_14 = ListItem(List=deconstruct_metadata_7.Values, Index=panel_2, Wrap=True)  # -> simplify(Item)
uv_height_15 = ListItem(List=deconstruct_metadata_10.Values, Index="11", Wrap=True)
uv_height_16 = ListItem(List=deconstruct_metadata_6.Values, Index="11", Wrap=True)
uv_height_17 = ListItem(List=deconstruct_metadata_17.Values, Index="11", Wrap=True)
bldg_name_15 = ListItem(List=deconstruct_metadata_10.Values, Index=panel_2, Wrap=True)  # -> simplify(Item)
bldg_name_16 = ListItem(List=deconstruct_metadata_6.Values, Index=panel_2, Wrap=True)  # -> simplify(Item)
num_flrs_rndup_18 = ListItem(List=deconstruct_metadata_23.Values, Index="10", Wrap=True)
bldg_name_17 = ListItem(List=deconstruct_metadata_17.Values, Index=panel_2, Wrap=True)  # -> simplify(Item)
uv_height_18 = ListItem(List=deconstruct_metadata_23.Values, Index="11", Wrap=True)
num_flrs_rndup_19 = ListItem(List=deconstruct_metadata_21.Values, Index="10", Wrap=True)
bldg_name_18 = ListItem(List=deconstruct_metadata_23.Values, Index=panel_2, Wrap=True)
uv_height_19 = ListItem(List=deconstruct_metadata_21.Values, Index="11", Wrap=True)
bldg_name_19 = ListItem(List=deconstruct_metadata_21.Values, Index=panel_2, Wrap=True)  # -> simplify(Item)
num_flrs_rndup_20 = ListItem(List=deconstruct_metadata_24.Values, Index="10", Wrap=True)
uv_height_20 = ListItem(List=deconstruct_metadata_24.Values, Index="11", Wrap=True)
num_flrs_rndup_21 = ListItem(List=deconstruct_metadata_27.Values, Index="10", Wrap=True)  # disabled
num_flrs_rndup_22 = ListItem(List=deconstruct_metadata_26.Values, Index="10", Wrap=True)
uv_height_21 = ListItem(List=deconstruct_metadata_27.Values, Index="11", Wrap=True)  # disabled
bldg_name_20 = ListItem(List=deconstruct_metadata_24.Values, Index=panel_2, Wrap=True)
uv_height_22 = ListItem(List=deconstruct_metadata_26.Values, Index="11", Wrap=True)
num_flrs_rndup_23 = ListItem(List=deconstruct_metadata_15.Values, Index="10", Wrap=True)
bldg_name_21 = ListItem(List=deconstruct_metadata_27.Values, Index=panel_2, Wrap=True)  # -> simplify(Item); disabled
uv_height_23 = ListItem(List=deconstruct_metadata_15.Values, Index="11", Wrap=True)
bldg_name_22 = ListItem(List=deconstruct_metadata_26.Values, Index=panel_2, Wrap=True)  # -> simplify(Item)
bldg_name_23 = ListItem(List=deconstruct_metadata_15.Values, Index=panel_2, Wrap=True)  # -> simplify(Item)
num_flrs_rndup_24 = ListItem(List=deconstruct_metadata_12.Values, Index="10", Wrap=True)
uv_height_24 = ListItem(List=deconstruct_metadata_12.Values, Index="11", Wrap=True)
num_flrs_rndup_25 = ListItem(List=deconstruct_metadata_19.Values, Index="10", Wrap=True)
bldg_name_24 = ListItem(List=deconstruct_metadata_12.Values, Index=panel_2, Wrap=True)  # -> simplify(Item)
uv_height_25 = ListItem(List=deconstruct_metadata_19.Values, Index="11", Wrap=True)
num_flrs_rndup_26 = ListItem(List=deconstruct_metadata_20.Values, Index="10", Wrap=True)
bldg_name_25 = ListItem(List=deconstruct_metadata_19.Values, Index=panel_2, Wrap=True)  # -> simplify(Item)
uv_height_26 = ListItem(List=deconstruct_metadata_20.Values, Index="11", Wrap=True)
bldg_name_26 = ListItem(List=deconstruct_metadata_20.Values, Index=panel_2, Wrap=True)  # -> simplify(Item)
num_flrs_rndup_27 = ListItem(List=deconstruct_metadata_25.Values, Index="10", Wrap=True)
uv_height_27 = ListItem(List=deconstruct_metadata_25.Values, Index="11", Wrap=True)
bldg_name_27 = ListItem(List=deconstruct_metadata_25.Values, Index=panel_2, Wrap=True)  # -> simplify(Item)
flr_flr_height = Division(A=uv_height, B=num_flrs_rndup)
flr_flr_height_2 = Division(A=uv_height_2, B=num_flrs_rndup_2)
num_flrs_rndup_28 = ListItem(List=deconstruct_metadata_28.Values, Index="10", Wrap=True)  # disabled
uv_height_28 = ListItem(List=deconstruct_metadata_28.Values, Index="11", Wrap=True)  # disabled
bldg_name_28 = ListItem(List=deconstruct_metadata_28.Values, Index=panel_2, Wrap=True)  # -> simplify(Item); disabled
flr_flr_height_3 = Division(A=uv_height_3, B=num_flrs_rndup_3)  # -> simplify(Result)
panel_70 = Panel(num_flrs_rndup)
flr_flr_height_4 = Division(A=uv_height_4, B=num_flrs_rndup_4)
flr_flr_height_5 = Division(A=uv_height_5, B=num_flrs_rndup_5)  # disabled
flr_flr_height_6 = Division(A=uv_height_6, B=num_flrs_rndup_6)  # disabled
panel_71 = Panel(deconstruct_metadata_29.Values)
panel_72 = Panel(deconstruct_metadata_30.Values)
flr_flr_height_7 = Division(A=uv_height_7, B=num_flrs_rndup_7)
flr_flr_height_8 = Division(A=uv_height_8, B=num_flrs_rndup_8)
flr_flr_height_9 = Division(A=uv_height_9, B=num_flrs_rndup_9)  # disabled
flr_flr_height_10 = Division(A=uv_height_10, B=num_flrs_rndup_10)
panel_73 = Panel(num_flrs_rndup_2)
flr_flr_height_11 = Division(A=uv_height_11, B=num_flrs_rndup_11)  # disabled
panel_74 = Panel(num_flrs_rndup_3)
flr_flr_height_12 = Division(A=uv_height_12, B=num_flrs_rndup_12)
flr_flr_height_13 = Division(A=uv_height_13, B=num_flrs_rndup_13)
flr_flr_height_14 = Division(A=uv_height_14, B=num_flrs_rndup_14)
flr_flr_height_15 = Division(A=uv_height_15, B=num_flrs_rndup_15)
flr_flr_height_16 = Division(A=uv_height_16, B=num_flrs_rndup_16)
flr_flr_height_17 = Division(A=uv_height_17, B=num_flrs_rndup_17)
panel_75 = Panel(num_flrs_rndup_4)
flr_flr_height_18 = Division(A=uv_height_18, B=num_flrs_rndup_18)
panel_76 = Panel(num_flrs_rndup_5)  # disabled
flr_flr_height_19 = Division(A=uv_height_19, B=num_flrs_rndup_19)
panel_77 = Panel(num_flrs_rndup_6)  # disabled
panel_78 = Panel(num_flrs_rndup_7)
panel_79 = Panel(num_flrs_rndup_8)
panel_80 = Panel(num_flrs_rndup_9)  # disabled
panel_81 = Panel(num_flrs_rndup_10)
flr_flr_height_20 = Division(A=uv_height_20, B=num_flrs_rndup_20)
panel_82 = Panel(num_flrs_rndup_11)  # disabled
flr_flr_height_21 = Division(A=uv_height_21, B=num_flrs_rndup_21)  # disabled
flr_flr_height_22 = Division(A=uv_height_22, B=num_flrs_rndup_22)
flr_flr_height_23 = Division(A=uv_height_23, B=num_flrs_rndup_23)
panel_83 = Panel(num_flrs_rndup_12)
panel_84 = Panel(num_flrs_rndup_13)
flr_flr_height_24 = Division(A=uv_height_24, B=num_flrs_rndup_24)
flr_flr_height_25 = Division(A=uv_height_25, B=num_flrs_rndup_25)
flr_flr_height_26 = Division(A=uv_height_26, B=num_flrs_rndup_26)
panel_85 = Panel(num_flrs_rndup_14)
panel_86 = Panel(num_flrs_rndup_17)
flr_flr_height_27 = Division(A=uv_height_27, B=num_flrs_rndup_27)
panel_87 = Panel(num_flrs_rndup_15)
panel_88 = Panel(num_flrs_rndup_16)
panel_89 = Panel(flr_flr_height)
panel_90 = Panel(num_flrs_rndup_18)
panel_91 = Panel(num_flrs_rndup_19)
panel_92 = Panel(bldg_name)
panel_93 = Panel(num_flrs_rndup_20)
panel_94 = Panel(num_flrs_rndup_21)  # disabled
panel_95 = Panel(num_flrs_rndup_22)
panel_96 = Panel(num_flrs_rndup_23)
panel_97 = Panel(num_flrs_rndup_24)
panel_98 = Panel(flr_flr_height_2)
panel_99 = Panel(num_flrs_rndup_25)
panel_100 = Panel(num_flrs_rndup_26)
panel_101 = Panel(flr_flr_height_3)
panel_102 = Panel(num_flrs_rndup_27)
panel_103 = Panel(bldg_name_2)
panel_104 = Panel(bldg_name_3)
panel_105 = Panel(flr_flr_height_4)
panel_106 = Panel(flr_flr_height_5)  # disabled
panel_107 = Panel(flr_flr_height_6)  # disabled
panel_108 = Panel(flr_flr_height_7)
panel_109 = Panel(flr_flr_height_8)
panel_110 = Panel(flr_flr_height_9)  # disabled
flr_flr_height_28 = Division(A=uv_height_28, B=num_flrs_rndup_28)  # disabled
panel_111 = Panel(bldg_name_4)
panel_112 = Panel(bldg_name_5)  # disabled
panel_113 = Panel(flr_flr_height_10)
panel_114 = Panel(flr_flr_height_11)  # disabled
panel_115 = Panel(bldg_name_6)  # disabled
panel_116 = Panel(bldg_name_7)
panel_117 = Panel(bldg_name_8)
panel_118 = Panel(flr_flr_height_12)
panel_119 = Panel(bldg_name_9)  # disabled
panel_120 = Panel(flr_flr_height_13)
panel_121 = Panel(bldg_name_10)
panel_122 = Panel(bldg_name_11)  # disabled
panel_123 = Panel(flr_flr_height_14)
panel_124 = Panel(flr_flr_height_17)
panel_125 = Panel(flr_flr_height_15)
panel_126 = Panel(flr_flr_height_16)
panel_127 = Panel(bldg_name_12)
panel_128 = Panel(flr_flr_height_18)
panel_129 = Panel(bldg_name_13)
panel_130 = Panel(flr_flr_height_19)
panel_131 = Panel(bldg_name_14)
panel_132 = Panel(bldg_name_16)
panel_133 = Panel(bldg_name_17)
panel_134 = Panel(num_flrs_rndup_28)  # disabled
panel_135 = Panel(bldg_name_15)
panel_136 = Panel(bldg_name_18)
panel_137 = Panel(bldg_name_19)
panel_138 = Panel(flr_flr_height_20)
panel_139 = Panel(flr_flr_height_21)  # disabled
panel_140 = Panel(flr_flr_height_22)
panel_141 = Panel(flr_flr_height_23)
panel_142 = Panel(flr_flr_height_24)
panel_143 = Panel(flr_flr_height_25)
panel_144 = Panel(flr_flr_height_26)
panel_145 = Panel(bldg_name_20)
panel_146 = Panel(bldg_name_21)  # disabled
panel_147 = Panel(bldg_name_22)
panel_148 = Panel(bldg_name_23)
panel_149 = Panel(flr_flr_height_27)
panel_150 = Panel(bldg_name_24)
panel_151 = Panel(bldg_name_25)
panel_152 = Panel(bldg_name_26)
panel_153 = Panel(bldg_name_27)
duplicate_data = DuplicateData(Data=panel_89, Number=panel_70, Order=True)  # -> simplify(Data)
duplicate_data_2 = DuplicateData(Data=panel_98, Number=panel_73, Order=True)  # -> simplify(Data)
duplicate_data_3 = DuplicateData(Data=panel_101, Number=panel_74, Order=True)  # -> simplify(Data)
panel_154 = Panel(flr_flr_height_28)  # disabled
duplicate_data_4 = DuplicateData(Data=panel_105, Number=panel_75, Order=True)  # -> simplify(Data)
duplicate_data_5 = DuplicateData(Data=panel_106, Number=panel_76, Order=True)  # -> simplify(Data); disabled
duplicate_data_6 = DuplicateData(Data=panel_107, Number=panel_77, Order=True)  # -> simplify(Data); disabled
panel_155 = Panel(bldg_name_28)  # disabled
duplicate_data_7 = DuplicateData(Data=panel_108, Number=panel_78, Order=True)  # -> simplify(Data)
duplicate_data_8 = DuplicateData(Data=panel_109, Number=panel_79, Order=True)  # -> simplify(Data)
duplicate_data_9 = DuplicateData(Data=panel_110, Number=panel_80, Order=True)  # -> simplify(Data); disabled
duplicate_data_10 = DuplicateData(Data=panel_113, Number=panel_81, Order=True)  # -> simplify(Data)
duplicate_data_11 = DuplicateData(Data=panel_114, Number=panel_82, Order=True)  # -> simplify(Data); disabled
duplicate_data_12 = DuplicateData(Data=panel_118, Number=panel_83, Order=True)  # -> simplify(Data)
duplicate_data_13 = DuplicateData(Data=panel_120, Number=panel_84, Order=True)  # -> simplify(Data)
duplicate_data_14 = DuplicateData(Data=panel_123, Number=panel_85, Order=True)  # -> simplify(Data)
duplicate_data_15 = DuplicateData(Data=panel_125, Number=panel_87, Order=True)  # -> simplify(Data)
duplicate_data_16 = DuplicateData(Data=panel_126, Number=panel_88, Order=True)  # -> simplify(Data)
duplicate_data_17 = DuplicateData(Data=panel_124, Number=panel_86, Order=True)  # -> simplify(Data)
duplicate_data_18 = DuplicateData(Data=panel_128, Number=panel_90, Order=True)
duplicate_data_19 = DuplicateData(Data=panel_130, Number=panel_91, Order=True)  # -> simplify(Data)
duplicate_data_20 = DuplicateData(Data=panel_138, Number=panel_93, Order=True)
duplicate_data_21 = DuplicateData(Data=panel_139, Number=panel_94, Order=True)  # -> simplify(Data); disabled
duplicate_data_22 = DuplicateData(Data=panel_140, Number=panel_95, Order=True)  # -> simplify(Data)
duplicate_data_23 = DuplicateData(Data=panel_141, Number=panel_96, Order=True)  # -> simplify(Data)
duplicate_data_24 = DuplicateData(Data=panel_142, Number=panel_97, Order=True)  # -> simplify(Data)
duplicate_data_25 = DuplicateData(Data=panel_143, Number=panel_99, Order=True)  # -> simplify(Data)
duplicate_data_26 = DuplicateData(Data=panel_144, Number=panel_100, Order=True)  # -> simplify(Data)
duplicate_data_27 = DuplicateData(Data=panel_149, Number=panel_102, Order=True)  # -> simplify(Data)
panel_156 = Panel(duplicate_data)
bldg_name_29 = ListItem(List=deconstruct_metadata_29.Values, Index="0", Wrap=True)  # -> simplify(Item)
bldg_name_30 = ListItem(List=deconstruct_metadata_30.Values, Index="0", Wrap=True)  # -> simplify(Item)
height = ListItem(List=deconstruct_metadata_30.Values, Index="9", Wrap=True)  # -> simplify(Item)
height_2 = ListItem(List=deconstruct_metadata_29.Values, Index="6", Wrap=True)  # -> simplify(Item)
panel_157 = Panel(duplicate_data_2)
panel_158 = Panel(duplicate_data_3)
duplicate_data_28 = DuplicateData(Data=panel_154, Number=panel_134, Order=True)  # -> simplify(Data); disabled
panel_159 = Panel(duplicate_data_4)
panel_160 = Panel(duplicate_data_5)  # disabled
panel_161 = Panel(duplicate_data_6)  # disabled
panel_162 = Panel(duplicate_data_7)
panel_163 = Panel(duplicate_data_8)
panel_164 = Panel(duplicate_data_9)  # disabled
panel_165 = Panel(duplicate_data_10)
panel_166 = Panel(duplicate_data_11)  # disabled
panel_167 = Panel(duplicate_data_12)
panel_168 = Panel(duplicate_data_13)
panel_169 = Panel(duplicate_data_14)
panel_170 = Panel(duplicate_data_15)
panel_171 = Panel(duplicate_data_16)
panel_172 = Panel(duplicate_data_17)
panel_173 = Panel(duplicate_data_18)
panel_174 = Panel(duplicate_data_19)
panel_175 = Panel(duplicate_data_20)
panel_176 = Panel(duplicate_data_21)  # disabled
panel_177 = Panel(duplicate_data_22)
panel_178 = Panel(duplicate_data_23)
panel_179 = Panel(duplicate_data_24)
panel_180 = Panel(duplicate_data_25)
panel_181 = Panel(duplicate_data_26)
panel_182 = Panel(duplicate_data_27)
panel_183 = Panel(duplicate_data_28)  # disabled

data = Data(Tree({0;0}: ["288783057", "1500", "building", "", "residential", "R3TH", "TH", "44.69691", "111.86961", "288783057", "2", "7.544425", "0.062220767", "0.05", "0.06428798", "0.05", "63.276276", "224.44363"], {0;1}: ["863796914", "1500", "building", "", "", "R3TH", "TH", "44.252968", "119.4145", "863796914", "2", "7.7478633", "0.17867006", "0.05", "0.15354322", "0.05", "62.690285", "239.70374"], {0;2}: ["930680555", "1500", "building", "", "residential", "R3TH", "TH", "41.1435", "102.65306", "930680555", "2", "7.8608804", "1E-07", "0.14033504", "0.05", "0.15418757", "58.26046", "205.96043"], {0;3}: ["1069198793", "1500", "building", "", "", "R3TH", "TH", "36.359077", "79.74872", "1069198793", "2", "6.642028", "0.19837737", "1E-07", "0.19797876", "1E-07", "51.489902", "160.00768"], {0;4}: ["1069198844", "1500", "building", "", "", "R3TH", "TH", "43.965637", "99.79567", "1069198844", "2", "7.34635", "0.15343267", "1E-07", "0.16247958", "0.16247958", "62.269688", "200.22438"], {0;5}: ["1069499856", "1500", "building", "", "apartments", "R3TH", "TH", "61.714115", "179.20067", "1069499856", "2", "6.543791", "0.16535746", "0.11521605", "0.172454", "0.1638608", "87.42295", "359.53323"], {0;6}: ["1069499857", "1500", "building", "", "", "R3TH", "TH", "50.300816", "141.34366", "1069499857", "2", "7.1565137", "0.12524937", "0.12524937", "1E-07", "0.11311016", "71.28034", "283.57864"], {0;7}: ["1073871735", "1500", "building", "", "", "R3TH", "TH", "47.36691", "139.04285", "1073871735", "2", "7.5900636", "0.19470206", "0.19470206", "0.19470206", "0.15833306", "67.083084", "278.97076"]))
bldg_name_31 = ListItem(List=data, Index="14", Wrap=True)  # -> simplify(Item)
bldg_name_32 = ListItem(List=data, Index="13", Wrap=True)  # -> simplify(Item)
bldg_name_33 = ListItem(List=data, Index="15", Wrap=True)  # -> simplify(Item)
bldg_name_34 = ListItem(List=data, Index=panel, Wrap=True)  # -> simplify(Item)
wwr_north = Panel(bldg_name_34)
wwr_east = Panel(bldg_name_32)
wwr_south = Panel(bldg_name_31)
wwr_west = Panel(bldg_name_33)

data_2 = Data(Tree({0;0}: ["83471241", "1500", "building", "", "apartments", "R4AB", "AB", "122.52116", "585.2143", "83471241", "7", "23.367086", "1E-07", "0.13938294", "1E-07", "0.05", "173.63509", "1174.3518"], {0;1}: ["117354756", "1500", "building", "", "apartments", "R4AB", "AB", "74.965", "320.37906", "117354756", "5", "18.302935", "0.21114485", "1E-07", "0.22544116", "1E-07", "106.13396", "642.80347"], {0;2}: ["117354761", "1500", "building", "", "apartments", "R4AB", "AB", "50.443195", "158.50919", "117354761", "5", "17.801538", "0.21947451", "0.05", "0.24708991", "1E-07", "71.457", "318.0305"], {0;3}: ["117466254", "1500", "building", "", "apartments", "R4AB", "AB", "43.303715", "114.251274", "117466254", "5", "17.086924", "0.21232164", "1E-07", "0.21232164", "1E-07", "61.32141", "229.22597"], {0;4}: ["117466262", "1500", "building", "", "apartments", "R4AB", "AB", "53.666744", "177.519", "117466262", "5", "18.101297", "0.2506858", "1E-07", "0.2506858", "1E-07", "76.00587", "356.1623"], {0;5}: ["117466688", "1500", "building", "", "apartments", "R4AB", "AB", "62.051914", "223.17264", "117466688", "6", "20.919333", "0.05", "0.20253289", "1E-07", "0.05", "87.91631", "447.7837"]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))
bldg_name_35 = ListItem(List=data_2, Index="14", Wrap=True)  # -> simplify(Item)
bldg_name_36 = ListItem(List=data_2, Index="13", Wrap=True)  # -> simplify(Item)
bldg_name_37 = ListItem(List=data_2, Index="15", Wrap=True)  # -> simplify(Item)
bldg_name_38 = ListItem(List=data_2, Index=panel, Wrap=True)  # -> simplify(Item)
wwr_north_2 = Panel(bldg_name_38)
wwr_east_2 = Panel(bldg_name_36)
wwr_south_2 = Panel(bldg_name_35)
wwr_west_2 = Panel(bldg_name_37)

data_3 = Data(Tree({0;0}: ["930680523", "1500", "building", "", "residential", "R3SF", "SF", "100.791916", "421.02606", "930680523", "2", "6.748709", "0.13607627", "0.06497199", "0.0729679", "0.34928054", "142.73766", "844.7012"], {0;1}: ["1069198822", "1500", "building", "", "", "R3SF", "SF", "34.96658", "71.74153", "1069198822", "2", "5.7143087", "1E-07", "0.18107873", "0.05", "0.14948495", "49.55105", "143.93906"]))
bldg_name_39 = ListItem(List=data_3, Index="14", Wrap=True)  # -> simplify(Item)
bldg_name_40 = ListItem(List=data_3, Index="13", Wrap=True)  # -> simplify(Item)
bldg_name_41 = ListItem(List=data_3, Index="15", Wrap=True)  # -> simplify(Item)
bldg_name_42 = ListItem(List=data_3, Index=panel, Wrap=True)  # -> simplify(Item)
wwr_north_3 = Panel(bldg_name_42)
wwr_east_3 = Panel(bldg_name_40)
wwr_south_3 = Panel(bldg_name_39)
wwr_west_3 = Panel(bldg_name_41)

data_4 = Data(Tree({0;0}: ["117467573", "1500", "building", "", "", "R3AB", "AB", "67.26553", "283.55594", "117467573", "6", "22.18733", "0.27315673", "1E-07", "0.30487946", "0.27315673", "95.27962", "568.9513"], {0;1}: ["253374894", "1500", "building", "", "residential", "R3AB", "AB", "53.274323", "175.808", "253374894", "4", "14.202253", "1E-07", "0.16683555", "1E-07", "0.19006385", "75.46185", "352.66974"], {0;2}: ["532533042", "1500", "building", "", "", "R3AB", "AB", "221.63461", "1234.3044", "532533042", "7", "26.018614", "0.13962387", "0.21407126", "0.23757538", "0.17168562", "314.1071", "2476.2917"], {0;3}: ["808447125", "1500", "building", "", "apartments", "R3AB", "AB", "94.917496", "246.04387", "808447125", "4", "14.44195", "0.16332752", "0.16332752", "0.17816015", "0.05", "134.37737", "493.7437"], {0;4}: ["808447133", "1500", "building", "", "apartments", "R3AB", "AB", "50.710926", "160.33792", "808447133", "5", "19.26099", "0.05", "0.17272545", "0.05", "0.16408119", "71.83001", "321.7486"], {0;5}: ["846018303", "1500", "building", "", "house", "R3AB", "AB", "65.79011", "256.29697", "846018303", "5", "17.42959", "1E-07", "0.18691897", "0.05", "0.17697185", "93.21542", "514.21796"]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))
bldg_name_43 = ListItem(List=data_4, Index="14", Wrap=True)  # -> simplify(Item)
bldg_name_44 = ListItem(List=data_4, Index="13", Wrap=True)  # -> simplify(Item)
bldg_name_45 = ListItem(List=data_4, Index="15", Wrap=True)  # -> simplify(Item)
bldg_name_46 = ListItem(List=data_4, Index=panel, Wrap=True)  # -> simplify(Item)
wwr_north_4 = Panel(bldg_name_46)
wwr_east_4 = Panel(bldg_name_44)
wwr_south_4 = Panel(bldg_name_43)
wwr_west_4 = Panel(bldg_name_45)

data_5 = Data(Tree({0;0}: ["215457706", "1500", "building", "", "", "R4MF", "MF", "116.272736", "528.8144", "215457706", "3", "10.662061", "0.1868997", "0.05", "0.189112", "0.05", "164.6731", "1062.2716"], {0;1}: ["215457736", "1500", "building", "", "", "R4MF", "MF", "195.79294", "1034.28", "215457736", "3", "10.528519", "0.13588329", "0.05", "0.05", "0.09281209", "277.26056", "2077.7097"], {0;2}: ["215457812", "1500", "building", "", "", "R4MF", "MF", "61.37813", "234.21173", "215457812", "2", "7.564349", "0.05", "0.26686376", "0.05", "0.25601912", "86.99668", "470.41348"], {0;3}: ["253374895", "1500", "building", "", "residential", "R4MF", "MF", "49.50502", "153.01144", "253374895", "3", "11.677804", "0.05", "0.16272092", "1E-07", "0.14773922", "70.11863", "306.9411"], {0;4}: ["359389054", "1500", "building", "", "", "R4MF", "MF", "60.789345", "219.27032", "359389054", "3", "10.713328", "0.18399505", "0.05", "0.19438696", "1E-07", "86.10821", "440.30975"], {0;5}: ["359389056", "1500", "building", "", "", "R4MF", "MF", "79.80388", "301.88428", "359389056", "2", "6.3224688", "0.1989977", "0.05295019", "0.10628609", "0.23586296", "113.02135", "606.20514"]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))
bldg_name_47 = ListItem(List=data_5, Index="14", Wrap=True)  # -> simplify(Item)
bldg_name_48 = ListItem(List=data_5, Index="13", Wrap=True)  # -> simplify(Item)
bldg_name_49 = ListItem(List=data_5, Index="15", Wrap=True)  # -> simplify(Item)
bldg_name_50 = ListItem(List=data_5, Index=panel, Wrap=True)  # -> simplify(Item)
wwr_north_5 = Panel(bldg_name_50)
wwr_east_5 = Panel(bldg_name_48)
wwr_south_5 = Panel(bldg_name_47)
wwr_west_5 = Panel(bldg_name_49)

data_6 = Data(Tree({0;0}: ["443385207", "1500", "building", "", "house", "R4SF", "SF", "34.362488", "71.04308", "443385207", "1", "3.6554012", "1E-07", "0.05", "0.07883584", "1E-07", "48.70112", "142.59337"], {0;1}: ["864044061", "1500", "building", "", "", "R4SF", "SF", "36.405354", "81.12769", "864044061", "2", "6.0869293", "0.13391787", "0.05", "0.10933584", "0.05", "51.563675", "162.8158"], {0;2}: ["930680544", "1500", "building", "", "residential", "R4SF", "SF", "40.86792", "80.86539", "930680544", "2", "6.1178575", "0.13289802", "1E-07", "0.15246536", "1E-07", "57.840668", "162.23778"], {0;3}: ["1214584741", "1500", "building", "", "residential", "R4SF", "SF", "38.020622", "85.52229", "1214584741", "1", "3.6811323", "0.17116143", "1E-07", "1E-07", "1E-07", "53.860115", "171.6897"]))
bldg_name_51 = ListItem(List=data_6, Index="14", Wrap=True)  # -> simplify(Item)
bldg_name_52 = ListItem(List=data_6, Index="13", Wrap=True)  # -> simplify(Item)
bldg_name_53 = ListItem(List=data_6, Index="15", Wrap=True)  # -> simplify(Item)
bldg_name_54 = ListItem(List=data_6, Index=panel, Wrap=True)  # -> simplify(Item)
wwr_north_6 = Panel(bldg_name_54)
wwr_east_6 = Panel(bldg_name_52)
wwr_south_6 = Panel(bldg_name_51)
wwr_west_6 = Panel(bldg_name_53)

data_7 = Data(Tree({0;0}: ["215469862", "1500", "building", "", "", "R3MF", "MF", "71.533615", "269.48215", "215469862", "3", "11.106295", "0.05", "0.2017116", "0.10578077", "0.16921198", "101.3671", "540.7229"], {0;1}: ["510718686", "1500", "building", "", "", "R3MF", "MF", "52.312256", "161.2317", "510718686", "3", "10.435851", "0.14680474", "0.05", "0.05", "0.009142855", "74.07029", "323.5036"], {0;2}: ["846018332", "1500", "building", "", "house", "R3MF", "MF", "68.02494", "213.75734", "846018332", "3", "11.422194", "0.19695775", "0.19523022", "0.118803605", "0.11141717", "96.33987", "428.91663"], {0;3}: ["871388865", "1500", "building", "", "", "R3MF", "MF", "38.91687", "93.966286", "871388865", "3", "9.785558", "0.05", "1E-07", "0.23283318", "0.09047636", "55.11647", "188.52676"], {0;4}: ["930961646", "1500", "building", "", "", "R3MF", "MF", "44.71356", "122.82045", "930961646", "3", "10.719797", "0.21863115", "1E-07", "0.2049638", "1E-07", "63.345966", "246.43695"], {0;5}: ["930961712", "1500", "building", "", "residential", "R3MF", "MF", "99.15987", "491.46954", "930961712", "5", "17.49422", "0.05", "1E-07", "0.23526521", "0.157306", "140.37022", "986.03107"], {0;6}: ["1069198845", "1500", "building", "", "", "R3MF", "MF", "74.581665", "280.3149", "1069198845", "3", "11.473981", "0.24862602", "0.23243389", "0.18938476", "0.19156459", "105.637794", "562.4065"], {0;7}: ["1069499864", "1500", "building", "", "apartments", "R3MF", "MF", "46.242943", "132.98692", "1069499864", "3", "10.76006", "1E-07", "0.2171842", "0.22056629", "0.22056629", "65.50435", "266.8114"], {0;8}: ["1069499865", "1500", "building", "", "apartments", "R3MF", "MF", "49.705235", "125.68775", "1069499865", "3", "11.895895", "0.13950315", "0.18859172", "0.089610174", "0.18119198", "70.41625", "252.16615"], {0;9}: ["1069499905", "1500", "building", "", "apartments", "R3MF", "MF", "71.548805", "216.35489", "1069499905", "3", "10.57027", "0.13991679", "0.13573363", "0.15738462", "0.14641619", "101.35257", "434.07507"], {0;10}: ["1069499906", "1500", "building", "", "", "R3MF", "MF", "51.709488", "137.252", "1069499906", "3", "11.869774", "0.20723064", "1E-07", "0.25653544", "1E-07", "73.20537", "275.3693"], {0;11}: ["1073871738", "1500", "building", "", "", "R3MF", "MF", "50.640465", "159.28716", "1073871738", "2", "7.729134", "0.16725934", "0.115243055", "0.20738584", "1E-07", "71.73251", "319.58435"]))
bldg_name_55 = ListItem(List=data_7, Index="14", Wrap=True)  # -> simplify(Item)
bldg_name_56 = ListItem(List=data_7, Index="13", Wrap=True)  # -> simplify(Item)
bldg_name_57 = ListItem(List=data_7, Index="15", Wrap=True)  # -> simplify(Item)
bldg_name_58 = ListItem(List=data_7, Index=panel, Wrap=True)  # -> simplify(Item)
wwr_north_7 = Panel(bldg_name_58)
wwr_east_7 = Panel(bldg_name_56)
wwr_south_7 = Panel(bldg_name_55)
wwr_west_7 = Panel(bldg_name_57)

data_8 = Data(Tree({0;0}: ["1069198808", "1500", "building", "", "", "R2MF", "MF", "49.873116", "108.22474", "1069198808", "3", "9.893381", "0.21798488", "0.21798488", "0.23815739", "0.21798488", "70.64285", "217.13763"], {0;1}: ["1069198825", "1500", "building", "", "apartments", "R2MF", "MF", "52.811493", "147.00833", "1069198825", "4", "12.495932", "0.19696476", "0.1519092", "0.15923299", "0.05", "74.76577", "294.95163"], {0;2}: ["1069198839", "1500", "building", "", "", "R2MF", "MF", "53.491344", "143.2807", "1069198839", "3", "11.66203", "0.1362555", "0.13235685", "0.079167016", "0.12503071", "75.786804", "287.4712"], {0;3}: ["1069198840", "1500", "building", "", "", "R2MF", "MF", "64.80944", "172.15826", "1069198840", "3", "10.267902", "0.15871255", "0.16106108", "0.16106108", "0.02592357", "91.80564", "345.4093"]))
bldg_name_59 = ListItem(List=data_8, Index="14", Wrap=True)  # -> simplify(Item)
bldg_name_60 = ListItem(List=data_8, Index="13", Wrap=True)  # -> simplify(Item)
bldg_name_61 = ListItem(List=data_8, Index="15", Wrap=True)  # -> simplify(Item)
bldg_name_62 = ListItem(List=data_8, Index=panel, Wrap=True)  # -> simplify(Item)
wwr_north_8 = Panel(bldg_name_62)
wwr_east_8 = Panel(bldg_name_60)
wwr_south_8 = Panel(bldg_name_59)
wwr_west_8 = Panel(bldg_name_61)

data_9 = Data(Tree({0;0}: ["215457711", "1500", "building", "", "", "R6MF", "MF", "56.57774", "198.414", "215457711", "3", "10.914698", "0.05", "0.05", "0.054767568", "0.21052687", "80.19772", "398.54138"], {0;1}: ["443613456", "1500", "building", "", "apartments", "R6MF", "MF", "52.384502", "162.13109", "443613456", "3", "11.565758", "1E-07", "0.21451822", "0.12246664", "1E-07", "74.22989", "325.42758"], {0;2}: ["930680537", "1500", "building", "", "", "R6MF", "MF", "46.196064", "125.6228", "930680537", "3", "11.358333", "0.11120699", "1E-07", "0.12539528", "0.05", "65.422424", "252.02689"]))
bldg_name_63 = ListItem(List=data_9, Index="14", Wrap=True)  # -> simplify(Item)
bldg_name_64 = ListItem(List=data_9, Index="13", Wrap=True)  # -> simplify(Item)
bldg_name_65 = ListItem(List=data_9, Index="15", Wrap=True)  # -> simplify(Item)
bldg_name_66 = ListItem(List=data_9, Index=panel, Wrap=True)  # -> simplify(Item)
wwr_north_9 = Panel(bldg_name_66)
wwr_east_9 = Panel(bldg_name_64)
wwr_south_9 = Panel(bldg_name_63)
wwr_west_9 = Panel(bldg_name_65)

data_10 = Data(Tree({0;0}: ["215457825", "1500", "building", "", "", "R4TH", "TH", "35.852577", "79.16401", "215457825", "2", "7.8643146", "0.2476264", "0.05", "0.19169873", "0.05", "50.822365", "159.00829"], {0;1}: ["359391572", "1500", "building", "", "", "R4TH", "TH", "56.221687", "197.49266", "359391572", "2", "7.5789237", "0.05", "0.18143271", "0.05", "0.18139882", "79.671875", "396.57657"], {0;2}: ["444002106", "1500", "building", "", "house", "R4TH", "TH", "40.90391", "92.36671", "444002106", "2", "5.665831", "0.20956765", "0.21160553", "0.21160553", "0.21160553", "57.934704", "185.38028"], {0;3}: ["444003684", "1500", "building", "", "house", "R4TH", "TH", "39.62512", "95.95585", "444003684", "2", "6.6543107", "0.18790707", "0.18790707", "0.18262422", "1E-07", "56.136826", "192.58124"], {0;4}: ["526503745", "1500", "building", "", "apartments", "R4TH", "TH", "43.193264", "116.53199", "526503745", "2", "7.75005", "0.19499458", "1E-07", "0.18222651", "0.19499458", "61.185654", "233.8196"], {0;5}: ["532533035", "1500", "building", "", "", "R4TH", "TH", "61.062653", "182.1519", "532533035", "2", "5.5515275", "1E-07", "0.24245775", "0.0952457", "0.27035144", "86.53165", "365.4375"]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))
bldg_name_67 = ListItem(List=data_10, Index="14", Wrap=True)  # -> simplify(Item)
bldg_name_68 = ListItem(List=data_10, Index="13", Wrap=True)  # -> simplify(Item)
bldg_name_69 = ListItem(List=data_10, Index="15", Wrap=True)  # -> simplify(Item)
bldg_name_70 = ListItem(List=data_10, Index=panel, Wrap=True)  # -> simplify(Item)
wwr_north_10 = Panel(bldg_name_70)
wwr_east_10 = Panel(bldg_name_68)
wwr_south_10 = Panel(bldg_name_67)
wwr_west_10 = Panel(bldg_name_69)

data_11 = Data(Tree({0;0}: ["108229726", "1500", "building", "", "apartments", "R6AB", "AB", "291.45996", "1889.4359", "108229726", "7", "25.320982", "0.23072499", "0.062433816", "0.13602309", "0.23072499", "413.0168", "3791.005"], {0;1}: ["132316754", "1500", "building", "", "", "R6AB", "AB", "220.16513", "1353.779", "132316754", "8", "28.070797", "0.13390908", "0.2128414", "0.18524268", "0.05", "312.0716", "2718.3274"], {0;2}: ["359390651", "1500", "building", "", "", "R6AB", "AB", "55.570213", "188.59023", "359390651", "5", "16.135557", "0.016925622", "0.2065777", "1E-07", "0.05", "78.76695", "378.7036"], {0;3}: ["359392286", "1500", "building", "", "", "R6AB", "AB", "141.62955", "665.9997", "359392286", "6", "23.541973", "0.05", "0.022527", "0.1724909", "0.14500275", "200.53221", "1337.3682"], {0;4}: ["444003688", "1500", "building", "", "apartments", "R6AB", "AB", "59.412056", "220.7991", "444003688", "5", "19.399242", "0.24553958", "1E-07", "0.22781047", "1E-07", "84.164314", "443.13904"], {0;5}: ["930961668", "1500", "building", "", "", "R6AB", "AB", "56.157547", "195.76262", "930961668", "4", "15.270855", "1E-07", "0.17671335", "0.32922998", "1E-07", "79.53542", "392.77603"], {0;6}: ["1000122303", "1500", "building", "", "", "R6AB", "AB", "51.3001", "164.47389", "1000122303", "7", "24.59896", "0.05", "0.05", "0.2689232", "0.10323045", "72.68664", "330.19913"], {0;7}: ["1068899299", "1500", "building", "", "apartments", "R6AB", "AB", "112.34956", "564.8471", "1068899299", "6", "20.833397", "0.30471396", "0.28200534", "0.09497825", "0.30471396", "159.23053", "1133.6885"], {0;8}: ["1205424919", "1500", "building", "", "", "R6AB", "AB", "67.26418", "192.54245", "1205424919", "4", "14.534965", "0.122366", "0.1705424", "0.20948324", "0.102307856", "95.24112", "386.2873"], {0;9}: ["1214584661", "1500", "building", "", "residential", "R6AB", "AB", "54.365086", "183.27762", "1214584661", "4", "14.092752", "0.25798488", "0.20192336", "1E-07", "0.25798488", "77.04335", "367.96555"]))
bldg_name_71 = ListItem(List=data_11, Index="14", Wrap=True)  # -> simplify(Item)
bldg_name_72 = ListItem(List=data_11, Index="13", Wrap=True)  # -> simplify(Item)
bldg_name_73 = ListItem(List=data_11, Index="15", Wrap=True)  # -> simplify(Item)
bldg_name_74 = ListItem(List=data_11, Index=panel, Wrap=True)  # -> simplify(Item)
wwr_north_11 = Panel(bldg_name_74)
wwr_east_11 = Panel(bldg_name_72)
wwr_south_11 = Panel(bldg_name_71)
wwr_west_11 = Panel(bldg_name_73)

data_12 = Data(Tree({0;0}: ["404399730", "1500", "building", "", "residential", "R7AB", "AB", "130.77214", "750.1218", "404399730", "5", "16.93658", "0.23786747", "0.21594964", "0.26518112", "1E-07", "185.14226", "1505.1477"], {0;1}: ["526503748", "1500", "building", "", "apartments", "R7AB", "AB", "58.929985", "211.47331", "526503748", "4", "14.830027", "0.28634176", "1E-07", "0.3004922", "1E-07", "83.45235", "424.3181"]))
bldg_name_75 = ListItem(List=data_12, Index="14", Wrap=True)  # -> simplify(Item)
bldg_name_76 = ListItem(List=data_12, Index="13", Wrap=True)  # -> simplify(Item)
bldg_name_77 = ListItem(List=data_12, Index="15", Wrap=True)  # -> simplify(Item)
bldg_name_78 = ListItem(List=data_12, Index=panel, Wrap=True)  # -> simplify(Item)
wwr_north_12 = Panel(bldg_name_78)
wwr_east_12 = Panel(bldg_name_76)
wwr_south_12 = Panel(bldg_name_75)
wwr_west_12 = Panel(bldg_name_77)

data_13 = Data(Tree({0;0}: ["108229725", "1500", "building", "", "apartments", "R5AB", "AB", "147.91203", "776.3897", "108229725", "10", "35.778717", "0.13849059", "0.13021526", "0.1146281", "0.21061537", "209.59334", "1557.8008"], {0;1}: ["114796212", "1500", "building", "", "apartments", "R5AB", "AB", "50.274517", "154.3715", "114796212", "5", "16.448215", "0.115418665", "0.05", "0.1953424", "0.05", "71.17847", "309.7205"], {0;2}: ["117355025", "1500", "building", "", "apartments", "R5AB", "AB", "74.46428", "308.84937", "117355025", "5", "19.648396", "0.2381905", "1E-07", "0.05", "0.2381905", "105.41777", "619.6576"], {0;3}: ["117467093", "1500", "building", "", "apartments", "R5AB", "AB", "118.097275", "705.9013", "117467093", "6", "22.459223", "0.24267681", "0.05", "0.29517227", "0.05", "167.16829", "1416.3922"], {0;4}: ["117467575", "1500", "building", "", "", "R5AB", "AB", "69.80957", "301.50107", "117467575", "6", "23.497673", "0.21337734", "1E-07", "0.19861303", "0.10126057", "98.857635", "604.9582"], {0;5}: ["117635295", "1500", "building", "", "", "R5AB", "AB", "205.61464", "1201.2223", "117635295", "8", "28.9878", "0.22671027", "0.12652439", "0.23033999", "0.2520829", "291.3412", "2410.395"]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))
bldg_name_79 = ListItem(List=data_13, Index="14", Wrap=True)  # -> simplify(Item)
bldg_name_80 = ListItem(List=data_13, Index="13", Wrap=True)  # -> simplify(Item)
bldg_name_81 = ListItem(List=data_13, Index="15", Wrap=True)  # -> simplify(Item)
bldg_name_82 = ListItem(List=data_13, Index=panel, Wrap=True)  # -> simplify(Item)
wwr_north_13 = Panel(bldg_name_82)
wwr_east_13 = Panel(bldg_name_80)
wwr_south_13 = Panel(bldg_name_79)
wwr_west_13 = Panel(bldg_name_81)

data_14 = Data(Tree({0;0}: ["215457754", "1500", "building", "", "", "R8AB", "AB", "99.94802", "498.7625", "215457754", "4", "11.464473", "0.08840667", "0.08841126", "0.123799786", "0.12661", "141.62048", "1001.8301"], {0;1}: ["253374902", "1500", "building", "", "residential", "R8AB", "AB", "56.260715", "182.22084", "253374902", "7", "23.275518", "0.05", "0.20836176", "1E-07", "0.21576208", "79.699974", "365.52887"], {0;2}: ["865262326", "1500", "building", "", "", "R8AB", "AB", "85.77825", "371.6504", "865262326", "3", "11.828056", "0.15153313", "0.15153313", "0.15910058", "0.060368314", "121.51487", "745.9251"], {0;3}: ["1069198750", "1500", "building", "", "", "R8AB", "AB", "47.826206", "141.88477", "1069198750", "4", "11.830152", "1E-07", "0.17806137", "1E-07", "0.17931743", "67.7365", "284.68008"]))
bldg_name_83 = ListItem(List=data_14, Index="14", Wrap=True)  # -> simplify(Item)
bldg_name_84 = ListItem(List=data_14, Index="13", Wrap=True)  # -> simplify(Item)
bldg_name_85 = ListItem(List=data_14, Index="15", Wrap=True)  # -> simplify(Item)
bldg_name_86 = ListItem(List=data_14, Index=panel, Wrap=True)  # -> simplify(Item)
wwr_north_14 = Panel(bldg_name_86)
wwr_east_14 = Panel(bldg_name_84)
wwr_south_14 = Panel(bldg_name_83)
wwr_west_14 = Panel(bldg_name_85)

data_15 = Data(Tree({0;0}: ["288783080", "1500", "building", "", "residential", "R2TH", "TH", "54.168842", "181.84857", "288783080", "2", "7.695783", "0.05", "0.16448596", "1E-07", "0.20625365", "76.71807", "364.83847"], {0;1}: ["1069198816", "1500", "building", "", "", "R2TH", "TH", "47.989307", "101.73908", "1069198816", "2", "7.702945", "0.18361372", "0.18002664", "0.16332383", "0.18361372", "67.97158", "204.12457"], {0;2}: ["1069198829", "1500", "building", "", "apartments", "R2TH", "TH", "46.366375", "125.42237", "1069198829", "2", "7.595695", "0.05", "0.22864345", "0.05", "0.2164468", "65.69905", "251.64009"], {0;3}: ["1069556115", "1500", "building", "", "", "R2TH", "TH", "56.160442", "193.58446", "1069556115", "2", "7.6299353", "0.10134436", "0.2215773", "0.14245375", "0.05", "79.550514", "388.4183"]))
bldg_name_87 = ListItem(List=data_15, Index="14", Wrap=True)  # -> simplify(Item)
bldg_name_88 = ListItem(List=data_15, Index="13", Wrap=True)  # -> simplify(Item)
bldg_name_89 = ListItem(List=data_15, Index="15", Wrap=True)  # -> simplify(Item)
bldg_name_90 = ListItem(List=data_15, Index=panel, Wrap=True)  # -> simplify(Item)
wwr_north_15 = Panel(bldg_name_90)
wwr_east_15 = Panel(bldg_name_88)
wwr_south_15 = Panel(bldg_name_87)
wwr_west_15 = Panel(bldg_name_89)

data_16 = Data(["938318594", "1500", "building", "", "apartments", "R7MF", "MF", "45.969788", "125.840614", "938318594", "2", "6.8434696", "0.2279287", "0.2279287", "0.17510915", "0.2279287", "65.13394", "252.50316"])
bldg_name_91 = ListItem(List=data_16, Index="13", Wrap=True)  # -> simplify(Item)
bldg_name_92 = ListItem(List=data_16, Index="14", Wrap=True)  # -> simplify(Item)
bldg_name_93 = ListItem(List=data_16, Index="15", Wrap=True)  # -> simplify(Item)
bldg_name_94 = ListItem(List=data_16, Index=panel, Wrap=True)  # -> simplify(Item)
wwr_north_16 = Panel(bldg_name_94)
wwr_east_16 = Panel(bldg_name_91)
wwr_south_16 = Panel(bldg_name_92)
wwr_west_16 = Panel(bldg_name_93)

data_17 = Data(["1214584659", "1500", "building", "", "residential", "R7TH", "TH", "49.84727", "155.28809", "1214584659", "2", "6.978477", "1E-07", "0.18228674", "0.05", "0.16318098", "70.62921", "311.7685"])
bldg_name_95 = ListItem(List=data_17, Index="14", Wrap=True)  # -> simplify(Item)
bldg_name_96 = ListItem(List=data_17, Index="13", Wrap=True)  # -> simplify(Item)
bldg_name_97 = ListItem(List=data_17, Index="15", Wrap=True)  # -> simplify(Item)
bldg_name_98 = ListItem(List=data_17, Index=panel, Wrap=True)  # -> simplify(Item)
wwr_north_17 = Panel(bldg_name_98)
wwr_east_17 = Panel(bldg_name_96)
wwr_south_17 = Panel(bldg_name_95)
wwr_west_17 = Panel(bldg_name_97)

data_18 = Data(Tree({0;0}: ["215457776", "1500", "building", "", "", "R5TH", "TH", "57.12037", "189.75833", "215457776", "2", "7.808467", "0.19202362", "0.05", "0.18555745", "0.05", "80.91618", "381.12845"], {0;1}: ["215457798", "1500", "building", "", "", "R5TH", "TH", "47.750748", "142.41405", "215457798", "2", "7.27306", "0.23182471", "0.05", "0.24031533", "0.05", "67.67154", "286.04907"], {0;2}: ["306426788", "1500", "building", "", "", "R5TH", "TH", "41.205856", "105.53975", "306426788", "2", "7.2824426", "0.14763282", "0.05", "0.16229548", "0.05", "58.37156", "211.8192"], {0;3}: ["846926805", "1500", "building", "", "house", "R5TH", "TH", "47.195415", "137.65839", "846926805", "2", "7.7908134", "0.18262333", "0.05", "0.2465941", "0.05", "66.852806", "276.241"], {0;4}: ["863796929", "1500", "building", "", "", "R5TH", "TH", "56.156013", "193.66371", "863796929", "2", "7.900081", "1E-07", "0.13011079", "0.05", "0.16063266", "79.57515", "388.71323"], {0;5}: ["863796936", "1500", "building", "", "", "R5TH", "TH", "53.896503", "181.22556", "863796936", "2", "6.5918317", "0.05", "0.22123481", "0.05", "0.2836223", "76.36471", "363.7673"], {0;6}: ["864044100", "1500", "building", "", "", "R5TH", "TH", "52.13456", "145.34496", "864044100", "2", "7.511796", "0.05", "0.13792218", "0.05", "0.095437065", "73.88762", "291.7071"], {0;7}: ["930680489", "1500", "building", "", "residential", "R5TH", "TH", "36.211872", "76.63268", "930680489", "2", "7.3369484", "0.16525869", "1E-07", "0.1412579", "1E-07", "51.28106", "153.74168"], {0;8}: ["930680561", "1500", "building", "", "residential", "R5TH", "TH", "48.141544", "140.13745", "930680561", "2", "6.6755314", "1E-07", "0.30123028", "0.31873816", "0.05", "68.17128", "281.17252"], {0;9}: ["1066867123", "1500", "building", "", "", "R5TH", "TH", "52.493805", "168.53513", "1066867123", "2", "7.842733", "0.17025511", "0.05", "0.14623554", "0.16674389", "74.36678", "338.1673"]))
bldg_name_99 = ListItem(List=data_18, Index="14", Wrap=True)  # -> simplify(Item)
bldg_name_100 = ListItem(List=data_18, Index="13", Wrap=True)  # -> simplify(Item)
bldg_name_101 = ListItem(List=data_18, Index="15", Wrap=True)  # -> simplify(Item)
bldg_name_102 = ListItem(List=data_18, Index=panel, Wrap=True)  # -> simplify(Item)
wwr_north_18 = Panel(bldg_name_102)
wwr_east_18 = Panel(bldg_name_100)
wwr_south_18 = Panel(bldg_name_99)
wwr_west_18 = Panel(bldg_name_101)

data_19 = Data(Tree({0;0}: ["215457723", "1500", "building", "", "", "R5MF", "MF", "48.85285", "149.09665", "215457723", "4", "12.082815", "0.2220937", "0.05", "0.18372025", "0.05", "69.23435", "299.47476"], {0;1}: ["215457787", "1500", "building", "", "", "R5MF", "MF", "48.144936", "144.72433", "215457787", "3", "11.933703", "0.05", "0.05", "0.12138136", "0.12050103", "68.23699", "290.692"], {0;2}: ["215457810", "1500", "building", "", "", "R5MF", "MF", "48.755764", "148.56903", "215457810", "3", "11.068809", "0.18823135", "0.05", "0.2153741", "0.05", "69.09849", "298.4121"], {0;3}: ["846895627", "1500", "building", "", "house", "R5MF", "MF", "40.104923", "98.40765", "846895627", "3", "11.192705", "0.107383184", "1E-07", "0.09826849", "1E-07", "56.815327", "197.47462"], {0;4}: ["863793542", "1500", "building", "", "", "R5MF", "MF", "48.08829", "144.47247", "863793542", "3", "10.4835205", "0.22352448", "0.05", "0.27627108", "0.05", "68.13083", "289.97818"], {0;5}: ["1000200086", "1500", "building", "", "", "R5MF", "MF", "56.80526", "198.49727", "1000200086", "3", "11.250992", "0.19498357", "0.05", "0.1750033", "0.05", "80.46433", "398.3602"], {0;6}: ["1069556125", "1500", "building", "", "apartments", "R5MF", "MF", "60.30095", "199.49281", "1069556125", "3", "11.906152", "0.23516299", "1E-07", "0.2697687", "0.23516299", "85.38981", "400.27005"], {0;7}: ["1184969747", "1500", "building", "", "", "R5MF", "MF", "56.991493", "202.49863", "1184969747", "3", "11.447432", "0.31254885", "1E-07", "0.26193786", "1E-07", "80.73033", "406.30603"], {0;8}: ["1214584632", "1500", "building", "", "residential", "R5MF", "MF", "53.698116", "180.20898", "1214584632", "3", "10.548135", "1E-07", "0.20150462", "1E-07", "0.19613029", "76.08734", "361.80887"]))
bldg_name_103 = ListItem(List=data_19, Index="14", Wrap=True)  # -> simplify(Item)
bldg_name_104 = ListItem(List=data_19, Index="13", Wrap=True)  # -> simplify(Item)
bldg_name_105 = ListItem(List=data_19, Index="15", Wrap=True)  # -> simplify(Item)
bldg_name_106 = ListItem(List=data_19, Index=panel, Wrap=True)  # -> simplify(Item)
wwr_north_19 = Panel(bldg_name_106)
wwr_east_19 = Panel(bldg_name_104)
wwr_south_19 = Panel(bldg_name_103)
wwr_west_19 = Panel(bldg_name_105)

data_20 = Data(Tree({0;0}: ["444002105", "1500", "building", "", "house", "R6TH", "TH", "39.37394", "95.860344", "444002105", "2", "6.7050323", "0.10576139", "0.12662633", "0.12662633", "0.05", "55.771465", "192.39194"], {0;1}: ["930680546", "1500", "building", "", "residential", "R6TH", "TH", "39.640842", "96.13929", "930680546", "2", "5.5282884", "0.19165029", "1E-07", "0.17965454", "1E-07", "56.137703", "192.88153"], {0;2}: ["1214584655", "1500", "building", "", "residential", "R6TH", "TH", "53.291573", "176.88353", "1214584655", "2", "7.8579106", "1E-07", "0.17827107", "1E-07", "0.17712909", "75.50404", "355.1161"]))
bldg_name_107 = ListItem(List=data_20, Index="14", Wrap=True)  # -> simplify(Item)
bldg_name_108 = ListItem(List=data_20, Index="13", Wrap=True)  # -> simplify(Item)
bldg_name_109 = ListItem(List=data_20, Index="15", Wrap=True)  # -> simplify(Item)
bldg_name_110 = ListItem(List=data_20, Index=panel, Wrap=True)  # -> simplify(Item)
wwr_north_20 = Panel(bldg_name_110)
wwr_east_20 = Panel(bldg_name_108)
wwr_south_20 = Panel(bldg_name_107)
wwr_west_20 = Panel(bldg_name_109)

noflrs_r2ab = Data(duplicate_data_5)  # disabled
geo = Geometry(polyline_13)  # disabled
bldgname_r2ab = Data(bldg_name_5)  # disabled
footprint_geo = Panel(geo)  # disabled
building_name = Panel(bldgname_r2ab)  # disabled
floor_floor_height_x_no_flrs = Panel(noflrs_r2ab)  # disabled

data_21 = Data(Tree({0;0}: ["1069198799", "1500", "building", "", "", "R2AB", "AB", "47.192196", "127.828514", "1069198799", "4", "15.043335", "1E-07", "0.21108617", "0.12718639", "0.23856804", "66.842995", "256.47235"], {0;1}: ["1069198809", "1500", "building", "", "", "R2AB", "AB", "47.264828", "138.4996", "1069198809", "4", "14.341085", "0.18937458", "1E-07", "0.18030594", "0.18335514", "66.94157", "277.87955"], {0;2}: ["1069198817", "1500", "building", "", "", "R2AB", "AB", "51.879417", "167.83551", "1069198817", "4", "14.38", "0.244817", "1E-07", "0.22902833", "0.22902833", "73.4905", "336.7422"], {0;3}: ["1069198821", "1500", "building", "", "", "R2AB", "AB", "60.60135", "222.93074", "1069198821", "4", "14.734113", "1E-07", "0.19438568", "0.18505496", "0.18505496", "85.86439", "447.28052"], {0;4}: ["1069198852", "1500", "building", "", "", "R2AB", "AB", "46.764217", "133.68652", "1069198852", "4", "14.404336", "1E-07", "0.26478684", "1E-07", "0.24338143", "66.25614", "268.21896"], {0;5}: ["1069499900", "1500", "building", "", "", "R2AB", "AB", "46.1259", "130.06609", "1069499900", "4", "14.091339", "0.19419739", "0.2515675", "1E-07", "0.19419739", "65.3289", "260.94913"], {0;6}: ["1069499904", "1500", "building", "", "", "R2AB", "AB", "58.698494", "212.08061", "1069499904", "4", "15.223034", "1E-07", "0.23729515", "0.23729515", "0.22246742", "83.159904", "425.502"], {0;7}: ["1069499907", "1500", "building", "", "", "R2AB", "AB", "46.262917", "102.36759", "1069499907", "4", "14.807844", "0.19396578", "1E-07", "0.21674089", "0.19396578", "65.53303", "205.3803"]))
bldg_name_111 = ListItem(List=data_21, Index="14", Wrap=True)  # -> simplify(Item)
bldg_name_112 = ListItem(List=data_21, Index="13", Wrap=True)  # -> simplify(Item)
bldg_name_113 = ListItem(List=data_21, Index="15", Wrap=True)  # -> simplify(Item)
bldg_name_114 = ListItem(List=data_21, Index=panel, Wrap=True)  # -> simplify(Item)
wwr_north_21 = Panel(bldg_name_114)
wwr_east_21 = Panel(bldg_name_112)
wwr_south_21 = Panel(bldg_name_111)
wwr_west_21 = Panel(bldg_name_113)

data_22 = Data(Tree({0}: ["8"], {1}: ["8"], {2}: ["8"], {3}: ["8"], {4}: ["8"], {5}: ["8"]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))
geo_2 = Geometry(Tree({0}: [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], {1}: [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], {2}: [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], {3}: [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], {4}: [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], {5}: [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]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))
data_23 = Data(Tree({0}: ["108480266"], {1}: ["117354537"], {2}: ["117632407"], {3}: ["197183084"], {4}: ["197209821"], {5}: ["2682662"]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))
bldg_height = Panel(data_22)
building_name_2 = Panel(data_23)
footprint_geo_2 = Panel(geo_2)

geo_3 = Geometry(Tree({0}: [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], {1}: [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], {2}: [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], {3}: [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]))
noflrs_r2ab_2 = Data(Tree({0}: ["3.297794", "3.297794", "3.297794"], {1}: ["3.123983", "3.123983", "3.123983", "3.123983"], {2}: ["3.887343", "3.887343", "3.887343"], {3}: ["3.422634", "3.422634", "3.422634"]))
bldgname_r2ab_2 = Data(Tree({0}: ["1069198808"], {1}: ["1069198825"], {2}: ["1069198839"], {3}: ["1069198840"]))
footprint_geo_3 = Panel(geo_3)
building_name_3 = Panel(bldgname_r2ab_2)
floor_floor_height_x_no_flrs_2 = Panel(noflrs_r2ab_2)

data_24 = Data(["1000254901", "1500", "building", "", "", "R8TH", "TH", "115.51638", "491.611", "1000254901", "3", "11.704182", "0.08823535", "0.12914157", "0.14716542", "0.16139196", "163.7284", "986.49634"])
bldg_name_115 = ListItem(List=data_24, Index="14", Wrap=True)  # -> simplify(Item)
bldg_name_116 = ListItem(List=data_24, Index="13", Wrap=True)  # -> simplify(Item)
bldg_name_117 = ListItem(List=data_24, Index="15", Wrap=True)  # -> simplify(Item)
bldg_name_118 = ListItem(List=data_24, Index=panel, Wrap=True)  # -> simplify(Item)
wwr_north_22 = Panel(bldg_name_118)
wwr_east_22 = Panel(bldg_name_116)
wwr_west_22 = Panel(bldg_name_117)

data_25 = Data(Tree({0}: ["23.801468"], {1}: ["21"], {2}: ["25.320982"], {3}: ["21.916466"], {4}: ["25.320982"], {5}: ["17.214098"]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))
geo_4 = Geometry(Tree({0}: [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], {1}: [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], {2}: [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], {3}: [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], {4}: [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], {5}: [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]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))
data_26 = Data(Tree({0}: ["23055597"], {1}: ["83471240"], {2}: ["83701787"], {3}: ["83701788"], {4}: ["83701789"], {5}: ["83701790"]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))
bldg_height_2 = Panel(data_25)
building_name_4 = Panel(data_26)
footprint_geo_4 = Panel(geo_4)

noflrs_r2ab_3 = Data(Tree({0}: ["3.772213", "3.772213"], {1}: ["3.873932", "3.873932"], {2}: ["3.93044", "3.93044"], {3}: ["3.321014", "3.321014"], {4}: ["3.673175", "3.673175"], {5}: ["3.271896", "3.271896"], {6}: ["3.578257", "3.578257"], {7}: ["3.795032", "3.795032"]))
bldgname_r2ab_3 = Data(Tree({0}: ["288783057"], {1}: ["863796914"], {2}: ["930680555"], {3}: ["1069198793"], {4}: ["1069198844"], {5}: ["1069499856"], {6}: ["1069499857"], {7}: ["1073871735"]))
geo_5 = Geometry(Tree({0}: [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], {1}: [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], {2}: [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], {3}: [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], {4}: [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], {5}: [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], {6}: [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], {7}: [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]))
footprint_geo_5 = Panel(geo_5)
building_name_5 = Panel(bldgname_r2ab_3)
floor_floor_height_x_no_flrs_3 = Panel(noflrs_r2ab_3)

bldgname_r2ab_4 = Data(Tree({0}: ["83471241"], {1}: ["117354756"], {2}: ["117354761"], {3}: ["117466254"], {4}: ["117466262"], {5}: ["117466688"]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))
geo_6 = Geometry(Tree({0}: [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], {1}: [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], {2}: [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], {3}: [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], {4}: [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], {5}: [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]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))
noflrs_r2ab_4 = Data(Tree({0}: ["3.338155", "3.338155", "3.338155", "3.338155", "3.338155", "3.338155", "3.338155"], {1}: ["3.660587", "3.660587", "3.660587", "3.660587", "3.660587"], {2}: ["3.560308", "3.560308", "3.560308", "3.560308", "3.560308"], {3}: ["3.417385", "3.417385", "3.417385", "3.417385", "3.417385"], {4}: ["3.620259", "3.620259", "3.620259", "3.620259", "3.620259"], {5}: ["3.486556", "3.486556", "3.486556", "3.486556", "3.486556", "3.486556"]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))
footprint_geo_6 = Panel(geo_6)
building_name_6 = Panel(bldgname_r2ab_4)
floor_floor_height_x_no_flrs_4 = Panel(noflrs_r2ab_4)

bldgname_r2ab_5 = Data(Tree({0}: ["930680523"], {1}: ["1069198822"]))
geo_7 = Geometry(Tree({0}: [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], {1}: [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]))
noflrs_r2ab_5 = Data(Tree({0}: ["3.374355", "3.374355"], {1}: ["2.857154", "2.857154"]))
footprint_geo_7 = Panel(geo_7)
building_name_7 = Panel(bldgname_r2ab_5)
floor_floor_height_x_no_flrs_5 = Panel(noflrs_r2ab_5)

bldgname_r2ab_6 = Data(Tree({0}: ["288783080"], {1}: ["1069198816"], {2}: ["1069198829"], {3}: ["1069556115"]))
geo_8 = Geometry(Tree({0}: [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], {1}: [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], {2}: [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], {3}: [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]))
noflrs_r2ab_6 = Data(Tree({0}: ["3.847892", "3.847892"], {1}: ["3.851473", "3.851473"], {2}: ["3.797848", "3.797848"], {3}: ["3.814968", "3.814968"]))
footprint_geo_8 = Panel(geo_8)
building_name_8 = Panel(bldgname_r2ab_6)
floor_floor_height_x_no_flrs_6 = Panel(noflrs_r2ab_6)

bldgname_r2ab_7 = Data(Tree({0}: ["215469862"], {1}: ["510718686"], {2}: ["846018332"], {3}: ["871388865"], {4}: ["930961646"], {5}: ["930961712"], {6}: ["1069198845"], {7}: ["1069499864"], {8}: ["1069499865"], {9}: ["1069499905"], {10}: ["1069499906"], {11}: ["1073871738"]))
geo_9 = Geometry(Tree({0}: [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], {1}: [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], {2}: [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], {3}: [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], {4}: [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], {5}: [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], {6}: [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], {7}: [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], {8}: [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], {9}: [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], {10}: [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], {11}: [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]))
noflrs_r2ab_7 = Data(Tree({0}: ["3.702098", "3.702098", "3.702098"], {1}: ["3.478617", "3.478617", "3.478617"], {2}: ["3.807398", "3.807398", "3.807398"], {3}: ["3.261853", "3.261853", "3.261853"], {4}: ["3.573266", "3.573266", "3.573266"], {5}: ["3.498844", "3.498844", "3.498844", "3.498844", "3.498844"], {6}: ["3.82466", "3.82466", "3.82466"], {7}: ["3.586687", "3.586687", "3.586687"], {8}: ["3.965298", "3.965298", "3.965298"], {9}: ["3.523423", "3.523423", "3.523423"], {10}: ["3.956591", "3.956591", "3.956591"], {11}: ["3.864567", "3.864567"]))
footprint_geo_9 = Panel(geo_9)
building_name_9 = Panel(bldgname_r2ab_7)
floor_floor_height_x_no_flrs_7 = Panel(noflrs_r2ab_7)

geo_10 = Geometry(polyline_18)  # disabled
bldgname_r2ab_8 = Data(bldg_name_6)  # disabled
noflrs_r2ab_8 = Data(duplicate_data_6)  # disabled
footprint_geo_10 = Panel(geo_10)  # disabled
building_name_10 = Panel(bldgname_r2ab_8)  # disabled
floor_floor_height_x_no_flrs_8 = Panel(noflrs_r2ab_8)  # disabled

bldg_name_119 = ListItem(List=deconstruct_metadata_18.Values, Index="14", Wrap=True)  # -> simplify(Item); disabled
bldg_name_120 = ListItem(List=deconstruct_metadata_18.Values, Index="13", Wrap=True)  # -> simplify(Item); disabled
bldg_name_121 = ListItem(List=deconstruct_metadata_18.Values, Index="15", Wrap=True)  # -> simplify(Item); disabled
bldg_name_122 = ListItem(List=deconstruct_metadata_18.Values, Index=panel, Wrap=True)  # -> simplify(Item); disabled
wwr_north_23 = Panel(bldg_name_122)  # disabled
wwr_east_23 = Panel(bldg_name_120)  # disabled
wwr_south_22 = Panel(bldg_name_119)  # disabled
wwr_west_23 = Panel(bldg_name_121)  # disabled

geo_11 = Geometry(Tree({0}: [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], {1}: [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], {2}: [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], {3}: [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], {4}: [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], {5}: [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]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))
bldgname_r2ab_9 = Data(Tree({0}: ["117467573"], {1}: ["253374894"], {2}: ["532533042"], {3}: ["808447125"], {4}: ["808447133"], {5}: ["846018303"]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))
noflrs_r2ab_9 = Data(Tree({0}: ["3.697888", "3.697888", "3.697888", "3.697888", "3.697888", "3.697888"], {1}: ["3.550563", "3.550563", "3.550563", "3.550563"], {2}: ["3.716945", "3.716945", "3.716945", "3.716945", "3.716945", "3.716945", "3.716945"], {3}: ["3.610488", "3.610488", "3.610488", "3.610488"], {4}: ["3.852198", "3.852198", "3.852198", "3.852198", "3.852198"], {5}: ["3.485918", "3.485918", "3.485918", "3.485918", "3.485918"]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))
footprint_geo_11 = Panel(geo_11)
building_name_11 = Panel(bldgname_r2ab_9)
floor_floor_height_x_no_flrs_9 = Panel(noflrs_r2ab_9)

bldg_name_123 = ListItem(List=deconstruct_metadata_4.Values, Index="14", Wrap=True)  # -> simplify(Item); disabled
bldg_name_124 = ListItem(List=deconstruct_metadata_4.Values, Index="13", Wrap=True)  # -> simplify(Item); disabled
bldg_name_125 = ListItem(List=deconstruct_metadata_4.Values, Index="15", Wrap=True)  # -> simplify(Item); disabled
bldg_name_126 = ListItem(List=deconstruct_metadata_4.Values, Index=panel, Wrap=True)  # -> simplify(Item); disabled
wwr_north_24 = Panel(bldg_name_126)  # disabled
wwr_east_24 = Panel(bldg_name_124)  # disabled
wwr_south_23 = Panel(bldg_name_123)  # disabled
wwr_west_24 = Panel(bldg_name_125)  # disabled

geo_12 = Geometry(Tree({0}: [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], {1}: [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]))
bldgname_r2ab_10 = Data(Tree({0}: ["404399730"], {1}: ["526503748"]))
noflrs_r2ab_10 = Data(Tree({0}: ["3.387316", "3.387316", "3.387316", "3.387316", "3.387316"], {1}: ["3.707507", "3.707507", "3.707507", "3.707507"]))
footprint_geo_12 = Panel(geo_12)
building_name_12 = Panel(bldgname_r2ab_10)
floor_floor_height_x_no_flrs_10 = Panel(noflrs_r2ab_10)

bldg_name_127 = ListItem(List=deconstruct_metadata_27.Values, Index="14", Wrap=True)  # -> simplify(Item); disabled
bldg_name_128 = ListItem(List=deconstruct_metadata_27.Values, Index="13", Wrap=True)  # -> simplify(Item); disabled
bldg_name_129 = ListItem(List=deconstruct_metadata_27.Values, Index="15", Wrap=True)  # -> simplify(Item); disabled
bldg_name_130 = ListItem(List=deconstruct_metadata_27.Values, Index=panel, Wrap=True)  # -> simplify(Item); disabled
wwr_north_25 = Panel(bldg_name_130)  # disabled
wwr_east_25 = Panel(bldg_name_128)  # disabled
wwr_south_24 = Panel(bldg_name_127)  # disabled
wwr_west_25 = Panel(bldg_name_129)  # disabled

bldg_name_131 = ListItem(List=deconstruct_metadata_8.Values, Index="14", Wrap=True)  # -> simplify(Item); disabled
bldg_name_132 = ListItem(List=deconstruct_metadata_8.Values, Index="13", Wrap=True)  # -> simplify(Item); disabled
bldg_name_133 = ListItem(List=deconstruct_metadata_8.Values, Index="15", Wrap=True)  # -> simplify(Item); disabled
bldg_name_134 = ListItem(List=deconstruct_metadata_8.Values, Index=panel, Wrap=True)  # -> simplify(Item); disabled
wwr_north_26 = Panel(bldg_name_134)  # disabled
wwr_east_26 = Panel(bldg_name_132)  # disabled
wwr_south_25 = Panel(bldg_name_131)  # disabled
wwr_west_26 = Panel(bldg_name_133)  # disabled

geo_13 = Geometry(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)
bldgname_r2ab_11 = Data("1214584659")
noflrs_r2ab_11 = Data(["3.489239", "3.489239"])
footprint_geo_13 = Panel(geo_13)
building_name_13 = Panel(bldgname_r2ab_11)
floor_floor_height_x_no_flrs_11 = Panel(noflrs_r2ab_11)

bldg_name_135 = ListItem(List=deconstruct_metadata_13.Values, Index="14", Wrap=True)  # -> simplify(Item); disabled
bldg_name_136 = ListItem(List=deconstruct_metadata_13.Values, Index="13", Wrap=True)  # -> simplify(Item); disabled
bldg_name_137 = ListItem(List=deconstruct_metadata_13.Values, Index="15", Wrap=True)  # -> simplify(Item); disabled
bldg_name_138 = ListItem(List=deconstruct_metadata_13.Values, Index=panel, Wrap=True)  # -> simplify(Item); disabled
wwr_north_27 = Panel(bldg_name_138)  # disabled
wwr_east_27 = Panel(bldg_name_136)  # disabled
wwr_south_26 = Panel(bldg_name_135)  # disabled
wwr_west_27 = Panel(bldg_name_137)  # disabled

geo_14 = Geometry(Tree({0}: [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], {1}: [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], {2}: [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], {3}: [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]))
bldgname_r2ab_12 = Data(Tree({0}: ["443385207"], {1}: ["864044061"], {2}: ["930680544"], {3}: ["1214584741"]))
noflrs_r2ab_12 = Data(Tree({0}: ["3.655401"], {1}: ["3.043465", "3.043465"], {2}: ["3.058929", "3.058929"], {3}: ["3.681132"]))
footprint_geo_14 = Panel(geo_14)
building_name_14 = Panel(bldgname_r2ab_12)
floor_floor_height_x_no_flrs_12 = Panel(noflrs_r2ab_12)

geo_15 = Geometry(Tree({0}: [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], {1}: [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], {2}: [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], {3}: [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], {4}: [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], {5}: [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]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))
bldgname_r2ab_13 = Data(Tree({0}: ["215457706"], {1}: ["215457736"], {2}: ["215457812"], {3}: ["253374895"], {4}: ["359389054"], {5}: ["359389056"]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))
noflrs_r2ab_13 = Data(Tree({0}: ["3.55402", "3.55402", "3.55402"], {1}: ["3.509506", "3.509506", "3.509506"], {2}: ["3.782175", "3.782175"], {3}: ["3.892601", "3.892601", "3.892601"], {4}: ["3.571109", "3.571109", "3.571109"], {5}: ["3.161234", "3.161234"]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))
footprint_geo_15 = Panel(geo_15)
building_name_15 = Panel(bldgname_r2ab_13)
floor_floor_height_x_no_flrs_13 = Panel(noflrs_r2ab_13)

geo_16 = Geometry(Tree({0}: [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], {1}: [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], {2}: [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], {3}: [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], {4}: [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], {5}: [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]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))
bldgname_r2ab_14 = Data(Tree({0}: ["215457825"], {1}: ["359391572"], {2}: ["444002106"], {3}: ["444003684"], {4}: ["526503745"], {5}: ["532533035"]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))
noflrs_r2ab_14 = Data(Tree({0}: ["3.932157", "3.932157"], {1}: ["3.789462", "3.789462"], {2}: ["2.832916", "2.832916"], {3}: ["3.327155", "3.327155"], {4}: ["3.875025", "3.875025"], {5}: ["2.775764", "2.775764"]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))
footprint_geo_16 = Panel(geo_16)
building_name_16 = Panel(bldgname_r2ab_14)
floor_floor_height_x_no_flrs_14 = Panel(noflrs_r2ab_14)

bldgname_r2ab_15 = Data(Tree({0}: ["108229725"], {1}: ["114796212"], {2}: ["117355025"], {3}: ["117467093"], {4}: ["117467575"], {5}: ["117635295"]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))
geo_17 = Geometry(Tree({0}: [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], {1}: [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], {2}: [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], {3}: [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], {4}: [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], {5}: [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]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))
noflrs_r2ab_15 = Data(Tree({0}: ["3.577872", "3.577872", "3.577872", "3.577872", "3.577872", "3.577872", "3.577872", "3.577872", "3.577872", "3.577872"], {1}: ["3.289643", "3.289643", "3.289643", "3.289643", "3.289643"], {2}: ["3.929679", "3.929679", "3.929679", "3.929679", "3.929679"], {3}: ["3.743204", "3.743204", "3.743204", "3.743204", "3.743204", "3.743204"], {4}: ["3.916279", "3.916279", "3.916279", "3.916279", "3.916279", "3.916279"], {5}: ["3.623475", "3.623475", "3.623475", "3.623475", "3.623475", "3.623475", "3.623475", "3.623475"]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))
footprint_geo_17 = Panel(geo_17)
building_name_17 = Panel(bldgname_r2ab_15)
floor_floor_height_x_no_flrs_15 = Panel(noflrs_r2ab_15)

bldgname_r2ab_16 = Data(bldg_name_21)  # disabled
noflrs_r2ab_16 = Data(duplicate_data_21)  # disabled
geo_18 = Geometry(polyline_27)  # disabled
footprint_geo_18 = Panel(geo_18)  # disabled
building_name_18 = Panel(bldgname_r2ab_16)  # disabled
floor_floor_height_x_no_flrs_16 = Panel(noflrs_r2ab_16)  # disabled

bldgname_r2ab_17 = Data("938318594")
noflrs_r2ab_17 = Data(["3.421735", "3.421735"])
geo_19 = Geometry(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)
footprint_geo_19 = Panel(geo_19)
building_name_19 = Panel(bldgname_r2ab_17)
floor_floor_height_x_no_flrs_17 = Panel(noflrs_r2ab_17)

geo_20 = Geometry(polyline_3)  # disabled
bldgname_r2ab_18 = Data(bldg_name_11)  # disabled
noflrs_r2ab_18 = Data(duplicate_data_11)  # disabled
footprint_geo_20 = Panel(geo_20)  # disabled
building_name_20 = Panel(bldgname_r2ab_18)  # disabled
floor_floor_height_x_no_flrs_18 = Panel(noflrs_r2ab_18)  # disabled

# ----
# BELOW:
# LOAD CONSTRUCTION SET FOR EACH ARCHEYPE
# LOAD PROGRAM FOR EACH ARCHETYPE
# SET TOGGLE TO 'RUN' TO ACTIVATE DRAGONFLY OBJECT
# BELOW:
# INTERNALIZED DATA
# FROM OSM (2024)
# District border
geo_21 = Geometry(Tree({0;0}: [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], {0;1}: [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]))

geo_22 = Geometry(Tree({0}: [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], {1}: [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], {2}: [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], {3}: [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], {4}: [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], {5}: [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], {6}: [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], {7}: [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], {8}: [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], {9}: [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]))
bldgname_r2ab_19 = Data(Tree({0}: ["108229726"], {1}: ["132316754"], {2}: ["359390651"], {3}: ["359392286"], {4}: ["444003688"], {5}: ["930961668"], {6}: ["1000122303"], {7}: ["1068899299"], {8}: ["1205424919"], {9}: ["1214584661"]))
noflrs_r2ab_19 = Data(Tree({0}: ["3.617283", "3.617283", "3.617283", "3.617283", "3.617283", "3.617283", "3.617283"], {1}: ["3.50885", "3.50885", "3.50885", "3.50885", "3.50885", "3.50885", "3.50885", "3.50885"], {2}: ["3.227111", "3.227111", "3.227111", "3.227111", "3.227111"], {3}: ["3.923662", "3.923662", "3.923662", "3.923662", "3.923662", "3.923662"], {4}: ["3.879848", "3.879848", "3.879848", "3.879848", "3.879848"], {5}: ["3.817714", "3.817714", "3.817714", "3.817714"], {6}: ["3.514137", "3.514137", "3.514137", "3.514137", "3.514137", "3.514137", "3.514137"], {7}: ["3.472233", "3.472233", "3.472233", "3.472233", "3.472233", "3.472233"], {8}: ["3.633741", "3.633741", "3.633741", "3.633741"], {9}: ["3.523188", "3.523188", "3.523188", "3.523188"]))
footprint_geo_21 = Panel(geo_22)
building_name_21 = Panel(bldgname_r2ab_19)
floor_floor_height_x_no_flrs_19 = Panel(noflrs_r2ab_19)

geo_23 = Geometry(polyline_7)  # disabled
bldgname_r2ab_20 = Data(bldg_name_9)  # disabled
noflrs_r2ab_20 = Data(duplicate_data_9)  # disabled
footprint_geo_22 = Panel(geo_23)  # disabled
building_name_22 = Panel(bldgname_r2ab_20)  # disabled
floor_floor_height_x_no_flrs_20 = Panel(noflrs_r2ab_20)  # disabled

bldg_name_139 = ListItem(List=deconstruct_metadata_28.Values, Index="14", Wrap=True)  # -> simplify(Item); disabled
bldg_name_140 = ListItem(List=deconstruct_metadata_28.Values, Index="13", Wrap=True)  # -> simplify(Item); disabled
bldg_name_141 = ListItem(List=deconstruct_metadata_28.Values, Index="15", Wrap=True)  # -> simplify(Item); disabled
bldg_name_142 = ListItem(List=deconstruct_metadata_28.Values, Index=panel, Wrap=True)  # -> simplify(Item); disabled
wwr_north_28 = Panel(bldg_name_142)  # disabled
wwr_east_28 = Panel(bldg_name_140)  # disabled
wwr_west_28 = Panel(bldg_name_141)  # disabled

bldgname_r2ab_21 = Data(Tree({0}: ["215457711"], {1}: ["443613456"], {2}: ["930680537"]))
geo_24 = Geometry(Tree({0}: [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], {1}: [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], {2}: [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]))
noflrs_r2ab_21 = Data(Tree({0}: ["3.638233", "3.638233", "3.638233"], {1}: ["3.855253", "3.855253", "3.855253"], {2}: ["3.786111", "3.786111", "3.786111"]))
footprint_geo_23 = Panel(geo_24)
building_name_23 = Panel(bldgname_r2ab_21)
floor_floor_height_x_no_flrs_21 = Panel(noflrs_r2ab_21)

geo_25 = Geometry(Tree({0}: [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], {1}: [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], {2}: [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], {3}: [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]))
bldgname_r2ab_22 = Data(Tree({0}: ["215457754"], {1}: ["253374902"], {2}: ["865262326"], {3}: ["1069198750"]))
noflrs_r2ab_22 = Data(Tree({0}: ["2.866118", "2.866118", "2.866118", "2.866118"], {1}: ["3.325074", "3.325074", "3.325074", "3.325074", "3.325074", "3.325074", "3.325074"], {2}: ["3.942685", "3.942685", "3.942685"], {3}: ["2.957538", "2.957538", "2.957538", "2.957538"]))
footprint_geo_24 = Panel(geo_25)
building_name_24 = Panel(bldgname_r2ab_22)
floor_floor_height_x_no_flrs_22 = Panel(noflrs_r2ab_22)

geo_26 = Geometry(Tree({0}: [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], {1}: [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], {2}: [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], {3}: [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], {4}: [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], {5}: [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], {6}: [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], {7}: [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], {8}: [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], {9}: [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]))
bldgname_r2ab_23 = Data(Tree({0;0}: ["215457776"], {0;1}: ["215457798"], {0;2}: ["306426788"], {0;3}: ["846926805"], {0;4}: ["863796929"], {0;5}: ["863796936"], {0;6}: ["864044100"], {0;7}: ["930680489"], {0;8}: ["930680561"], {0;9}: ["1066867123"]))
noflrs_r2ab_23 = Data(Tree({0;0;0}: ["3.904234", "3.904234"], {0;1;0}: ["3.63653", "3.63653"], {0;2;0}: ["3.641221", "3.641221"], {0;3;0}: ["3.895407", "3.895407"], {0;4;0}: ["3.950041", "3.950041"], {0;5;0}: ["3.295916", "3.295916"], {0;6;0}: ["3.755898", "3.755898"], {0;7;0}: ["3.668474", "3.668474"], {0;8;0}: ["3.337766", "3.337766"], {0;9;0}: ["3.921367", "3.921367"]))
footprint_geo_25 = Panel(geo_26)
building_name_25 = Panel(bldgname_r2ab_23)
floor_floor_height_x_no_flrs_23 = Panel(noflrs_r2ab_23)

geo_27 = Geometry(polyline_28)  # disabled
bldgname_r2ab_24 = Data(bldg_name_28)  # disabled
noflrs_r2ab_24 = Data(duplicate_data_28)  # disabled
footprint_geo_26 = Panel(geo_27)  # disabled
building_name_26 = Panel(bldgname_r2ab_24)  # disabled
floor_floor_height_x_no_flrs_24 = Panel(noflrs_r2ab_24)  # disabled

geo_28 = Geometry(Tree({0}: [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], {1}: [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], {2}: [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], {3}: [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], {4}: [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], {5}: [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], {6}: [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], {7}: [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], {8}: [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]))
bldgname_r2ab_25 = Data(Tree({0;0}: ["215457723"], {0;1}: ["215457787"], {0;2}: ["215457810"], {0;3}: ["846895627"], {0;4}: ["863793542"], {0;5}: ["1000200086"], {0;6}: ["1069556125"], {0;7}: ["1184969747"], {0;8}: ["1214584632"]))
noflrs_r2ab_25 = Data(Tree({0;0;0}: ["3.020704", "3.020704", "3.020704", "3.020704"], {0;1;0}: ["3.977901", "3.977901", "3.977901"], {0;2;0}: ["3.689603", "3.689603", "3.689603"], {0;3;0}: ["3.730902", "3.730902", "3.730902"], {0;4;0}: ["3.494507", "3.494507", "3.494507"], {0;5;0}: ["3.750331", "3.750331", "3.750331"], {0;6;0}: ["3.968717", "3.968717", "3.968717"], {0;7;0}: ["3.815811", "3.815811", "3.815811"], {0;8;0}: ["3.516045", "3.516045", "3.516045"]))
footprint_geo_27 = Panel(geo_28)
building_name_27 = Panel(bldgname_r2ab_25)
floor_floor_height_x_no_flrs_25 = Panel(noflrs_r2ab_25)

noflrs_r2ab_26 = Data(Tree({0}: ["3.760834", "3.760834", "3.760834", "3.760834"], {1}: ["3.585271", "3.585271", "3.585271", "3.585271"], {2}: ["3.595", "3.595", "3.595", "3.595"], {3}: ["3.683528", "3.683528", "3.683528", "3.683528"], {4}: ["3.601084", "3.601084", "3.601084", "3.601084"], {5}: ["3.522835", "3.522835", "3.522835", "3.522835"], {6}: ["3.805759", "3.805759", "3.805759", "3.805759"], {7}: ["3.701961", "3.701961", "3.701961", "3.701961"]))
r2ab_footprint = Geometry(Tree({0}: [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], {1}: [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], {2}: [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], {3}: [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], {4}: [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], {5}: [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], {6}: [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], {7}: [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]))
bldgname_r2ab_26 = Data(Tree({0}: ["1069198799"], {1}: ["1069198809"], {2}: ["1069198817"], {3}: ["1069198821"], {4}: ["1069198852"], {5}: ["1069499900"], {6}: ["1069499904"], {7}: ["1069499907"]))
building_name_28 = Panel(bldgname_r2ab_26)
footprint_geo_28 = Panel(r2ab_footprint)
floor_floor_height_x_no_flrs_26 = Panel(noflrs_r2ab_26)

geo_29 = Geometry(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)
bldgname_r2ab_27 = Data("1000254901")
noflrs_r2ab_27 = Data(["3.901394", "3.901394", "3.901394"])
footprint_geo_29 = Panel(geo_29)
building_name_29 = Panel(bldgname_r2ab_27)
floor_floor_height_x_no_flrs_27 = Panel(noflrs_r2ab_27)

bldgname_r2ab_28 = Data(Tree({0}: ["444002105"], {1}: ["930680546"], {2}: ["1214584655"]))
noflrs_r2ab_28 = Data(Tree({0}: ["3.352516", "3.352516"], {1}: ["2.764144", "2.764144"], {2}: ["3.928955", "3.928955"]))
geo_30 = Geometry(Tree({0}: [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], {1}: [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], {2}: [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]))
footprint_geo_30 = Panel(geo_30)
building_name_30 = Panel(bldgname_r2ab_28)
floor_floor_height_x_no_flrs_28 = Panel(noflrs_r2ab_28)

wwr_south_27 = Panel(bldg_name_139)  # disabled
wwr_south_28 = Panel(bldg_name_115)

# ----
# Create Buildings -
# Use to Subtract Glazing @ Party Walls
falsestart = LBFalseStartToggle(False)
buildingfootprint = DFBuildingFromFootprint(footprint_geo=geo_2, floor_to_floor=data_22, name=data_23, run=falsestart)  # -> report, simplify(buildings); plug-in component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
vizall = DFVisualizeAll(df_objs=flatten(buildingfootprint.buildings))  # -> geo; plug-in component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
panel_184 = Panel(buildingfootprint.buildings)

# ----
# Create Buildings -
# Use to Subtract Glazing @ Party Walls
falsestart_2 = LBFalseStartToggle(False)
buildingfootprint_2 = DFBuildingFromFootprint(footprint_geo=geo_4, floor_to_floor=data_25, name=data_26, run=falsestart_2)  # -> report, simplify(buildings); plug-in component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
vizall_2 = DFVisualizeAll(df_objs=flatten(buildingfootprint_2.buildings))  # -> geo; plug-in component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
panel_185 = Panel(buildingfootprint_2.buildings)

# ----
# Create Extrusions -
# Use as Context Layer
Z = UnitZ(Factor=data_22)
extr = Extrude(Base=geo_2, Direction=Z)

# ----
# Create Extrusions -
# Use as Context Layer
Z_2 = UnitZ(Factor=data_25)
extr_2 = Extrude(Base=geo_4, Direction=Z_2)

detachedsched_pre1970_hcventmod = Data("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")

# ----
# 2. IMPORT PROGRAM
panel_186 = Panel("0.0006")
infiltration = HBInfiltration(name="High", flow_per_ext_area=panel_186)  # -> infil; plug-in component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
strtoobj = HBStringToObject(hb_str=detachedsched_pre1970_hcventmod)  # -> hb_obj; plug-in component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
programtype = HBProgramType(base_program=strtoobj, infiltration=infiltration)  # -> program; plug-in component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
deconstrprogram = HBDeconstructProgramType(program=programtype)  # -> people, lighting, electric_equip, gas_equip, hot_water, infiltration, ventilation, setpoint; plug-in component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
panel_187 = Panel(deconstrprogram.infiltration)

aptsched_1971_1999_hcventmod = Data("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")

# ----
# 2. IMPORT PROGRAM
panel_188 = Panel("0.0003")
infiltration_2 = HBInfiltration(name="Medium", flow_per_ext_area=panel_188)  # -> infil; plug-in component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
strtoobj_2 = HBStringToObject(hb_str=aptsched_1971_1999_hcventmod)  # -> hb_obj; plug-in component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
programtype_2 = HBProgramType(base_program=strtoobj_2, infiltration=infiltration_2)  # -> program; plug-in component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
deconstrprogram_2 = HBDeconstructProgramType(program=programtype_2)  # -> people, lighting, electric_equip, gas_equip, hot_water, infiltration, ventilation, setpoint; plug-in component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
panel_189 = Panel(deconstrprogram_2.infiltration)

aptsched_1971_1999_hcventmod_2 = Data("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")

# ----
# 2. IMPORT PROGRAM
panel_190 = Panel("0.0003")
infiltration_3 = HBInfiltration(name="Medium", flow_per_ext_area=panel_190)  # -> infil; plug-in component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
strtoobj_3 = HBStringToObject(hb_str=aptsched_1971_1999_hcventmod_2)  # -> hb_obj; plug-in component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
programtype_3 = HBProgramType(base_program=strtoobj_3, infiltration=infiltration_3)  # -> program; plug-in component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
deconstrprogram_3 = HBDeconstructProgramType(program=programtype_3)  # -> people, lighting, electric_equip, gas_equip, hot_water, infiltration, ventilation, setpoint; plug-in component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
panel_191 = Panel(deconstrprogram_3.infiltration)

detachedsched_pre1970_hcventmod_2 = Data("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")

# ----
# 2. IMPORT PROGRAM
panel_192 = Panel("0.0006")
infiltration_4 = HBInfiltration(name="High", flow_per_ext_area=panel_192)  # -> infil; plug-in component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
strtoobj_4 = HBStringToObject(hb_str=detachedsched_pre1970_hcventmod_2)  # -> hb_obj; plug-in component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
programtype_4 = HBProgramType(base_program=strtoobj_4, infiltration=infiltration_4)  # -> program; plug-in component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
deconstrprogram_4 = HBDeconstructProgramType(program=programtype_4)  # -> people, lighting, electric_equip, gas_equip, hot_water, infiltration, ventilation, setpoint; plug-in component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
panel_193 = Panel(deconstrprogram_4.infiltration)

aptsched_pre1970_hcventmod = Data("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")

# ----
# 2. IMPORT PROGRAM
panel_194 = Panel("0.0006")
infiltration_5 = HBInfiltration(name="High", flow_per_ext_area=panel_194)  # -> infil; plug-in component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
strtoobj_5 = HBStringToObject(hb_str=aptsched_pre1970_hcventmod)  # -> hb_obj; plug-in component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
programtype_5 = HBProgramType(base_program=strtoobj_5, infiltration=infiltration_5)  # -> program; plug-in component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
deconstrprogram_5 = HBDeconstructProgramType(program=programtype_5)  # -> people, lighting, electric_equip, gas_equip, hot_water, infiltration, ventilation, setpoint; plug-in component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
panel_195 = Panel(deconstrprogram_5.infiltration)

aptsched_pre1970_hcventmod_2 = Data("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")

# ----
# 2. IMPORT PROGRAM
panel_196 = Panel("0.0006")
infiltration_6 = HBInfiltration(name="High", flow_per_ext_area=panel_196)  # -> infil; plug-in component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
strtoobj_6 = HBStringToObject(hb_str=aptsched_pre1970_hcventmod_2)  # -> hb_obj; plug-in component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
programtype_6 = HBProgramType(base_program=strtoobj_6, infiltration=infiltration_6)  # -> program; plug-in component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
deconstrprogram_6 = HBDeconstructProgramType(program=programtype_6)  # -> people, lighting, electric_equip, gas_equip, hot_water, infiltration, ventilation, setpoint; plug-in component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
panel_197 = Panel(deconstrprogram_6.infiltration)

detachedsched_1971_1999_hcventmod = Data("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")  # disabled

# ----
# 2. IMPORT PROGRAM
panel_198 = Panel("0.0003")
infiltration_7 = HBInfiltration(name="Medium", flow_per_ext_area=panel_198)  # -> infil; disabled; plug-in component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
strtoobj_7 = HBStringToObject(hb_str=detachedsched_1971_1999_hcventmod)  # -> hb_obj; disabled; plug-in component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
programtype_7 = HBProgramType(base_program=strtoobj_7, infiltration=infiltration_7)  # -> program; disabled; plug-in component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
deconstrprogram_7 = HBDeconstructProgramType(program=programtype_7)  # -> people, lighting, electric_equip, gas_equip, hot_water, infiltration, ventilation, setpoint; disabled; plug-in component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
panel_199 = Panel(deconstrprogram_7.infiltration)  # disabled

aptsched_pre1970_hcventmod_3 = Data("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")

# ----
# 2. IMPORT PROGRAM
panel_200 = Panel("0.0006")
infiltration_8 = HBInfiltration(name="High", flow_per_ext_area=panel_200)  # -> infil; plug-in component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
strtoobj_8 = HBStringToObject(hb_str=aptsched_pre1970_hcventmod_3)  # -> hb_obj; plug-in component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
programtype_8 = HBProgramType(base_program=strtoobj_8, infiltration=infiltration_8)  # -> program; plug-in component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
deconstrprogram_8 = HBDeconstructProgramType(program=programtype_8)  # -> people, lighting, electric_equip, gas_equip, hot_water, infiltration, ventilation, setpoint; plug-in component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
panel_201 = Panel(deconstrprogram_8.infiltration)

aptsched_pre1970_hcventmod_4 = Data("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")

# ----
# 2. IMPORT PROGRAM
panel_202 = Panel("0.0006")
infiltration_9 = HBInfiltration(name="High", flow_per_ext_area=panel_202)  # -> infil; plug-in component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
strtoobj_9 = HBStringToObject(hb_str=aptsched_pre1970_hcventmod_4)  # -> hb_obj; plug-in component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
programtype_9 = HBProgramType(base_program=strtoobj_9, infiltration=infiltration_9)  # -> program; plug-in component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
deconstrprogram_9 = HBDeconstructProgramType(program=programtype_9)  # -> people, lighting, electric_equip, gas_equip, hot_water, infiltration, ventilation, setpoint; plug-in component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
panel_203 = Panel(deconstrprogram_9.infiltration)

detachedsched_pre1970_hcventmod_3 = Data("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")

# ----
# 2. IMPORT PROGRAM
panel_204 = Panel("0.0006")
infiltration_10 = HBInfiltration(name="High", flow_per_ext_area=panel_204)  # -> infil; plug-in component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
strtoobj_10 = HBStringToObject(hb_str=detachedsched_pre1970_hcventmod_3)  # -> hb_obj; plug-in component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
programtype_10 = HBProgramType(base_program=strtoobj_10, infiltration=infiltration_10)  # -> program; plug-in component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
deconstrprogram_10 = HBDeconstructProgramType(program=programtype_10)  # -> people, lighting, electric_equip, gas_equip, hot_water, infiltration, ventilation, setpoint; plug-in component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
panel_205 = Panel(deconstrprogram_10.infiltration)

detachedsched_1971_1999_hcventmod_2 = Data("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")

# ----
# 2. IMPORT PROGRAM
panel_206 = Panel("0.0003")
infiltration_11 = HBInfiltration(name="Medium", flow_per_ext_area=panel_206)  # -> infil; plug-in component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
strtoobj_11 = HBStringToObject(hb_str=detachedsched_1971_1999_hcventmod_2)  # -> hb_obj; plug-in component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
programtype_11 = HBProgramType(base_program=strtoobj_11, infiltration=infiltration_11)  # -> program; plug-in component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
deconstrprogram_11 = HBDeconstructProgramType(program=programtype_11)  # -> people, lighting, electric_equip, gas_equip, hot_water, infiltration, ventilation, setpoint; plug-in component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
panel_207 = Panel(deconstrprogram_11.infiltration)

detachedsched_pre1970_hcventmod_4 = Data("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")

# ----
# 2. IMPORT PROGRAM
panel_208 = Panel("0.0006")
infiltration_12 = HBInfiltration(name="High", flow_per_ext_area=panel_208)  # -> infil; plug-in component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
strtoobj_12 = HBStringToObject(hb_str=detachedsched_pre1970_hcventmod_4)  # -> hb_obj; plug-in component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
programtype_12 = HBProgramType(base_program=strtoobj_12, infiltration=infiltration_12)  # -> program; plug-in component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
deconstrprogram_12 = HBDeconstructProgramType(program=programtype_12)  # -> people, lighting, electric_equip, gas_equip, hot_water, infiltration, ventilation, setpoint; plug-in component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
panel_209 = Panel(deconstrprogram_12.infiltration)

detachedsched_pre1970_hcventmod_5 = Data("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")  # disabled

# ----
# 2. IMPORT PROGRAM
panel_210 = Panel("0.0006")
infiltration_13 = HBInfiltration(name="High", flow_per_ext_area=panel_210)  # -> infil; disabled; plug-in component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
strtoobj_13 = HBStringToObject(hb_str=detachedsched_pre1970_hcventmod_5)  # -> hb_obj; disabled; plug-in component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
programtype_13 = HBProgramType(base_program=strtoobj_13, infiltration=infiltration_13)  # -> program; disabled; plug-in component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
deconstrprogram_13 = HBDeconstructProgramType(program=programtype_13)  # -> people, lighting, electric_equip, gas_equip, hot_water, infiltration, ventilation, setpoint; disabled; plug-in component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
panel_211 = Panel(deconstrprogram_13.infiltration)  # disabled

aptsched_pre1970_hcventmod_5 = Data("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")

# ----
# 2. IMPORT PROGRAM
panel_212 = Panel("0.0006")
infiltration_14 = HBInfiltration(name="High", flow_per_ext_area=panel_212)  # -> infil; plug-in component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
strtoobj_14 = HBStringToObject(hb_str=aptsched_pre1970_hcventmod_5)  # -> hb_obj; plug-in component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
programtype_14 = HBProgramType(base_program=strtoobj_14, infiltration=infiltration_14)  # -> program; plug-in component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
deconstrprogram_14 = HBDeconstructProgramType(program=programtype_14)  # -> people, lighting, electric_equip, gas_equip, hot_water, infiltration, ventilation, setpoint; plug-in component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
panel_213 = Panel(deconstrprogram_14.infiltration)

aptsched_pre1970_hcventmod_6 = Data("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")

# ----
# 2. IMPORT PROGRAM
panel_214 = Panel("0.0006")
infiltration_15 = HBInfiltration(name="High", flow_per_ext_area=panel_214)  # -> infil; plug-in component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
strtoobj_15 = HBStringToObject(hb_str=aptsched_pre1970_hcventmod_6)  # -> hb_obj; plug-in component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
programtype_15 = HBProgramType(base_program=strtoobj_15, infiltration=infiltration_15)  # -> program; plug-in component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
deconstrprogram_15 = HBDeconstructProgramType(program=programtype_15)  # -> people, lighting, electric_equip, gas_equip, hot_water, infiltration, ventilation, setpoint; plug-in component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
panel_215 = Panel(deconstrprogram_15.infiltration)

aptsched_1971_1999_hcventmod_3 = Data("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")

# ----
# 2. IMPORT PROGRAM
panel_216 = Panel("0.0003")
infiltration_16 = HBInfiltration(name="Medium", flow_per_ext_area=panel_216)  # -> infil; plug-in component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
strtoobj_16 = HBStringToObject(hb_str=aptsched_1971_1999_hcventmod_3)  # -> hb_obj; plug-in component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
programtype_16 = HBProgramType(base_program=strtoobj_16, infiltration=infiltration_16)  # -> program; plug-in component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
deconstrprogram_16 = HBDeconstructProgramType(program=programtype_16)  # -> people, lighting, electric_equip, gas_equip, hot_water, infiltration, ventilation, setpoint; plug-in component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
panel_217 = Panel(deconstrprogram_16.infiltration)

detachedsched_pre1970_hcventmod_6 = Data("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")

# ----
# 2. IMPORT PROGRAM
panel_218 = Panel("0.0006")
infiltration_17 = HBInfiltration(name="High", flow_per_ext_area=panel_218)  # -> infil; plug-in component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
strtoobj_17 = HBStringToObject(hb_str=detachedsched_pre1970_hcventmod_6)  # -> hb_obj; plug-in component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
programtype_17 = HBProgramType(base_program=strtoobj_17, infiltration=infiltration_17)  # -> program; plug-in component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
deconstrprogram_17 = HBDeconstructProgramType(program=programtype_17)  # -> people, lighting, electric_equip, gas_equip, hot_water, infiltration, ventilation, setpoint; plug-in component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
panel_219 = Panel(deconstrprogram_17.infiltration)

aptsched_pre1970_hcventmod_7 = Data("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")

# ----
# 2. IMPORT PROGRAM
panel_220 = Panel("0.0006")
infiltration_18 = HBInfiltration(name="High", flow_per_ext_area=panel_220)  # -> infil; plug-in component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
strtoobj_18 = HBStringToObject(hb_str=aptsched_pre1970_hcventmod_7)  # -> hb_obj; plug-in component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
programtype_18 = HBProgramType(base_program=strtoobj_18, infiltration=infiltration_18)  # -> program; plug-in component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
deconstrprogram_18 = HBDeconstructProgramType(program=programtype_18)  # -> people, lighting, electric_equip, gas_equip, hot_water, infiltration, ventilation, setpoint; plug-in component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
panel_221 = Panel(deconstrprogram_18.infiltration)

detachedsched_pre1970_hcventmod_7 = Data("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")

# ----
# 2. IMPORT PROGRAM
panel_222 = Panel("0.0006")
infiltration_19 = HBInfiltration(name="High", flow_per_ext_area=panel_222)  # -> infil; plug-in component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
strtoobj_19 = HBStringToObject(hb_str=detachedsched_pre1970_hcventmod_7)  # -> hb_obj; plug-in component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
programtype_19 = HBProgramType(base_program=strtoobj_19, infiltration=infiltration_19)  # -> program; plug-in component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
deconstrprogram_19 = HBDeconstructProgramType(program=programtype_19)  # -> people, lighting, electric_equip, gas_equip, hot_water, infiltration, ventilation, setpoint; plug-in component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
panel_223 = Panel(deconstrprogram_19.infiltration)

aptsched_pre1970_hcventmod_8 = Data("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")

# ----
# 2. IMPORT PROGRAM
panel_224 = Panel("0.0006")
infiltration_20 = HBInfiltration(name="High", flow_per_ext_area=panel_224)  # -> infil; plug-in component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
strtoobj_20 = HBStringToObject(hb_str=aptsched_pre1970_hcventmod_8)  # -> hb_obj; plug-in component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
programtype_20 = HBProgramType(base_program=strtoobj_20, infiltration=infiltration_20)  # -> program; plug-in component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
deconstrprogram_20 = HBDeconstructProgramType(program=programtype_20)  # -> people, lighting, electric_equip, gas_equip, hot_water, infiltration, ventilation, setpoint; plug-in component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
panel_225 = Panel(deconstrprogram_20.infiltration)

aptsched_2000andafter_hcventmod = Data("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")

# ----
# 2. IMPORT PROGRAM
panel_226 = Panel("0.0001")
infiltration_21 = HBInfiltration(name="Low", flow_per_ext_area=panel_226)  # -> infil; plug-in component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
strtoobj_21 = HBStringToObject(hb_str=aptsched_2000andafter_hcventmod)  # -> hb_obj; plug-in component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
programtype_21 = HBProgramType(base_program=strtoobj_21, infiltration=infiltration_21)  # -> program; plug-in component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
deconstrprogram_21 = HBDeconstructProgramType(program=programtype_21)  # -> people, lighting, electric_equip, gas_equip, hot_water, infiltration, ventilation, setpoint; plug-in component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
panel_227 = Panel(deconstrprogram_21.infiltration)

detachedsched_pre1970_hcventmod_8 = Data("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")  # disabled

# ----
# 2. IMPORT PROGRAM
panel_228 = Panel("0.0006")
infiltration_22 = HBInfiltration(name="High", flow_per_ext_area=panel_228)  # -> infil; disabled; plug-in component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
strtoobj_22 = HBStringToObject(hb_str=detachedsched_pre1970_hcventmod_8)  # -> hb_obj; disabled; plug-in component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
programtype_22 = HBProgramType(base_program=strtoobj_22, infiltration=infiltration_22)  # -> program; disabled; plug-in component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
deconstrprogram_22 = HBDeconstructProgramType(program=programtype_22)  # -> people, lighting, electric_equip, gas_equip, hot_water, infiltration, ventilation, setpoint; disabled; plug-in component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
panel_229 = Panel(deconstrprogram_22.infiltration)  # disabled

aptsched_1971_1999_hcventmod_4 = Data("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")

# ----
# 2. IMPORT PROGRAM
panel_230 = Panel("0.0003")
infiltration_23 = HBInfiltration(name="Medium", flow_per_ext_area=panel_230)  # -> infil; plug-in component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
strtoobj_23 = HBStringToObject(hb_str=aptsched_1971_1999_hcventmod_4)  # -> hb_obj; plug-in component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
programtype_23 = HBProgramType(base_program=strtoobj_23, infiltration=infiltration_23)  # -> program; plug-in component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
deconstrprogram_23 = HBDeconstructProgramType(program=programtype_23)  # -> people, lighting, electric_equip, gas_equip, hot_water, infiltration, ventilation, setpoint; plug-in component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
panel_231 = Panel(deconstrprogram_23.infiltration)

detachedsched_1971_1999_hcventmod_3 = Data("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")

# ----
# 2. IMPORT PROGRAM
panel_232 = Panel("Medium")
infiltration_24 = HBInfiltration(name=panel_232, flow_per_ext_area="0.0003")  # -> infil; plug-in component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
strtoobj_24 = HBStringToObject(hb_str=detachedsched_1971_1999_hcventmod_3)  # -> hb_obj; plug-in component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
programtype_24 = HBProgramType(base_program=strtoobj_24, infiltration=infiltration_24)  # -> program; plug-in component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
deconstrprogram_24 = HBDeconstructProgramType(program=programtype_24)  # -> people, lighting, electric_equip, gas_equip, hot_water, infiltration, ventilation, setpoint; plug-in component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
panel_233 = Panel(deconstrprogram_24.infiltration)

aptsched_2000andafter_hcventmod_2 = Data("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")  # disabled

# ----
# 2. IMPORT PROGRAM
panel_234 = Panel("0.0001")
infiltration_25 = HBInfiltration(name="Low", flow_per_ext_area=panel_234)  # -> infil; disabled; plug-in component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
strtoobj_25 = HBStringToObject(hb_str=aptsched_2000andafter_hcventmod_2)  # -> hb_obj; disabled; plug-in component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
programtype_25 = HBProgramType(base_program=strtoobj_25, infiltration=infiltration_25)  # -> program; disabled; plug-in component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
deconstrprogram_25 = HBDeconstructProgramType(program=programtype_25)  # -> people, lighting, electric_equip, gas_equip, hot_water, infiltration, ventilation, setpoint; disabled; plug-in component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
panel_235 = Panel(deconstrprogram_25.infiltration)  # disabled

detachedsched_2000andafter_hcventmod = Data("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")  # disabled

# ----
# 2. IMPORT PROGRAM
panel_236 = Panel("0.0001")
infiltration_26 = HBInfiltration(name="Low", flow_per_ext_area=panel_236)  # -> infil; disabled; plug-in component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
strtoobj_26 = HBStringToObject(hb_str=detachedsched_2000andafter_hcventmod)  # -> hb_obj; disabled; plug-in component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
programtype_26 = HBProgramType(base_program=strtoobj_26, infiltration=infiltration_26)  # -> program; disabled; plug-in component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
deconstrprogram_26 = HBDeconstructProgramType(program=programtype_26)  # -> people, lighting, electric_equip, gas_equip, hot_water, infiltration, ventilation, setpoint; disabled; plug-in component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
panel_237 = Panel(deconstrprogram_26.infiltration)  # disabled

detachedsched_1971_1999_hcventmod_4 = Data("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")  # disabled

# ----
# 2. IMPORT PROGRAM
panel_238 = Panel("0.0003")
infiltration_27 = HBInfiltration(name="Medium", flow_per_ext_area=panel_238)  # -> infil; disabled; plug-in component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
strtoobj_27 = HBStringToObject(hb_str=detachedsched_1971_1999_hcventmod_4)  # -> hb_obj; disabled; plug-in component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
programtype_27 = HBProgramType(base_program=strtoobj_27, infiltration=infiltration_27)  # -> program; disabled; plug-in component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
deconstrprogram_27 = HBDeconstructProgramType(program=programtype_27)  # -> people, lighting, electric_equip, gas_equip, hot_water, infiltration, ventilation, setpoint; disabled; plug-in component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
panel_239 = Panel(deconstrprogram_27.infiltration)  # disabled

detachedsched_2000andafter_hcventmod_2 = Data("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")

# ----
# 2. IMPORT PROGRAM
panel_240 = Panel("0.0001")
infiltration_28 = HBInfiltration(name="Low", flow_per_ext_area=panel_240)  # -> infil; plug-in component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
strtoobj_28 = HBStringToObject(hb_str=detachedsched_2000andafter_hcventmod_2)  # -> hb_obj; plug-in component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
programtype_28 = HBProgramType(base_program=strtoobj_28, infiltration=infiltration_28)  # -> program; plug-in component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
deconstrprogram_28 = HBDeconstructProgramType(program=programtype_28)  # -> people, lighting, electric_equip, gas_equip, hot_water, infiltration, ventilation, setpoint; plug-in component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
panel_241 = Panel(deconstrprogram_28.infiltration)

panel_242 = Panel(extr)
panel_243 = Panel(extr_2)

# ----
# 3. IMPORT APPROPRIATE
#  CONSTRUCTION SET
# IMPORT
r5sf_cset = Data("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")
strtoobj_29 = HBStringToObject(hb_str=r5sf_cset)  # -> hb_obj; plug-in component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
panel_244 = Panel(strtoobj_29)

# ----
# 1. CONVERT GIS FOOTPRINT TO 3D DRAGONFLY BLDGS
# R5SF
falsestart_3 = LBFalseStartToggle(False)  # disabled
buildingfootprint_3 = DFBuildingFromFootprint(
    footprint_geo=geo_23,
    floor_to_floor=noflrs_r2ab_20,
    name=bldgname_r2ab_20,
    program=programtype_13,
    constr_set=strtoobj_29,
    run=falsestart_3)  # -> out, simplify(buildings); disabled; plug-in component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
panel_245 = Panel(buildingfootprint_3.buildings)  # disabled
vizall_3 = DFVisualizeAll(df_objs=buildingfootprint_3.buildings)  # -> geo; disabled; plug-in component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

# ----
# 3. IMPORT APPROPRIATE
#  CONSTRUCTION SET
# IMPORT
r6sf_cset = Data("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")
strtoobj_30 = HBStringToObject(hb_str=r6sf_cset)  # -> hb_obj; plug-in component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
panel_246 = Panel(strtoobj_30)

# ----
# 1. CONVERT GIS FOOTPRINT TO 3D DRAGONFLY BLDGS
# R6SF
falsestart_4 = LBFalseStartToggle(False)  # disabled
buildingfootprint_4 = DFBuildingFromFootprint(
    footprint_geo=geo_20,
    floor_to_floor=noflrs_r2ab_18,
    name=bldgname_r2ab_18,
    program=programtype_7,
    constr_set=strtoobj_30,
    run=falsestart_4)  # -> out, simplify(buildings); disabled; plug-in component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
panel_247 = Panel(buildingfootprint_4.buildings)  # disabled
vizall_4 = DFVisualizeAll(df_objs=buildingfootprint_4.buildings)  # -> geo; disabled; plug-in component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

# ----
# 3. IMPORT APPROPRIATE
#  CONSTRUCTION SET
# IMPORT
r7ab_cset = Data("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")
strtoobj_31 = HBStringToObject(hb_str=r7ab_cset)  # -> hb_obj; plug-in component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
panel_248 = Panel(strtoobj_31)

# ----
# 1. CONVERT GIS FOOTPRINT TO 3D DRAGONFLY BLDGS
# R7AB
falsestart_5 = LBFalseStartToggle(False)
buildingfootprint_5 = DFBuildingFromFootprint(
    footprint_geo=geo_12,
    floor_to_floor=noflrs_r2ab_10,
    name=bldgname_r2ab_10,
    program=programtype_16,
    constr_set=strtoobj_31,
    run=falsestart_5)  # -> out, simplify(buildings); plug-in component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
panel_249 = Panel(buildingfootprint_5.buildings)
vizall_5 = DFVisualizeAll(df_objs=buildingfootprint_5.buildings)  # -> geo; plug-in component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

# ----
# 3. IMPORT APPROPRIATE
#  CONSTRUCTION SET
# IMPORT
r6mf_cset = Data("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")
strtoobj_32 = HBStringToObject(hb_str=r6mf_cset)  # -> hb_obj; plug-in component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
panel_250 = Panel(strtoobj_32)

# ----
# 1. CONVERT GIS FOOTPRINT TO 3D DRAGONFLY BLDGS
# R6MF
falsestart_6 = LBFalseStartToggle(False)
buildingfootprint_6 = DFBuildingFromFootprint(
    footprint_geo=geo_24,
    floor_to_floor=noflrs_r2ab_21,
    name=bldgname_r2ab_21,
    program=programtype_2,
    constr_set=strtoobj_32,
    run=falsestart_6)  # -> out, simplify(buildings); plug-in component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
panel_251 = Panel(buildingfootprint_6.buildings)
vizall_6 = DFVisualizeAll(df_objs=buildingfootprint_6.buildings)  # -> geo; plug-in component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

# ----
# 3. IMPORT APPROPRIATE
#  CONSTRUCTION SET
# IMPORT
r5ab_cset = Data("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")
strtoobj_33 = HBStringToObject(hb_str=r5ab_cset)  # -> hb_obj; plug-in component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
panel_252 = Panel(strtoobj_33)

# ----
# 1. CONVERT GIS FOOTPRINT TO 3D DRAGONFLY BLDGS
# R5AB
falsestart_7 = LBFalseStartToggle(False)
buildingfootprint_7 = DFBuildingFromFootprint(
    footprint_geo=geo_17,
    floor_to_floor=noflrs_r2ab_15,
    name=bldgname_r2ab_15,
    program=programtype_9,
    constr_set=strtoobj_33,
    run=falsestart_7)  # -> out, simplify(buildings); plug-in component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
panel_253 = Panel(buildingfootprint_7.buildings)
vizall_7 = DFVisualizeAll(df_objs=buildingfootprint_7.buildings)  # -> geo; plug-in component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

# ----
# 3. IMPORT APPROPRIATE
#  CONSTRUCTION SET
# IMPORT
r6ab_cset = Data("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")
strtoobj_34 = HBStringToObject(hb_str=r6ab_cset)  # -> hb_obj; plug-in component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
panel_254 = Panel(strtoobj_34)

# ----
# 1. CONVERT GIS FOOTPRINT TO 3D DRAGONFLY BLDGS
# R6AB
falsestart_8 = LBFalseStartToggle(False)
buildingfootprint_8 = DFBuildingFromFootprint(
    footprint_geo=geo_22,
    floor_to_floor=noflrs_r2ab_19,
    name=bldgname_r2ab_19,
    program=programtype_3,
    constr_set=strtoobj_34,
    run=falsestart_8)  # -> out, simplify(buildings); plug-in component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
panel_255 = Panel(buildingfootprint_8.buildings)
vizall_8 = DFVisualizeAll(df_objs=buildingfootprint_8.buildings)  # -> geo; plug-in component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

# ----
# 3. IMPORT APPROPRIATE
#  CONSTRUCTION SET
# IMPORT
r6th_cset = Data("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")
strtoobj_35 = HBStringToObject(hb_str=r6th_cset)  # -> hb_obj; plug-in component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
panel_256 = Panel(strtoobj_35)

# ----
# 1. CONVERT GIS FOOTPRINT TO 3D DRAGONFLY BLDGS
# R6TH
falsestart_9 = LBFalseStartToggle(False)
buildingfootprint_9 = DFBuildingFromFootprint(
    footprint_geo=geo_30,
    floor_to_floor=noflrs_r2ab_28,
    name=bldgname_r2ab_28,
    program=programtype_11,
    constr_set=strtoobj_35,
    run=falsestart_9)  # -> out, simplify(buildings); plug-in component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
panel_257 = Panel(buildingfootprint_9.buildings)
vizall_9 = DFVisualizeAll(df_objs=buildingfootprint_9.buildings)  # -> geo; plug-in component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

# ----
# 3. IMPORT APPROPRIATE
#  CONSTRUCTION SET
# IMPORT
r5mf_cset = Data("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")
strtoobj_36 = HBStringToObject(hb_str=r5mf_cset)  # -> hb_obj; plug-in component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
panel_258 = Panel(strtoobj_36)

# ----
# 1. CONVERT GIS FOOTPRINT TO 3D DRAGONFLY BLDGS
# R5MF
falsestart_10 = LBFalseStartToggle(False)
buildingfootprint_10 = DFBuildingFromFootprint(
    footprint_geo=geo_28,
    floor_to_floor=noflrs_r2ab_25,
    name=bldgname_r2ab_25,
    program=programtype_5,
    constr_set=strtoobj_36,
    run=falsestart_10)  # -> out, simplify(buildings); plug-in component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
panel_259 = Panel(buildingfootprint_10.buildings)
vizall_10 = DFVisualizeAll(df_objs=buildingfootprint_10.buildings)  # -> geo; plug-in component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

# ----
# 3. IMPORT APPROPRIATE
#  CONSTRUCTION SET
# IMPORT
r4th_cset = Data("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")
strtoobj_37 = HBStringToObject(hb_str=r4th_cset)  # -> hb_obj; plug-in component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
panel_260 = Panel(strtoobj_37)

# ----
# 1. CONVERT GIS FOOTPRINT TO 3D DRAGONFLY BLDGS
# R4TH
falsestart_11 = LBFalseStartToggle(False)
buildingfootprint_11 = DFBuildingFromFootprint(
    footprint_geo=geo_16,
    floor_to_floor=noflrs_r2ab_14,
    name=bldgname_r2ab_14,
    program=programtype,
    constr_set=strtoobj_37,
    run=falsestart_11)  # -> out, simplify(buildings); plug-in component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
panel_261 = Panel(buildingfootprint_11.buildings)
vizall_11 = DFVisualizeAll(df_objs=buildingfootprint_11.buildings)  # -> geo; plug-in component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

# ----
# 3. IMPORT APPROPRIATE
#  CONSTRUCTION SET
# IMPORT
r5th_cset = Data("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")
strtoobj_38 = HBStringToObject(hb_str=r5th_cset)  # -> hb_obj; plug-in component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
panel_262 = Panel(strtoobj_38)

# ----
# 1. CONVERT GIS FOOTPRINT TO 3D DRAGONFLY BLDGS
# R5TH
falsestart_12 = LBFalseStartToggle(False)
buildingfootprint_12 = DFBuildingFromFootprint(
    footprint_geo=geo_26,
    floor_to_floor=noflrs_r2ab_23,
    name=bldgname_r2ab_23,
    program=programtype_4,
    constr_set=strtoobj_38,
    run=falsestart_12)  # -> out, simplify(buildings); plug-in component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
panel_263 = Panel(buildingfootprint_12.buildings)
vizall_12 = DFVisualizeAll(df_objs=buildingfootprint_12.buildings)  # -> geo; plug-in component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

# ----
# 3. IMPORT APPROPRIATE
#  CONSTRUCTION SET
# IMPORT
r3sf_cset = Data("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")
strtoobj_39 = HBStringToObject(hb_str=r3sf_cset)  # -> hb_obj; plug-in component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
panel_264 = Panel(strtoobj_39)

# ----
# 1. CONVERT GIS FOOTPRINT TO 3D DRAGONFLY BLDGS
# R3SF
falsestart_13 = LBFalseStartToggle(False)
buildingfootprint_13 = DFBuildingFromFootprint(
    footprint_geo=geo_7,
    floor_to_floor=noflrs_r2ab_5,
    name=bldgname_r2ab_5,
    program=programtype_12,
    constr_set=strtoobj_39,
    run=falsestart_13)  # -> out, simplify(buildings); plug-in component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
panel_265 = Panel(buildingfootprint_13.buildings)
vizall_13 = DFVisualizeAll(df_objs=buildingfootprint_13.buildings)  # -> geo; plug-in component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

# ----
# 3. IMPORT APPROPRIATE
#  CONSTRUCTION SET
# IMPORT
r2ab_cset = Data("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")
strtoobj_40 = HBStringToObject(hb_str=r2ab_cset)  # -> hb_obj; plug-in component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
panel_266 = Panel(strtoobj_40)

# ----
# 1. CONVERT GIS FOOTPRINT TO 3D DRAGONFLY BLDGS
# R2AB
falsestart_14 = LBFalseStartToggle(False)
buildingfootprint_14 = DFBuildingFromFootprint(
    footprint_geo=r2ab_footprint,
    floor_to_floor=noflrs_r2ab_26,
    name=bldgname_r2ab_26,
    program=programtype_8,
    constr_set=strtoobj_40,
    run=falsestart_14)  # -> out, simplify(buildings); plug-in component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
vizall_14 = DFVisualizeAll(df_objs=buildingfootprint_14.buildings)  # -> geo; plug-in component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
panel_267 = Panel(buildingfootprint_14.buildings)

# ----
# 3. IMPORT APPROPRIATE
#  CONSTRUCTION SET
# IMPORT
r3th_cset = Data("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")
strtoobj_41 = HBStringToObject(hb_str=r3th_cset)  # -> hb_obj; plug-in component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
panel_268 = Panel(strtoobj_41)

# ----
# 1. CONVERT GIS FOOTPRINT TO 3D DRAGONFLY BLDGS
# R3TH
falsestart_15 = LBFalseStartToggle(False)
buildingfootprint_15 = DFBuildingFromFootprint(
    footprint_geo=geo_5,
    floor_to_floor=noflrs_r2ab_3,
    name=bldgname_r2ab_3,
    program=programtype_17,
    constr_set=strtoobj_41,
    run=falsestart_15)  # -> out, simplify(buildings); plug-in component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
panel_269 = Panel(buildingfootprint_15.buildings)
vizall_15 = DFVisualizeAll(df_objs=buildingfootprint_15.buildings)  # -> geo; plug-in component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

# ----
# 3. IMPORT APPROPRIATE
#  CONSTRUCTION SET
# IMPORT
r4ab_cset = Data("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")
strtoobj_42 = HBStringToObject(hb_str=r4ab_cset)  # -> hb_obj; plug-in component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
panel_270 = Panel(strtoobj_42)

# ----
# 1. CONVERT GIS FOOTPRINT TO 3D DRAGONFLY BLDGS
# R4AB
falsestart_16 = LBFalseStartToggle(False)
buildingfootprint_16 = DFBuildingFromFootprint(
    footprint_geo=geo_6,
    floor_to_floor=noflrs_r2ab_4,
    name=bldgname_r2ab_4,
    program=programtype_20,
    constr_set=strtoobj_42,
    run=falsestart_16)  # -> out, simplify(buildings); plug-in component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
panel_271 = Panel(buildingfootprint_16.buildings)
vizall_16 = DFVisualizeAll(df_objs=buildingfootprint_16.buildings)  # -> geo; plug-in component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

# ----
# 3. IMPORT APPROPRIATE
#  CONSTRUCTION SET
# IMPORT
r3ab_cset = Data("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")
strtoobj_43 = HBStringToObject(hb_str=r3ab_cset)  # -> hb_obj; plug-in component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
panel_272 = Panel(strtoobj_43)

# ----
# 1. CONVERT GIS FOOTPRINT TO 3D DRAGONFLY BLDGS
# R3AB
falsestart_17 = LBFalseStartToggle(False)
buildingfootprint_17 = DFBuildingFromFootprint(
    footprint_geo=geo_11,
    floor_to_floor=noflrs_r2ab_9,
    name=bldgname_r2ab_9,
    program=programtype_6,
    constr_set=strtoobj_43,
    run=falsestart_17)  # -> out, simplify(buildings); plug-in component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
panel_273 = Panel(buildingfootprint_17.buildings)
vizall_17 = DFVisualizeAll(df_objs=buildingfootprint_17.buildings)  # -> geo; plug-in component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

# ----
# 5. IMPORT APPROPRIATE
#  CONSTRUCTION SET
# IMPORT
r8mf_cset = Data("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")
strtoobj_44 = HBStringToObject(hb_str=r8mf_cset)  # -> hb_obj; plug-in component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
panel_274 = Panel(strtoobj_44)

# ----
# 1. CONVERT GIS FOOTPRINT TO 3D DRAGONFLY BLDGS
# R8MF
falsestart_18 = LBFalseStartToggle(False)  # disabled
buildingfootprint_18 = DFBuildingFromFootprint(
    footprint_geo=geo_18,
    floor_to_floor=noflrs_r2ab_16,
    name=bldgname_r2ab_16,
    program=programtype_25,
    constr_set=strtoobj_44,
    run=falsestart_18)  # -> out, simplify(buildings); disabled; plug-in component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
panel_275 = Panel(buildingfootprint_18.buildings)  # disabled
vizall_18 = DFVisualizeAll(df_objs=buildingfootprint_18.buildings)  # -> geo; disabled; plug-in component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

# ----
# 5. IMPORT APPROPRIATE
#  CONSTRUCTION SET
# IMPORT
r8sf_cset = Data("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")
strtoobj_45 = HBStringToObject(hb_str=r8sf_cset)  # -> hb_obj; plug-in component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
panel_276 = Panel(strtoobj_45)

# ----
# 1. CONVERT GIS FOOTPRINT TO 3D DRAGONFLY BLDGS
# R8SF
falsestart_19 = LBFalseStartToggle(False)  # disabled
buildingfootprint_19 = DFBuildingFromFootprint(
    footprint_geo=geo_27,
    floor_to_floor=noflrs_r2ab_24,
    name=bldgname_r2ab_24,
    program=programtype_26,
    constr_set=strtoobj_45,
    run=falsestart_19)  # -> out, simplify(buildings); disabled; plug-in component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
panel_277 = Panel(buildingfootprint_19.buildings)  # disabled
vizall_19 = DFVisualizeAll(df_objs=buildingfootprint_19.buildings)  # -> geo; disabled; plug-in component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

# ----
# 3. IMPORT APPROPRIATE
#  CONSTRUCTION SET
# IMPORT
r7sf_cset = Data("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")
strtoobj_46 = HBStringToObject(hb_str=r7sf_cset)  # -> hb_obj; plug-in component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
panel_278 = Panel(strtoobj_46)

# ----
# 1. CONVERT GIS FOOTPRINT TO 3D DRAGONFLY BLDGS
# R7SF
falsestart_20 = LBFalseStartToggle(False)  # disabled
buildingfootprint_20 = DFBuildingFromFootprint(
    footprint_geo=geo_10,
    floor_to_floor=noflrs_r2ab_8,
    name=bldgname_r2ab_8,
    program=programtype_27,
    constr_set=strtoobj_46,
    run=falsestart_20)  # -> out, simplify(buildings); disabled; plug-in component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
panel_279 = Panel(buildingfootprint_20.buildings)  # disabled
vizall_20 = DFVisualizeAll(df_objs=buildingfootprint_20.buildings)  # -> geo; disabled; plug-in component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

# ----
# 3. IMPORT APPROPRIATE
#  CONSTRUCTION SET
# IMPORT
r3mf_cset = Data("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")
strtoobj_47 = HBStringToObject(hb_str=r3mf_cset)  # -> hb_obj; plug-in component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
panel_280 = Panel(strtoobj_47)

# ----
# 1. CONVERT GIS FOOTPRINT TO 3D DRAGONFLY BLDGS
# R3MF
falsestart_21 = LBFalseStartToggle(False)
buildingfootprint_21 = DFBuildingFromFootprint(
    footprint_geo=geo_9,
    floor_to_floor=noflrs_r2ab_7,
    name=bldgname_r2ab_7,
    program=programtype_14,
    constr_set=strtoobj_47,
    run=falsestart_21)  # -> out, simplify(buildings); plug-in component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
panel_281 = Panel(buildingfootprint_21.buildings)
vizall_21 = DFVisualizeAll(df_objs=buildingfootprint_21.buildings)  # -> geo; plug-in component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

# ----
# 3. IMPORT APPROPRIATE
#  CONSTRUCTION SET
# IMPORT
r4mf_cset = Data("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")
strtoobj_48 = HBStringToObject(hb_str=r4mf_cset)  # -> hb_obj; plug-in component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
panel_282 = Panel(strtoobj_48)

# ----
# 1. CONVERT GIS FOOTPRINT TO 3D DRAGONFLY BLDGS
# R4MF
falsestart_22 = LBFalseStartToggle(False)
buildingfootprint_22 = DFBuildingFromFootprint(
    footprint_geo=geo_15,
    floor_to_floor=noflrs_r2ab_13,
    name=bldgname_r2ab_13,
    program=programtype_18,
    constr_set=strtoobj_48,
    run=falsestart_22)  # -> out, simplify(buildings); plug-in component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
panel_283 = Panel(buildingfootprint_22.buildings)
vizall_22 = DFVisualizeAll(df_objs=buildingfootprint_22.buildings)  # -> geo; plug-in component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

# ----
# 3. IMPORT APPROPRIATE
#  CONSTRUCTION SET
# IMPORT
r7th_cset = Data("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")
strtoobj_49 = HBStringToObject(hb_str=r7th_cset)  # -> hb_obj; plug-in component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
panel_284 = Panel(strtoobj_49)

# ----
# 1. CONVERT GIS FOOTPRINT TO 3D DRAGONFLY BLDGS
# R7TH
falsestart_23 = LBFalseStartToggle(False)
buildingfootprint_23 = DFBuildingFromFootprint(
    footprint_geo=geo_13,
    floor_to_floor=noflrs_r2ab_11,
    name=bldgname_r2ab_11,
    program=programtype_24,
    constr_set=strtoobj_49,
    run=falsestart_23)  # -> out, simplify(buildings); plug-in component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
panel_285 = Panel(buildingfootprint_23.buildings)
vizall_23 = DFVisualizeAll(df_objs=buildingfootprint_23.buildings)  # -> geo; plug-in component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

# ----
# 3. IMPORT APPROPRIATE
#  CONSTRUCTION SET
# IMPORT
r4sf_cset = Data("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")
strtoobj_50 = HBStringToObject(hb_str=r4sf_cset)  # -> hb_obj; plug-in component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
panel_286 = Panel(strtoobj_50)

# ----
# 1. CONVERT GIS FOOTPRINT TO 3D DRAGONFLY BLDGS
# R4SF
falsestart_24 = LBFalseStartToggle(False)
buildingfootprint_24 = DFBuildingFromFootprint(
    footprint_geo=geo_14,
    floor_to_floor=noflrs_r2ab_12,
    name=bldgname_r2ab_12,
    program=programtype_10,
    constr_set=strtoobj_50,
    run=falsestart_24)  # -> out, simplify(buildings); plug-in component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
panel_287 = Panel(buildingfootprint_24.buildings)
vizall_24 = DFVisualizeAll(df_objs=buildingfootprint_24.buildings)  # -> geo; plug-in component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

# ----
# 3. IMPORT APPROPRIATE
#  CONSTRUCTION SET
# IMPORT
r2mf_cset = Data("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")
strtoobj_51 = HBStringToObject(hb_str=r2mf_cset)  # -> hb_obj; plug-in component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
panel_288 = Panel(strtoobj_51)

# ----
# 1. CONVERT GIS FOOTPRINT TO 3D DRAGONFLY BLDGS
# R2MF
falsestart_25 = LBFalseStartToggle(False)
buildingfootprint_25 = DFBuildingFromFootprint(
    footprint_geo=geo_3,
    floor_to_floor=noflrs_r2ab_2,
    name=bldgname_r2ab_2,
    program=programtype_15,
    constr_set=strtoobj_51,
    run=falsestart_25)  # -> out, simplify(buildings); plug-in component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
panel_289 = Panel(buildingfootprint_25.buildings)
vizall_25 = DFVisualizeAll(df_objs=buildingfootprint_25.buildings)  # -> geo; plug-in component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

# ----
# 3. IMPORT APPROPRIATE
#  CONSTRUCTION SET
# IMPORT
r2th_cset = Data("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")
strtoobj_52 = HBStringToObject(hb_str=r2th_cset)  # -> hb_obj; plug-in component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
panel_290 = Panel(strtoobj_52)

# ----
# 1. CONVERT GIS FOOTPRINT TO 3D DRAGONFLY BLDGS
# R2TH
falsestart_26 = LBFalseStartToggle(False)
buildingfootprint_26 = DFBuildingFromFootprint(
    footprint_geo=geo_8,
    floor_to_floor=noflrs_r2ab_6,
    name=bldgname_r2ab_6,
    program=programtype_19,
    constr_set=strtoobj_52,
    run=falsestart_26)  # -> out, simplify(buildings); plug-in component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
panel_291 = Panel(buildingfootprint_26.buildings)
vizall_26 = DFVisualizeAll(df_objs=buildingfootprint_26.buildings)  # -> geo; plug-in component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

# ----
# 5. IMPORT APPROPRIATE
#  CONSTRUCTION SET
# IMPORT
r8th_cset = Data("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")
strtoobj_53 = HBStringToObject(hb_str=r8th_cset)  # -> hb_obj; plug-in component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
panel_292 = Panel(strtoobj_53)

# ----
# 1. CONVERT GIS FOOTPRINT TO 3D DRAGONFLY BLDGS
# R8TH
falsestart_27 = LBFalseStartToggle(False)
buildingfootprint_27 = DFBuildingFromFootprint(
    footprint_geo=geo_29,
    floor_to_floor=noflrs_r2ab_27,
    name=bldgname_r2ab_27,
    program=programtype_28,
    constr_set=strtoobj_53,
    run=falsestart_27)  # -> out, simplify(buildings); plug-in component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
panel_293 = Panel(buildingfootprint_27.buildings)
vizall_27 = DFVisualizeAll(df_objs=buildingfootprint_27.buildings)  # -> geo; plug-in component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

# ----
# 3. IMPORT APPROPRIATE
#  CONSTRUCTION SET
# IMPORT
r8ab_cset = Data("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")
strtoobj_54 = HBStringToObject(hb_str=r8ab_cset)  # -> hb_obj; plug-in component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
panel_294 = Panel(strtoobj_54)

# ----
# 1. CONVERT GIS FOOTPRINT TO 3D DRAGONFLY BLDGS
# R8AB
falsestart_28 = LBFalseStartToggle(False)
buildingfootprint_28 = DFBuildingFromFootprint(
    footprint_geo=geo_25,
    floor_to_floor=noflrs_r2ab_22,
    name=bldgname_r2ab_22,
    program=programtype_21,
    constr_set=strtoobj_54,
    run=falsestart_28)  # -> out, simplify(buildings); plug-in component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
panel_295 = Panel(buildingfootprint_28.buildings)
vizall_28 = DFVisualizeAll(df_objs=buildingfootprint_28.buildings)  # -> geo; plug-in component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

# ----
# 3. IMPORT APPROPRIATE
#  CONSTRUCTION SET
# IMPORT
r7mf_cset = Data("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")
strtoobj_55 = HBStringToObject(hb_str=r7mf_cset)  # -> hb_obj; plug-in component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
panel_296 = Panel(strtoobj_55)

# ----
# 1. CONVERT GIS FOOTPRINT TO 3D DRAGONFLY BLDGS
# R7MF
falsestart_29 = LBFalseStartToggle(False)
buildingfootprint_29 = DFBuildingFromFootprint(
    footprint_geo=geo_19,
    floor_to_floor=noflrs_r2ab_17,
    name=bldgname_r2ab_17,
    program=programtype_23,
    constr_set=strtoobj_55,
    run=falsestart_29)  # -> out, simplify(buildings); plug-in component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
panel_297 = Panel(buildingfootprint_29.buildings)
vizall_29 = DFVisualizeAll(df_objs=buildingfootprint_29.buildings)  # -> geo; plug-in component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

# ----
# 3. IMPORT APPROPRIATE
# CONSTRUCTION SET
# IMPORT
r2sf_cset = Data("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")
strtoobj_56 = HBStringToObject(hb_str=r2sf_cset)  # -> hb_obj; plug-in component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
panel_298 = Panel(strtoobj_56)

# ----
# 1. CONVERT GIS FOOTPRINT TO 3D DRAGONFLY BLDGS
# R2SF
falsestart_30 = LBFalseStartToggle(False)  # disabled
buildingfootprint_30 = DFBuildingFromFootprint(
    footprint_geo=geo,
    floor_to_floor=noflrs_r2ab,
    name=bldgname_r2ab,
    program=programtype_22,
    constr_set=strtoobj_56,
    run=falsestart_30)  # -> out, simplify(buildings); disabled; plug-in component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
panel_299 = Panel(buildingfootprint_30.buildings)  # disabled
vizall_30 = DFVisualizeAll(df_objs=buildingfootprint_30.buildings)  # -> geo; disabled; plug-in component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

# ----
# 4. SET SCHEDULES & HVAC SYSTEM TO EACH ZONE
dfidealair = DFIdealAir(df_objs=buildingfootprint_6.buildings)  # -> report, simplify(df_objs); plug-in component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
panel_300 = Panel(dfidealair.df_objs)

# ----
# 4. SET SCHEDULES & HVAC SYSTEM TO EACH ZONE
dfidealair_2 = DFIdealAir(df_objs=buildingfootprint_8.buildings)  # -> report, simplify(df_objs); plug-in component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
panel_301 = Panel(dfidealair_2.df_objs)

# ----
# 4. SET SCHEDULES & HVAC SYSTEM TO EACH ZONE
dfidealair_3 = DFIdealAir(df_objs=buildingfootprint_11.buildings)  # -> report, simplify(df_objs); plug-in component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
panel_302 = Panel(dfidealair_3.df_objs)

# ----
# 4. SET SCHEDULES & HVAC SYSTEM TO EACH ZONE
dfidealair_4 = DFIdealAir(df_objs=buildingfootprint_4.buildings)  # -> report, simplify(df_objs); disabled; plug-in component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
panel_303 = Panel(dfidealair_4.df_objs)  # disabled

# ----
# 4. SET SCHEDULES & HVAC SYSTEM TO EACH ZONE
dfidealair_5 = DFIdealAir(df_objs=buildingfootprint_9.buildings)  # -> report, simplify(df_objs); plug-in component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
panel_304 = Panel(dfidealair_5.df_objs)

# ----
# 4. SET SCHEDULES & HVAC SYSTEM TO EACH ZONE
dfidealair_6 = DFIdealAir(df_objs=buildingfootprint_12.buildings)  # -> report, simplify(df_objs); plug-in component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
panel_305 = Panel(dfidealair_6.df_objs)

# ----
# 4. SET SCHEDULES & HVAC SYSTEM TO EACH ZONE
dfidealair_7 = DFIdealAir(df_objs=buildingfootprint_24.buildings)  # -> report, simplify(df_objs); plug-in component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
panel_306 = Panel(dfidealair_7.df_objs)

# ----
# 4. SET SCHEDULES & HVAC SYSTEM TO EACH ZONE
dfidealair_8 = DFIdealAir(df_objs=buildingfootprint_22.buildings)  # -> report, simplify(df_objs); plug-in component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
panel_307 = Panel(dfidealair_8.df_objs)

# ----
# 4. SET SCHEDULES & HVAC SYSTEM TO EACH ZONE
dfidealair_9 = DFIdealAir(df_objs=buildingfootprint_16.buildings)  # -> report, simplify(df_objs); plug-in component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
panel_308 = Panel(dfidealair_9.df_objs)

# ----
# 4. SET SCHEDULES & HVAC SYSTEM TO EACH ZONE
dfidealair_10 = DFIdealAir(df_objs=buildingfootprint_3.buildings)  # -> report, simplify(df_objs); disabled; plug-in component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
panel_309 = Panel(dfidealair_10.df_objs)  # disabled

# ----
# 4. SET SCHEDULES & HVAC SYSTEM TO EACH ZONE
dfidealair_11 = DFIdealAir(df_objs=buildingfootprint_10.buildings)  # -> report, simplify(df_objs); plug-in component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
panel_310 = Panel(dfidealair_11.df_objs)

# ----
# 4. SET SCHEDULES & HVAC SYSTEM TO EACH ZONE
dfidealair_12 = DFIdealAir(df_objs=buildingfootprint_7.buildings)  # -> report, simplify(df_objs); plug-in component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
panel_311 = Panel(dfidealair_12.df_objs)

# ----
# 4. SET SCHEDULES & HVAC SYSTEM TO EACH ZONE
dfidealair_13 = DFIdealAir(df_objs=buildingfootprint_14.buildings)  # -> report, simplify(df_objs); plug-in component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
panel_312 = Panel(dfidealair_13.df_objs)

# ----
# 4. SET SCHEDULES & HVAC SYSTEM TO EACH ZONE
dfidealair_14 = DFIdealAir(df_objs=buildingfootprint_17.buildings)  # -> report, simplify(df_objs); plug-in component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
panel_313 = Panel(dfidealair_14.df_objs)

# ----
# 4. SET SCHEDULES & HVAC SYSTEM TO EACH ZONE
dfidealair_15 = DFIdealAir(df_objs=buildingfootprint_23.buildings)  # -> report, simplify(df_objs); plug-in component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
panel_314 = Panel(dfidealair_15.df_objs)

# ----
# 4. SET SCHEDULES & HVAC SYSTEM TO EACH ZONE
dfidealair_16 = DFIdealAir(df_objs=buildingfootprint_5.buildings)  # -> report, simplify(df_objs); plug-in component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
panel_315 = Panel(dfidealair_16.df_objs)

# ----
# 4. SET SCHEDULES & HVAC SYSTEM TO EACH ZONE
dfidealair_17 = DFIdealAir(df_objs=buildingfootprint_15.buildings)  # -> report, simplify(df_objs); plug-in component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
panel_316 = Panel(dfidealair_17.df_objs)

# ----
# 4. SET SCHEDULES & HVAC SYSTEM TO EACH ZONE
dfidealair_18 = DFIdealAir(df_objs=buildingfootprint_20.buildings)  # -> report, simplify(df_objs); disabled; plug-in component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
panel_317 = Panel(dfidealair_18.df_objs)  # disabled

# ----
# 4. SET SCHEDULES & HVAC SYSTEM TO EACH ZONE
dfidealair_19 = DFIdealAir(df_objs=buildingfootprint_28.buildings)  # -> report, simplify(df_objs); plug-in component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
panel_318 = Panel(dfidealair_19.df_objs)

# ----
# 4. SET SCHEDULES & HVAC SYSTEM TO EACH ZONE
dfidealair_20 = DFIdealAir(df_objs=buildingfootprint_13.buildings)  # -> report, simplify(df_objs); plug-in component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
panel_319 = Panel(dfidealair_20.df_objs)

# ----
# 4. SET SCHEDULES & HVAC SYSTEM TO EACH ZONE
dfidealair_21 = DFIdealAir(df_objs=buildingfootprint_18.buildings)  # -> report, simplify(df_objs); disabled; plug-in component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
panel_320 = Panel(dfidealair_21.df_objs)  # disabled

# ----
# 4. SET SCHEDULES & HVAC SYSTEM TO EACH ZONE
dfidealair_22 = DFIdealAir(df_objs=buildingfootprint_26.buildings)  # -> report, simplify(df_objs); plug-in component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
panel_321 = Panel(dfidealair_22.df_objs)

# ----
# 4. SET SCHEDULES & HVAC SYSTEM TO EACH ZONE
dfidealair_23 = DFIdealAir(df_objs=buildingfootprint_21.buildings)  # -> report, simplify(df_objs); plug-in component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
panel_322 = Panel(dfidealair_23.df_objs)

# ----
# 4. SET SCHEDULES & HVAC SYSTEM TO EACH ZONE
dfidealair_24 = DFIdealAir(df_objs=buildingfootprint_19.buildings)  # -> report, simplify(df_objs); disabled; plug-in component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
panel_323 = Panel(dfidealair_24.df_objs)  # disabled

# ----
# 4. SET SCHEDULES & HVAC SYSTEM TO EACH ZONE
dfidealair_25 = DFIdealAir(df_objs=buildingfootprint_29.buildings)  # -> report, simplify(df_objs); plug-in component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
panel_324 = Panel(dfidealair_25.df_objs)

# ----
# 4. SET SCHEDULES & HVAC SYSTEM TO EACH ZONE
dfidealair_26 = DFIdealAir(df_objs=buildingfootprint_25.buildings)  # -> report, simplify(df_objs); plug-in component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
panel_325 = Panel(dfidealair_26.df_objs)

# ----
# 4. SET SCHEDULES & HVAC SYSTEM TO EACH ZONE
dfidealair_27 = DFIdealAir(df_objs=buildingfootprint_27.buildings)  # -> report, simplify(df_objs); plug-in component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
panel_326 = Panel(dfidealair_27.df_objs)

# ----
# 4. SET SCHEDULES & HVAC SYSTEM TO EACH ZONE
dfidealair_28 = DFIdealAir(df_objs=buildingfootprint_30.buildings)  # -> report, simplify(df_objs); disabled; plug-in component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
panel_327 = Panel(dfidealair_28.df_objs)  # disabled

# ----
# 5. SOLVE BUILDING TOP & BOTTOM
topbottom = DFSeparateTopBottom(buildings=dfidealair.df_objs)  # -> simplify(buildings); plug-in component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
panel_328 = Panel(topbottom)

# ----
# 5. SOLVE BUILDING TOP & BOTTOM
topbottom_2 = DFSeparateTopBottom(buildings=dfidealair_2.df_objs)  # -> simplify(buildings); plug-in component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
panel_329 = Panel(topbottom_2)

# ----
# 5. SOLVE BUILDING TOP & BOTTOM
topbottom_3 = DFSeparateTopBottom(buildings=dfidealair_3.df_objs)  # -> simplify(buildings); plug-in component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
panel_330 = Panel(topbottom_3)

# ----
# 5. SOLVE BUILDING TOP & BOTTOM
topbottom_4 = DFSeparateTopBottom(buildings=dfidealair_4.df_objs)  # -> simplify(buildings); disabled; plug-in component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
panel_331 = Panel(topbottom_4)  # disabled

# ----
# 5. SOLVE BUILDING TOP & BOTTOM
topbottom_5 = DFSeparateTopBottom(buildings=dfidealair_5.df_objs)  # -> simplify(buildings); plug-in component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
panel_332 = Panel(topbottom_5)

# ----
# 5. SOLVE BUILDING TOP & BOTTOM
topbottom_6 = DFSeparateTopBottom(buildings=dfidealair_6.df_objs)  # -> simplify(buildings); plug-in component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
panel_333 = Panel(topbottom_6)

# ----
# 5. SOLVE BUILDING TOP & BOTTOM
topbottom_7 = DFSeparateTopBottom(buildings=dfidealair_7.df_objs)  # -> simplify(buildings); plug-in component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
panel_334 = Panel(topbottom_7)

# ----
# 5. SOLVE BUILDING TOP & BOTTOM
topbottom_8 = DFSeparateTopBottom(buildings=dfidealair_8.df_objs)  # -> simplify(buildings); plug-in component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
panel_335 = Panel(topbottom_8)

# ----
# 5. SOLVE BUILDING TOP & BOTTOM
topbottom_9 = DFSeparateTopBottom(buildings=dfidealair_9.df_objs)  # -> simplify(buildings); plug-in component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
panel_336 = Panel(topbottom_9)

# ----
# 5. SOLVE BUILDING TOP & BOTTOM
topbottom_10 = DFSeparateTopBottom(buildings=dfidealair_10.df_objs)  # -> simplify(buildings); disabled; plug-in component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
panel_337 = Panel(topbottom_10)  # disabled

# ----
# 5. SOLVE BUILDING TOP & BOTTOM
topbottom_11 = DFSeparateTopBottom(buildings=dfidealair_11.df_objs)  # -> simplify(buildings); plug-in component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
panel_338 = Panel(topbottom_11)

# ----
# 5. SOLVE BUILDING TOP & BOTTOM
topbottom_12 = DFSeparateTopBottom(buildings=dfidealair_12.df_objs)  # -> simplify(buildings); plug-in component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
panel_339 = Panel(topbottom_12)

# ----
# 5. SOLVE BUILDING TOP & BOTTOM
topbottom_13 = DFSeparateTopBottom(buildings=dfidealair_13.df_objs)  # -> simplify(buildings); plug-in component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
panel_340 = Panel(topbottom_13)

# ----
# 5. SOLVE BUILDING TOP & BOTTOM
topbottom_14 = DFSeparateTopBottom(buildings=dfidealair_14.df_objs)  # -> simplify(buildings); plug-in component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
panel_341 = Panel(topbottom_14)

# ----
# 5. SOLVE BUILDING TOP & BOTTOM
topbottom_15 = DFSeparateTopBottom(buildings=dfidealair_15.df_objs)  # -> simplify(buildings); plug-in component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
panel_342 = Panel(topbottom_15)

# ----
# 5. SOLVE BUILDING TOP & BOTTOM
topbottom_16 = DFSeparateTopBottom(buildings=dfidealair_16.df_objs)  # -> simplify(buildings); plug-in component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
panel_343 = Panel(topbottom_16)

# ----
# 5. SOLVE BUILDING TOP & BOTTOM
topbottom_17 = DFSeparateTopBottom(buildings=dfidealair_17.df_objs)  # -> simplify(buildings); plug-in component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
panel_344 = Panel(topbottom_17)

# ----
# 5. SOLVE BUILDING TOP & BOTTOM
topbottom_18 = DFSeparateTopBottom(buildings=dfidealair_18.df_objs)  # -> simplify(buildings); disabled; plug-in component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
panel_345 = Panel(topbottom_18)  # disabled

# ----
# 5. SOLVE BUILDING TOP & BOTTOM
topbottom_19 = DFSeparateTopBottom(buildings=dfidealair_19.df_objs)  # -> simplify(buildings); plug-in component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
panel_346 = Panel(topbottom_19)

# ----
# 5. SOLVE BUILDING TOP & BOTTOM
topbottom_20 = DFSeparateTopBottom(buildings=dfidealair_20.df_objs)  # -> simplify(buildings); plug-in component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
panel_347 = Panel(topbottom_20)

# ----
# 5. SOLVE BUILDING TOP & BOTTOM
topbottom_21 = DFSeparateTopBottom(buildings=dfidealair_21.df_objs)  # -> simplify(buildings); disabled; plug-in component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
panel_348 = Panel(topbottom_21)  # disabled

# ----
# 5. SOLVE BUILDING TOP & BOTTOM
topbottom_22 = DFSeparateTopBottom(buildings=dfidealair_22.df_objs)  # -> simplify(buildings); plug-in component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
panel_349 = Panel(topbottom_22)

# ----
# 5. SOLVE BUILDING TOP & BOTTOM
topbottom_23 = DFSeparateTopBottom(buildings=dfidealair_23.df_objs)  # -> simplify(buildings); plug-in component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
panel_350 = Panel(topbottom_23)

# ----
# 5. SOLVE BUILDING TOP & BOTTOM
topbottom_24 = DFSeparateTopBottom(buildings=dfidealair_24.df_objs)  # -> simplify(buildings); disabled; plug-in component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
panel_351 = Panel(topbottom_24)  # disabled

# ----
# 5. SOLVE BUILDING TOP & BOTTOM
topbottom_25 = DFSeparateTopBottom(buildings=dfidealair_25.df_objs)  # -> simplify(buildings); plug-in component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
panel_352 = Panel(topbottom_25)

# ----
# 5. SOLVE BUILDING TOP & BOTTOM
topbottom_26 = DFSeparateTopBottom(buildings=dfidealair_26.df_objs)  # -> simplify(buildings); plug-in component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
panel_353 = Panel(topbottom_26)

# ----
# 5. SOLVE BUILDING TOP & BOTTOM
topbottom_27 = DFSeparateTopBottom(buildings=dfidealair_27.df_objs)  # -> simplify(buildings); plug-in component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
panel_354 = Panel(topbottom_27)

# ----
# 5. SOLVE BUILDING TOP & BOTTOM
topbottom_28 = DFSeparateTopBottom(buildings=dfidealair_28.df_objs)  # -> simplify(buildings); disabled; plug-in component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
panel_355 = Panel(topbottom_28)  # disabled

# ----
# TABULA Archetype
# WWR Value
# Connect if running default simulation
panel_356 = Panel("0.102")
facparam = HBFacadeParameters(north=panel_356, east=panel_356, south=panel_356, west=panel_356)  # -> fac_par; plug-in component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

# ----
# TABULA Archetype
# WWR Value
# Connect if running default simulation
panel_357 = Panel("0.149")
facparam_2 = HBFacadeParameters(north=panel_357, east=panel_357, south=panel_357, west=panel_357)  # -> fac_par; plug-in component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

# ----
# TABULA Archetype
# WWR Value
# Connect if running default simulation
panel_358 = Panel("0.174")
facparam_3 = HBFacadeParameters(north=panel_358, east=panel_358, south=panel_358, west=panel_358)  # -> fac_par; plug-in component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

# ----
# TABULA Archetype
# WWR Value
# Connect if running default simulation
panel_359 = Panel("0.108")
facparam_4 = HBFacadeParameters(north=panel_359, east=panel_359, south=panel_359, west=panel_359)  # -> fac_par; plug-in component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

# ----
# TABULA Archetype
# WWR Value
# Connect if running default simulation
panel_360 = Panel("0.104")
facparam_5 = HBFacadeParameters(north=panel_360, east=panel_360, south=panel_360, west=panel_360)  # -> fac_par; plug-in component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

# ----
# TABULA Archetype
# WWR Value
# Connect if running default simulation
panel_361 = Panel("0.092")  # disabled
facparam_6 = HBFacadeParameters(north=panel_361, east=panel_361, south=panel_361, west=panel_361)  # -> fac_par; disabled; plug-in component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

# ----
# TABULA Archetype
# WWR Value
# Connect if running default simulation
panel_362 = Panel("0.117")
facparam_7 = HBFacadeParameters(north=panel_362, east=panel_362, south=panel_362, west=panel_362)  # -> fac_par; plug-in component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

# ----
# TABULA Archetype
# WWR Value
# Connect if running default simulation
panel_363 = Panel("0.141")
facparam_8 = HBFacadeParameters(north=panel_363, east=panel_363, south=panel_363, west=panel_363)  # -> fac_par; plug-in component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

# ----
# TABULA Archetype
# WWR Value
# Connect if running default simulation
panel_364 = Panel("0.075")  # disabled
facparam_9 = HBFacadeParameters(north=panel_364, east=panel_364, south=panel_364, west=panel_364)  # -> fac_par; disabled; plug-in component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

# ----
# TABULA Archetype
# WWR Value
# Connect if running default simulation
panel_365 = Panel("0.080")
facparam_10 = HBFacadeParameters(north=panel_365, east=panel_365, south=panel_365, west=panel_365)  # -> fac_par; plug-in component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

# ----
# TABULA Archetype
# WWR Value
# Connect if running default simulation
panel_366 = Panel("0.124")
facparam_11 = HBFacadeParameters(north=panel_366, east=panel_366, south=panel_366, west=panel_366)  # -> fac_par; plug-in component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

# ----
# TABULA Archetype
# WWR Value
# Connect if running default simulation
panel_367 = Panel("0.075")
facparam_12 = HBFacadeParameters(north=panel_367, east=panel_367, south=panel_367, west=panel_367)  # -> fac_par; plug-in component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

# ----
# TABULA Archetype
# WWR Value
# Connect if running default simulation
panel_368 = Panel("0.089")
facparam_13 = HBFacadeParameters(north=panel_368, east=panel_368, south=panel_368, west=panel_368)  # -> fac_par; plug-in component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

# ----
# TABULA Archetype
# WWR Value
# Connect if running default simulation
panel_369 = Panel("0.161")
facparam_14 = HBFacadeParameters(north=panel_369, east=panel_369, south=panel_369, west=panel_369)  # -> fac_par; plug-in component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

# ----
# TABULA Archetype
# WWR Value
# Connect if running default simulation
panel_370 = Panel("0.094")
facparam_15 = HBFacadeParameters(north=panel_370, east=panel_370, south=panel_370, west=panel_370)  # -> fac_par; plug-in component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

# ----
# TABULA Archetype
# WWR Value
# Connect if running default simulation
panel_371 = Panel("0.164")
facparam_16 = HBFacadeParameters(north=panel_371, east=panel_371, south=panel_371, west=panel_371)  # -> fac_par; plug-in component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

# ----
# TABULA Archetype
# WWR Value
# Connect if running default simulation
panel_372 = Panel("0.087")  # disabled
facparam_17 = HBFacadeParameters(north=panel_372, east=panel_372, south=panel_372, west=panel_372)  # -> fac_par; disabled; plug-in component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

# ----
# TABULA Archetype
# WWR Value
# Connect if running default simulation
panel_373 = Panel("0.165")
facparam_18 = HBFacadeParameters(north=panel_373, east=panel_373, south=panel_373, west=panel_373)  # -> fac_par; plug-in component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

# ----
# TABULA Archetype
# WWR Value
# Connect if running default simulation
panel_374 = Panel("0.105")  # disabled
facparam_19 = HBFacadeParameters(north=panel_374, east=panel_374, south=panel_374, west=panel_374)  # -> fac_par; disabled; plug-in component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

# ----
# TABULA Archetype
# WWR Value
# Connect if running default simulation
panel_375 = Panel("0.107")
facparam_20 = HBFacadeParameters(north=panel_375, east=panel_375, south=panel_375, west=panel_375)  # -> fac_par; plug-in component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

# ----
# TABULA Archetype
# WWR Value
# Connect if running default simulation
panel_376 = Panel("0.147")
facparam_21 = HBFacadeParameters(north=panel_376, east=panel_376, south=panel_376, west=panel_376)  # -> fac_par; plug-in component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

# ----
# TABULA Archetype
# WWR Value
# Connect if running default simulation
panel_377 = Panel("0.088")  # disabled
facparam_22 = HBFacadeParameters(north=panel_377, east=panel_377, south=panel_377, west=panel_377)  # -> fac_par; disabled; plug-in component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

# ----
# TABULA Archetype
# WWR Value
# Connect if running default simulation
panel_378 = Panel("0.063")
facparam_23 = HBFacadeParameters(north=panel_378, east=panel_378, south=panel_378, west=panel_378)  # -> fac_par; plug-in component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

# ----
# TABULA Archetype
# WWR Value
# Connect if running default simulation
panel_379 = Panel("0.127")
facparam_24 = HBFacadeParameters(north=panel_379, east=panel_379, south=panel_379, west=panel_379)  # -> fac_par; plug-in component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

# ----
# TABULA Archetype
# WWR Value
# Connect if running default simulation
panel_380 = Panel("0.086")
facparam_25 = HBFacadeParameters(north=panel_380, east=panel_380, south=panel_380, west=panel_380)  # -> fac_par; plug-in component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

# ----
# TABULA Archetype
# WWR Value
# Connect if running default simulation
panel_381 = Panel("0.089")
facparam_26 = HBFacadeParameters(north=panel_381, east=panel_381, south=panel_381, west=panel_381)  # -> fac_par; plug-in component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

# ----
# TABULA Archetype
# WWR Value
# Connect if running default simulation
panel_382 = Panel("0.095")
facparam_27 = HBFacadeParameters(north=panel_382, east=panel_382, south=panel_382, west=panel_382)  # -> fac_par; plug-in component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

# ----
# TABULA Archetype
# WWR Value
# Connect if running default simulation
panel_383 = Panel("0.063")  # disabled
facparam_28 = HBFacadeParameters(north=panel_383, east=panel_383, south=panel_383, west=panel_383)  # -> fac_par; disabled; plug-in component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

# ----
# 6. SET GLAZING
facparam_29 = HBFacadeParameters(north=bldg_name_66, east=bldg_name_64, south=bldg_name_63, west=bldg_name_65)  # -> simplify(fac_par); plug-in component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
simpleratiopar = DFSimpleWindowRatioParameters(ratio=facparam_29)  # -> win_par; plug-in component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
applyfacadepar = DFApplyFacadeParameters(df_obj=topbottom, win_par=simpleratiopar)  # -> report, simplify(df_obj); plug-in component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
ventcontrol = HBVentilationControl(min_in_temp="21", max_in_temp="25", min_out_temp="18", max_out_temp="30")  # -> vent_cntrl; plug-in component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
dfwindowopen = DFWindowOpening(df_objs=applyfacadepar.df_obj, vent_cntrl=ventcontrol, fract_area_oper="0.8")  # -> report, simplify(df_objs); plug-in component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
panel_384 = Panel(dfwindowopen.df_objs)

# ----
# 6. SET GLAZING
facparam_30 = HBFacadeParameters(north=bldg_name_102, east=bldg_name_100, south=bldg_name_99, west=bldg_name_101)  # -> simplify(fac_par); plug-in component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
simpleratiopar_2 = DFSimpleWindowRatioParameters(ratio=facparam_30)  # -> win_par; plug-in component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
applyfacadepar_2 = DFApplyFacadeParameters(df_obj=topbottom_6, win_par=simpleratiopar_2)  # -> report, simplify(df_obj); plug-in component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
ventcontrol_2 = HBVentilationControl(min_in_temp="21", max_in_temp="25", min_out_temp="18", max_out_temp="30")  # -> vent_cntrl; plug-in component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
dfwindowopen_2 = DFWindowOpening(df_objs=applyfacadepar_2.df_obj, vent_cntrl=ventcontrol_2, fract_area_oper="0.8")  # -> report, simplify(df_objs); plug-in component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
panel_385 = Panel(dfwindowopen_2.df_objs)

# ----
# 6. SET GLAZING
facparam_31 = HBFacadeParameters(north=bldg_name_110, east=bldg_name_108, south=bldg_name_107, west=bldg_name_109)  # -> simplify(fac_par); plug-in component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
simpleratiopar_3 = DFSimpleWindowRatioParameters(ratio=facparam_31)  # -> win_par; plug-in component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
applyfacadepar_3 = DFApplyFacadeParameters(df_obj=topbottom_5, win_par=simpleratiopar_3)  # -> report, simplify(df_obj); plug-in component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
ventcontrol_3 = HBVentilationControl(min_in_temp="21", max_in_temp="25", min_out_temp="18", max_out_temp="30")  # -> vent_cntrl; plug-in component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
dfwindowopen_3 = DFWindowOpening(df_objs=applyfacadepar_3.df_obj, vent_cntrl=ventcontrol_3, fract_area_oper="0.8")  # -> report, simplify(df_objs); plug-in component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
panel_386 = Panel(dfwindowopen_3.df_objs)

# ----
# 6. SET GLAZING
facparam_32 = HBFacadeParameters(north=bldg_name_70, east=bldg_name_68, south=bldg_name_67, west=bldg_name_69)  # -> simplify(fac_par); plug-in component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
simpleratiopar_4 = DFSimpleWindowRatioParameters(ratio=facparam_32)  # -> win_par; plug-in component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
applyfacadepar_4 = DFApplyFacadeParameters(df_obj=topbottom_3, win_par=simpleratiopar_4)  # -> report, simplify(df_obj); plug-in component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
ventcontrol_4 = HBVentilationControl(min_in_temp="21", max_in_temp="25", min_out_temp="18", max_out_temp="30")  # -> vent_cntrl; plug-in component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
dfwindowopen_4 = DFWindowOpening(df_objs=applyfacadepar_4.df_obj, vent_cntrl=ventcontrol_4, fract_area_oper="0.8")  # -> report, simplify(df_objs); plug-in component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
panel_387 = Panel(dfwindowopen_4.df_objs)

# ----
# 6. SET GLAZING
facparam_33 = HBFacadeParameters(north=bldg_name_74, east=bldg_name_72, south=bldg_name_71, west=bldg_name_73)  # -> simplify(fac_par); plug-in component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
simpleratiopar_5 = DFSimpleWindowRatioParameters(ratio=facparam_33)  # -> win_par; plug-in component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
applyfacadepar_5 = DFApplyFacadeParameters(df_obj=topbottom_2, win_par=simpleratiopar_5)  # -> report, simplify(df_obj); plug-in component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
ventcontrol_5 = HBVentilationControl(min_in_temp="21", max_in_temp="25", min_out_temp="18", max_out_temp="30")  # -> vent_cntrl; plug-in component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
dfwindowopen_5 = DFWindowOpening(df_objs=applyfacadepar_5.df_obj, vent_cntrl=ventcontrol_5, fract_area_oper="0.8")  # -> report, simplify(df_objs); plug-in component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
panel_388 = Panel(dfwindowopen_5.df_objs)

# ----
# 6. SET GLAZING
facparam_34 = HBFacadeParameters(north=bldg_name_126, east=bldg_name_124, south=bldg_name_123, west=bldg_name_125)  # -> simplify(fac_par); disabled; plug-in component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
simpleratiopar_6 = DFSimpleWindowRatioParameters(ratio=facparam_34)  # -> win_par; disabled; plug-in component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
panel_389 = Panel("30")  # disabled
panel_390 = Panel("21")  # disabled
panel_391 = Panel("25")  # disabled
panel_392 = Panel("18")  # disabled
applyfacadepar_6 = DFApplyFacadeParameters(df_obj=topbottom_4, win_par=simpleratiopar_6)  # -> report, simplify(df_obj); disabled; plug-in component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
ventcontrol_6 = HBVentilationControl(min_in_temp=panel_390, max_in_temp=panel_391, min_out_temp=panel_392, max_out_temp=panel_389)  # -> vent_cntrl; disabled; plug-in component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
panel_393 = Panel("0.8")  # disabled
dfwindowopen_6 = DFWindowOpening(df_objs=applyfacadepar_6.df_obj, vent_cntrl=ventcontrol_6, fract_area_oper=panel_393)  # -> report, simplify(df_objs); disabled; plug-in component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
panel_394 = Panel(dfwindowopen_6.df_objs)  # disabled

# ----
# 6. SET GLAZING
facparam_35 = HBFacadeParameters(north=bldg_name_54, east=bldg_name_52, south=bldg_name_51, west=bldg_name_53)  # -> simplify(fac_par); plug-in component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
simpleratiopar_7 = DFSimpleWindowRatioParameters(ratio=facparam_35)  # -> win_par; plug-in component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
applyfacadepar_7 = DFApplyFacadeParameters(df_obj=topbottom_7, win_par=simpleratiopar_7)  # -> report, simplify(df_obj); plug-in component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
ventcontrol_7 = HBVentilationControl(min_in_temp="21", max_in_temp="25", min_out_temp="18", max_out_temp="30")  # -> vent_cntrl; plug-in component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
dfwindowopen_7 = DFWindowOpening(df_objs=applyfacadepar_7.df_obj, vent_cntrl=ventcontrol_7, fract_area_oper="0.8")  # -> report, simplify(df_objs); plug-in component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
panel_395 = Panel(dfwindowopen_7.df_objs)

facparam_36 = HBFacadeParameters(north=bldg_name_134, east=bldg_name_132, south=bldg_name_131, west=bldg_name_133)  # -> simplify(fac_par); disabled; plug-in component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

# ----
# 6. SET GLAZING
facparam_37 = HBFacadeParameters(north=bldg_name_114, east=bldg_name_112, south=bldg_name_111, west=bldg_name_113)  # -> simplify(fac_par); plug-in component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
simpleratiopar_8 = DFSimpleWindowRatioParameters(ratio=facparam_37)  # -> win_par; plug-in component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
applyfacadepar_8 = DFApplyFacadeParameters(df_obj=topbottom_13, win_par=simpleratiopar_8)  # -> report, simplify(df_obj); plug-in component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
ventcontrol_8 = HBVentilationControl(min_in_temp="21", max_in_temp="25", min_out_temp="18", max_out_temp="30")  # -> vent_cntrl; plug-in component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
dfwindowopen_8 = DFWindowOpening(df_objs=applyfacadepar_8.df_obj, vent_cntrl=ventcontrol_8, fract_area_oper="0.8")  # -> report, simplify(df_objs); plug-in component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
panel_396 = Panel(dfwindowopen_8.df_objs)

# ----
# 6. SET GLAZING
facparam_38 = HBFacadeParameters(north=bldg_name_46, east=bldg_name_44, south=bldg_name_43, west=bldg_name_45)  # -> simplify(fac_par); plug-in component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
simpleratiopar_9 = DFSimpleWindowRatioParameters(ratio=facparam_38)  # -> win_par; plug-in component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
applyfacadepar_9 = DFApplyFacadeParameters(df_obj=topbottom_14, win_par=simpleratiopar_9)  # -> report, simplify(df_obj); plug-in component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
ventcontrol_9 = HBVentilationControl(min_in_temp="21", max_in_temp="25", min_out_temp="18", max_out_temp="30")  # -> vent_cntrl; plug-in component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
dfwindowopen_9 = DFWindowOpening(df_objs=applyfacadepar_9.df_obj, vent_cntrl=ventcontrol_9, fract_area_oper="0.8")  # -> report, simplify(df_objs); plug-in component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
panel_397 = Panel(dfwindowopen_9.df_objs)

# ----
# 6. SET GLAZING
facparam_39 = HBFacadeParameters(north=bldg_name_34, east=bldg_name_32, south=bldg_name_31, west=bldg_name_33)  # -> simplify(fac_par); plug-in component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
simpleratiopar_10 = DFSimpleWindowRatioParameters(ratio=facparam_39)  # -> win_par; plug-in component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
applyfacadepar_10 = DFApplyFacadeParameters(df_obj=topbottom_17, win_par=simpleratiopar_10)  # -> report, simplify(df_obj); plug-in component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
ventcontrol_10 = HBVentilationControl(min_in_temp="21", max_in_temp="25", min_out_temp="18", max_out_temp="30")  # -> vent_cntrl; plug-in component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
dfwindowopen_10 = DFWindowOpening(df_objs=applyfacadepar_10.df_obj, vent_cntrl=ventcontrol_10, fract_area_oper="0.8")  # -> report, simplify(df_objs); plug-in component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
panel_398 = Panel(dfwindowopen_10.df_objs)

# ----
# 6. SET GLAZING
facparam_40 = HBFacadeParameters(north=bldg_name_106, east=bldg_name_104, south=bldg_name_103, west=bldg_name_105)  # -> simplify(fac_par); plug-in component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
simpleratiopar_11 = DFSimpleWindowRatioParameters(ratio=facparam_40)  # -> win_par; plug-in component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
applyfacadepar_11 = DFApplyFacadeParameters(df_obj=topbottom_11, win_par=simpleratiopar_11)  # -> report, simplify(df_obj); plug-in component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
ventcontrol_11 = HBVentilationControl(min_in_temp="21", max_in_temp="25", min_out_temp="18", max_out_temp="30")  # -> vent_cntrl; plug-in component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
dfwindowopen_11 = DFWindowOpening(df_objs=applyfacadepar_11.df_obj, vent_cntrl=ventcontrol_11, fract_area_oper="0.8")  # -> report, simplify(df_objs); plug-in component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
panel_399 = Panel(dfwindowopen_11.df_objs)

# ----
# 6. SET GLAZING
facparam_41 = HBFacadeParameters(north=bldg_name_82, east=bldg_name_80, south=bldg_name_79, west=bldg_name_81)  # -> simplify(fac_par); plug-in component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
simpleratiopar_12 = DFSimpleWindowRatioParameters(ratio=facparam_41)  # -> win_par; plug-in component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
applyfacadepar_12 = DFApplyFacadeParameters(df_obj=topbottom_12, win_par=simpleratiopar_12)  # -> report, simplify(df_obj); plug-in component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
ventcontrol_12 = HBVentilationControl(min_in_temp="21", max_in_temp="25", min_out_temp="18", max_out_temp="30")  # -> vent_cntrl; plug-in component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
dfwindowopen_12 = DFWindowOpening(df_objs=applyfacadepar_12.df_obj, vent_cntrl=ventcontrol_12, fract_area_oper="0.8")  # -> report, simplify(df_objs); plug-in component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
panel_400 = Panel(dfwindowopen_12.df_objs)

panel_401 = Panel(facparam_30)

# ----
# 6. SET GLAZING
facparam_42 = HBFacadeParameters(north=bldg_name_78, east=bldg_name_76, south=bldg_name_75, west=bldg_name_77)  # -> simplify(fac_par); plug-in component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
simpleratiopar_13 = DFSimpleWindowRatioParameters(ratio=facparam_42)  # -> win_par; plug-in component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
applyfacadepar_13 = DFApplyFacadeParameters(df_obj=topbottom_16, win_par=simpleratiopar_13)  # -> report, simplify(df_obj); plug-in component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
ventcontrol_13 = HBVentilationControl(min_in_temp="21", max_in_temp="25", min_out_temp="18", max_out_temp="30")  # -> vent_cntrl; plug-in component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
dfwindowopen_13 = DFWindowOpening(df_objs=applyfacadepar_13.df_obj, vent_cntrl=ventcontrol_13, fract_area_oper="0.8")  # -> report, simplify(df_objs); plug-in component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
panel_402 = Panel(dfwindowopen_13.df_objs)

# ----
# 6. SET GLAZING
facparam_43 = HBFacadeParameters(north=bldg_name_98, east=bldg_name_96, south=bldg_name_95, west=bldg_name_97)  # -> simplify(fac_par); plug-in component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
simpleratiopar_14 = DFSimpleWindowRatioParameters(ratio=facparam_43)  # -> win_par; plug-in component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
applyfacadepar_14 = DFApplyFacadeParameters(df_obj=topbottom_15, win_par=simpleratiopar_14)  # -> report, simplify(df_obj); plug-in component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
ventcontrol_14 = HBVentilationControl(min_in_temp="21", max_in_temp="25", min_out_temp="18", max_out_temp="30")  # -> vent_cntrl; plug-in component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
dfwindowopen_14 = DFWindowOpening(df_objs=applyfacadepar_14.df_obj, vent_cntrl=ventcontrol_14, fract_area_oper="0.8")  # -> report, simplify(df_objs); plug-in component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
panel_403 = Panel(dfwindowopen_14.df_objs)

panel_404 = Panel(facparam_29)

# ----
# 6. SET GLAZING
facparam_44 = HBFacadeParameters(north=bldg_name_90, east=bldg_name_88, south=bldg_name_87, west=bldg_name_89)  # -> simplify(fac_par); plug-in component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
simpleratiopar_15 = DFSimpleWindowRatioParameters(ratio=facparam_44)  # -> win_par; plug-in component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
applyfacadepar_15 = DFApplyFacadeParameters(df_obj=topbottom_22, win_par=simpleratiopar_15)  # -> report, simplify(df_obj); plug-in component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
ventcontrol_15 = HBVentilationControl(min_in_temp="21", max_in_temp="25", min_out_temp="18", max_out_temp="30")  # -> vent_cntrl; plug-in component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
dfwindowopen_15 = DFWindowOpening(df_objs=applyfacadepar_15.df_obj, vent_cntrl=ventcontrol_15, fract_area_oper="0.8")  # -> report, simplify(df_objs); plug-in component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
panel_405 = Panel(dfwindowopen_15.df_objs)

panel_406 = Panel(facparam_35)

# ----
# 6. SET GLAZING
facparam_45 = HBFacadeParameters(north=bldg_name_130, east=bldg_name_128, south=bldg_name_127, west=bldg_name_129)  # -> simplify(fac_par); disabled; plug-in component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
simpleratiopar_16 = DFSimpleWindowRatioParameters(ratio=facparam_45)  # -> win_par; disabled; plug-in component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
panel_407 = Panel("30")  # disabled
panel_408 = Panel("21")  # disabled
panel_409 = Panel("25")  # disabled
panel_410 = Panel("18")  # disabled
applyfacadepar_16 = DFApplyFacadeParameters(df_obj=topbottom_21, win_par=simpleratiopar_16)  # -> report, simplify(df_obj); disabled; plug-in component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
ventcontrol_16 = HBVentilationControl(min_in_temp=panel_408, max_in_temp=panel_409, min_out_temp=panel_410, max_out_temp=panel_407)  # -> vent_cntrl; disabled; plug-in component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
panel_411 = Panel("0.8")  # disabled
dfwindowopen_16 = DFWindowOpening(df_objs=applyfacadepar_16.df_obj, vent_cntrl=ventcontrol_16, fract_area_oper=panel_411)  # -> report, simplify(df_objs); disabled; plug-in component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
panel_412 = Panel(dfwindowopen_16.df_objs)  # disabled

panel_413 = Panel(facparam_31)

# ----
# 6. SET GLAZING
facparam_46 = HBFacadeParameters(north=bldg_name_86, east=bldg_name_84, south=bldg_name_83, west=bldg_name_85)  # -> simplify(fac_par); plug-in component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
simpleratiopar_17 = DFSimpleWindowRatioParameters(ratio=facparam_46)  # -> win_par; plug-in component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
applyfacadepar_17 = DFApplyFacadeParameters(df_obj=topbottom_19, win_par=simpleratiopar_17)  # -> report, simplify(df_obj); plug-in component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
ventcontrol_17 = HBVentilationControl(min_in_temp="21", max_in_temp="25", min_out_temp="18", max_out_temp="30")  # -> vent_cntrl; plug-in component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
dfwindowopen_17 = DFWindowOpening(df_objs=applyfacadepar_17.df_obj, vent_cntrl=ventcontrol_17, fract_area_oper="0.8")  # -> report, simplify(df_objs); plug-in component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
panel_414 = Panel(dfwindowopen_17.df_objs)

panel_415 = Panel(facparam_33)
panel_416 = Panel(facparam_36)  # disabled

# ----
# 6. SET GLAZING
simpleratiopar_18 = DFSimpleWindowRatioParameters(ratio=facparam_36)  # -> win_par; disabled; plug-in component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
panel_417 = Panel("30")  # disabled
panel_418 = Panel("21")  # disabled
panel_419 = Panel("25")  # disabled
panel_420 = Panel("18")  # disabled
applyfacadepar_18 = DFApplyFacadeParameters(df_obj=topbottom_10, win_par=simpleratiopar_18)  # -> report, simplify(df_obj); disabled; plug-in component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
ventcontrol_18 = HBVentilationControl(min_in_temp=panel_418, max_in_temp=panel_419, min_out_temp=panel_420, max_out_temp=panel_417)  # -> vent_cntrl; disabled; plug-in component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
panel_421 = Panel("0.8")  # disabled
dfwindowopen_18 = DFWindowOpening(df_objs=applyfacadepar_18.df_obj, vent_cntrl=ventcontrol_18, fract_area_oper=panel_421)  # -> report, simplify(df_objs); disabled; plug-in component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
panel_422 = Panel(dfwindowopen_18.df_objs)  # disabled

# ----
# 6. SET GLAZING
facparam_47 = HBFacadeParameters(north=bldg_name_122, east=bldg_name_120, south=bldg_name_119, west=bldg_name_121)  # -> simplify(fac_par); disabled; plug-in component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
simpleratiopar_19 = DFSimpleWindowRatioParameters(ratio=facparam_47)  # -> win_par; disabled; plug-in component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
panel_423 = Panel("30")  # disabled
panel_424 = Panel("21")  # disabled
panel_425 = Panel("25")  # disabled
panel_426 = Panel("18")  # disabled
applyfacadepar_19 = DFApplyFacadeParameters(df_obj=topbottom_18, win_par=simpleratiopar_19)  # -> report, simplify(df_obj); disabled; plug-in component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
ventcontrol_19 = HBVentilationControl(min_in_temp=panel_424, max_in_temp=panel_425, min_out_temp=panel_426, max_out_temp=panel_423)  # -> vent_cntrl; disabled; plug-in component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
panel_427 = Panel("0.8")  # disabled
dfwindowopen_19 = DFWindowOpening(df_objs=applyfacadepar_19.df_obj, vent_cntrl=ventcontrol_19, fract_area_oper=panel_427)  # -> report, simplify(df_objs); disabled; plug-in component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
panel_428 = Panel(dfwindowopen_19.df_objs)  # disabled

panel_429 = Panel(facparam_38)

# ----
# 6. SET GLAZING
facparam_48 = HBFacadeParameters(north=bldg_name_58, east=bldg_name_56, south=bldg_name_55, west=bldg_name_57)  # -> simplify(fac_par); plug-in component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
simpleratiopar_20 = DFSimpleWindowRatioParameters(ratio=facparam_48)  # -> win_par; plug-in component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
applyfacadepar_20 = DFApplyFacadeParameters(df_obj=topbottom_23, win_par=simpleratiopar_20)  # -> report, simplify(df_obj); plug-in component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
ventcontrol_20 = HBVentilationControl(min_in_temp="21", max_in_temp="25", min_out_temp="18", max_out_temp="30")  # -> vent_cntrl; plug-in component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
dfwindowopen_20 = DFWindowOpening(df_objs=applyfacadepar_20.df_obj, vent_cntrl=ventcontrol_20, fract_area_oper="0.8")  # -> report, simplify(df_objs); plug-in component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
panel_430 = Panel(dfwindowopen_20.df_objs)

facparam_49 = HBFacadeParameters(north=bldg_name_142, east=bldg_name_140, south=bldg_name_139, west=bldg_name_141)  # -> simplify(fac_par); disabled; plug-in component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
panel_431 = Panel(facparam_41)

# ----
# 6. SET GLAZING
facparam_50 = HBFacadeParameters(north=bldg_name_94, east=bldg_name_91, south=bldg_name_92, west=bldg_name_93)  # -> simplify(fac_par); plug-in component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
simpleratiopar_21 = DFSimpleWindowRatioParameters(ratio=facparam_50)  # -> win_par; plug-in component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
applyfacadepar_21 = DFApplyFacadeParameters(df_obj=topbottom_25, win_par=simpleratiopar_21)  # -> report, simplify(df_obj); plug-in component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
ventcontrol_21 = HBVentilationControl(min_in_temp="21", max_in_temp="25", min_out_temp="18", max_out_temp="30")  # -> vent_cntrl; plug-in component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
dfwindowopen_21 = DFWindowOpening(df_objs=applyfacadepar_21.df_obj, vent_cntrl=ventcontrol_21, fract_area_oper="0.8")  # -> report, simplify(df_objs); plug-in component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
panel_432 = Panel(dfwindowopen_21.df_objs)

panel_433 = Panel(facparam_32)
panel_434 = Panel(facparam_34)  # disabled
panel_435 = Panel(facparam_40)
panel_436 = Panel(facparam_45)  # disabled
panel_437 = Panel(facparam_43)
panel_438 = Panel(facparam_42)
facparam_51 = HBFacadeParameters(north=bldg_name_118, east=bldg_name_116, south=bldg_name_115, west=bldg_name_117)  # -> simplify(fac_par); plug-in component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
panel_439 = Panel(facparam_46)

# ----
# 6. SET GLAZING
facparam_52 = HBFacadeParameters(north=bldg_name_62, east=bldg_name_60, south=bldg_name_59, west=bldg_name_61)  # -> simplify(fac_par); plug-in component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
simpleratiopar_22 = DFSimpleWindowRatioParameters(ratio=facparam_52)  # -> win_par; plug-in component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
applyfacadepar_22 = DFApplyFacadeParameters(df_obj=topbottom_26, win_par=simpleratiopar_22)  # -> report, simplify(df_obj); plug-in component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
ventcontrol_22 = HBVentilationControl(min_in_temp="21", max_in_temp="25", min_out_temp="18", max_out_temp="30")  # -> vent_cntrl; plug-in component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
dfwindowopen_22 = DFWindowOpening(df_objs=applyfacadepar_22.df_obj, vent_cntrl=ventcontrol_22, fract_area_oper="0.8")  # -> report, simplify(df_objs); plug-in component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
panel_440 = Panel(dfwindowopen_22.df_objs)

panel_441 = Panel(facparam_47)  # disabled
panel_442 = Panel(facparam_44)
panel_443 = Panel(facparam_39)
panel_444 = Panel(facparam_37)

# ----
# 6. SET GLAZING
simpleratiopar_23 = DFSimpleWindowRatioParameters(ratio=facparam_49)  # -> win_par; disabled; plug-in component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
panel_445 = Panel("30")  # disabled
applyfacadepar_23 = DFApplyFacadeParameters(df_obj=topbottom_24, win_par=simpleratiopar_23)  # -> report, simplify(df_obj); disabled; plug-in component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
panel_446 = Panel("21")  # disabled
panel_447 = Panel("25")  # disabled
panel_448 = Panel("18")  # disabled
ventcontrol_23 = HBVentilationControl(min_in_temp=panel_446, max_in_temp=panel_447, min_out_temp=panel_448, max_out_temp=panel_445)  # -> vent_cntrl; disabled; plug-in component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
panel_449 = Panel("0.8")  # disabled
dfwindowopen_23 = DFWindowOpening(df_objs=applyfacadepar_23.df_obj, vent_cntrl=ventcontrol_23, fract_area_oper=panel_449)  # -> report, simplify(df_objs); disabled; plug-in component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
panel_450 = Panel(dfwindowopen_23.df_objs)  # disabled

# ----
# 6. SET GLAZING
facparam_53 = HBFacadeParameters(north=bldg_name_138, east=bldg_name_136, south=bldg_name_135, west=bldg_name_137)  # -> simplify(fac_par); disabled; plug-in component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
simpleratiopar_24 = DFSimpleWindowRatioParameters(ratio=facparam_53)  # -> win_par; disabled; plug-in component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
panel_451 = Panel("30")  # disabled
panel_452 = Panel("21")  # disabled
panel_453 = Panel("25")  # disabled
panel_454 = Panel("18")  # disabled
applyfacadepar_24 = DFApplyFacadeParameters(df_obj=topbottom_28, win_par=simpleratiopar_24)  # -> report, simplify(df_obj); disabled; plug-in component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
ventcontrol_24 = HBVentilationControl(min_in_temp=panel_452, max_in_temp=panel_453, min_out_temp=panel_454, max_out_temp=panel_451)  # -> vent_cntrl; disabled; plug-in component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
panel_455 = Panel("0.8")  # disabled
dfwindowopen_24 = DFWindowOpening(df_objs=applyfacadepar_24.df_obj, vent_cntrl=ventcontrol_24, fract_area_oper=panel_455)  # -> report, simplify(df_objs); disabled; plug-in component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
panel_456 = Panel(dfwindowopen_24.df_objs)  # disabled

panel_457 = Panel(facparam_50)
panel_458 = Panel(facparam_48)
panel_459 = Panel(facparam_49)  # disabled

# ----
# 6. SET GLAZING
simpleratiopar_25 = DFSimpleWindowRatioParameters(ratio=facparam_51)  # -> win_par; plug-in component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
applyfacadepar_25 = DFApplyFacadeParameters(df_obj=topbottom_27, win_par=simpleratiopar_25)  # -> report, simplify(df_obj); plug-in component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
ventcontrol_25 = HBVentilationControl(min_in_temp="21", max_in_temp="25", min_out_temp="18", max_out_temp="30")  # -> vent_cntrl; plug-in component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
dfwindowopen_25 = DFWindowOpening(df_objs=applyfacadepar_25.df_obj, vent_cntrl=ventcontrol_25, fract_area_oper="0.8")  # -> report, simplify(df_objs); plug-in component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
panel_460 = Panel(dfwindowopen_25.df_objs)

panel_461 = Panel(facparam_52)
panel_462 = Panel(facparam_53)  # disabled
panel_463 = Panel(facparam_51)
panel_464 = Panel(applyfacadepar.df_obj)
panel_465 = Panel(applyfacadepar_5.df_obj)
panel_466 = Panel(applyfacadepar_4.df_obj)
panel_467 = Panel(applyfacadepar_6.df_obj)  # disabled
panel_468 = Panel(applyfacadepar_3.df_obj)
panel_469 = Panel(applyfacadepar_2.df_obj)
panel_470 = Panel(applyfacadepar_7.df_obj)
panel_471 = Panel(applyfacadepar_8.df_obj)
panel_472 = Panel(applyfacadepar_18.df_obj)  # disabled
panel_473 = Panel(applyfacadepar_11.df_obj)
panel_474 = Panel(applyfacadepar_12.df_obj)
panel_475 = Panel(applyfacadepar_9.df_obj)
panel_476 = Panel(applyfacadepar_10.df_obj)
panel_477 = Panel(applyfacadepar_14.df_obj)
panel_478 = Panel(applyfacadepar_13.df_obj)
panel_479 = Panel(applyfacadepar_19.df_obj)  # disabled
panel_480 = Panel(applyfacadepar_17.df_obj)
panel_481 = Panel(applyfacadepar_15.df_obj)
panel_482 = Panel(applyfacadepar_20.df_obj)
panel_483 = Panel(applyfacadepar_16.df_obj)  # disabled
panel_484 = Panel(applyfacadepar_21.df_obj)
panel_485 = Panel(applyfacadepar_23.df_obj)  # disabled
panel_486 = Panel(applyfacadepar_22.df_obj)
panel_487 = Panel(applyfacadepar_25.df_obj)
panel_488 = Panel(applyfacadepar_24.df_obj)  # disabled

# ----
# 8. ADD CONTEXT BUILDINGS INTO MODEL
swatch = ColourSwatch(SwatchColor=RGB(131, 38, 255))
merge = Merge(Data1=extr_2, Data2=extr)  # -> simplify(Result)
preview = CustomPreview(Geometry=merge, Material=swatch)
# BELOW:
# ADD CONTEXT
# BUILD MODEL
# CHECK MODEL
context = DFContextShade(geo=flatten(merge))  # -> out, simplify(context); plug-in component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
panel_489 = Panel(context.context)

path_to_eplus_weather_file = Panel("https://energyplus-weather.s3.amazonaws.com/europe_wmo_region_6/ITA/ITA_Torino-Caselle.160590_IGDG/ITA_Torino-Caselle.160590_IGDG.zip")
path_on_hdrive_to_save_weather = Panel("C:\Weather")
downloadepw = LBDownloadWeather(weather_URL=path_to_eplus_weather_file, folder=path_on_hdrive_to_save_weather)  # -> epw_file, stat_file, ddy_file; plug-in component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

# ----
# 6. SET GLAZING
facparam_54 = HBFacadeParameters(north=bldg_name_38, east=bldg_name_36, south=bldg_name_35, west=bldg_name_37)  # -> simplify(fac_par); plug-in component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
simpleratiopar_26 = DFSimpleWindowRatioParameters(ratio=facparam_54)  # -> win_par; plug-in component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
applyfacadepar_26 = DFApplyFacadeParameters(df_obj=topbottom_9, win_par=simpleratiopar_26)  # -> report, simplify(df_obj); plug-in component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
ventcontrol_26 = HBVentilationControl(min_in_temp="21", max_in_temp="25", min_out_temp="18", max_out_temp="30")  # -> vent_cntrl; plug-in component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

panel_490 = Panel(facparam_54)
panel_491 = Panel(applyfacadepar_26.df_obj)
dfwindowopen_26 = DFWindowOpening(df_objs=applyfacadepar_26.df_obj, vent_cntrl=ventcontrol_26, fract_area_oper="0.8")  # -> report, simplify(df_objs); plug-in component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

panel_492 = Panel(dfwindowopen_26.df_objs)

# ----
# 6. SET GLAZING
facparam_55 = HBFacadeParameters(north=bldg_name_50, east=bldg_name_48, south=bldg_name_47, west=bldg_name_49)  # -> simplify(fac_par); plug-in component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
simpleratiopar_27 = DFSimpleWindowRatioParameters(ratio=facparam_55)  # -> win_par; plug-in component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
ventcontrol_27 = HBVentilationControl(min_in_temp="21", max_in_temp="25", min_out_temp="18", max_out_temp="30")  # -> vent_cntrl; plug-in component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

panel_493 = Panel(facparam_55)
applyfacadepar_27 = DFApplyFacadeParameters(df_obj=topbottom_8, win_par=simpleratiopar_27)  # -> report, simplify(df_obj); plug-in component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
panel_494 = Panel(applyfacadepar_27.df_obj)
dfwindowopen_27 = DFWindowOpening(df_objs=applyfacadepar_27.df_obj, vent_cntrl=ventcontrol_27, fract_area_oper="0.8")  # -> report, simplify(df_objs); plug-in component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

panel_495 = Panel(dfwindowopen_27.df_objs)

# ----
# 6. SET GLAZING
facparam_56 = HBFacadeParameters(north=bldg_name_42, east=bldg_name_40, south=bldg_name_39, west=bldg_name_41)  # -> simplify(fac_par); plug-in component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
simpleratiopar_28 = DFSimpleWindowRatioParameters(ratio=facparam_56)  # -> win_par; plug-in component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
applyfacadepar_28 = DFApplyFacadeParameters(df_obj=topbottom_20, win_par=simpleratiopar_28)  # -> report, simplify(df_obj); plug-in component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
ventcontrol_28 = HBVentilationControl(min_in_temp="21", max_in_temp="25", min_out_temp="18", max_out_temp="30")  # -> vent_cntrl; plug-in component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

panel_496 = Panel(facparam_56)
panel_497 = Panel(applyfacadepar_28.df_obj)
dfwindowopen_28 = DFWindowOpening(df_objs=applyfacadepar_28.df_obj, vent_cntrl=ventcontrol_28, fract_area_oper="0.8")  # -> report, simplify(df_objs); plug-in component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

panel_498 = Panel(dfwindowopen_28.df_objs)

# ----
# 7. MERGE ALL RESIDENTIAL BUILDINGS INTO ONE DATA TREE
#     MERGE CONTEXT INTO RESIDENTIAL DATA TREE
#     REMOVE WINDOWS ON ALL ADJOINING BUILDINGS
#     SEPARATE MERGED DATA TREE TO INCLUDE RESIDENTIAL ONLY
# Residential Buildings -
# 28 Archetypes:
# Cull out objects which are part of the
# Context layer from the Buildings simulation.
# The Context objects will be re-added
# directly into the model in the "context" input.
# Context -
# Import to run
# "DF Process Alleys"
# to remove glazing
# from adjoining walls
res_bldgs = Merge(
    Data1=flatten(topbottom_13),
    Data2=flatten(dfwindowopen_22.df_objs),
    Data3=flatten(dfwindowopen_24.df_objs),
    Data4=flatten(dfwindowopen_15.df_objs),
    Data5=flatten(dfwindowopen_9.df_objs),
    Data6=flatten(dfwindowopen_20.df_objs),
    Data7=flatten(dfwindowopen_28.df_objs),
    Data8=flatten(dfwindowopen_10.df_objs),
    Data9=flatten(dfwindowopen_26.df_objs),
    Data10=flatten(dfwindowopen_27.df_objs),
    Data11=flatten(dfwindowopen_7.df_objs),
    Data12=flatten(dfwindowopen_4.df_objs),
    Data13=flatten(dfwindowopen_12.df_objs),
    Data14=flatten(dfwindowopen_11.df_objs),
    Data15=flatten(dfwindowopen_18.df_objs),
    Data16=flatten(dfwindowopen_2.df_objs),
    Data17=flatten(dfwindowopen_5.df_objs),
    Data18=flatten(dfwindowopen.df_objs),
    Data19=flatten(dfwindowopen_6.df_objs),
    Data20=flatten(dfwindowopen_3.df_objs),
    Data21=flatten(dfwindowopen_13.df_objs),
    Data22=flatten(dfwindowopen_21.df_objs),
    Data23=flatten(dfwindowopen_19.df_objs),
    Data24=flatten(dfwindowopen_14.df_objs),
    Data25=flatten(dfwindowopen_17.df_objs),
    Data26=flatten(dfwindowopen_16.df_objs),
    Data27=flatten(dfwindowopen_23.df_objs),
    Data28=flatten(dfwindowopen_25.df_objs))
context_2 = Merge(Data1=flatten(buildingfootprint_2.buildings), Data2=flatten(buildingfootprint.buildings))
# BELOW:
# DATA MERGE & REMOVE WINDOWS
# ON ADJOINING BUILDINGS
panel_499 = Panel(res_bldgs)
merge_2 = Merge(Data1=res_bldgs, Data2=context_2)
lng = ListLength(List=res_bldgs)
lng_2 = ListLength(List=merge_2)
panel_500 = Panel(merge_2)
subtraction = Subtraction(A=lng_2, B=lng)
# Apts
# Detached
# House
alleys = DFProcessAlleys(buildings=merge_2, distance="0.05", adiabatic=Toggle(True))  # -> report, simplify(buildings); plug-in component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
dup = DuplicateData(Data="True", Number=lng, Order=True)  # -> flatten(Data)
dup_2 = DuplicateData(Data="False", Number=subtraction, Order=True)  # -> flatten(Data)
merge_3 = Merge(Data1=dup, Data2=dup_2)
panel_501 = Panel(merge_3)
bool = Boolean(merge_3)
cull = CullPattern(List=alleys.buildings, CullPattern=bool)
panel_502 = Panel(cull)

# ----
# 9. BUILD MODEL & VALIDATE
panel_503 = Panel("Baseline")
model = DFModel(buildings=cull, context=flatten(context.context), name=panel_503)  # -> report, model; plug-in component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
vizall_31 = DFVisualizeAll(df_objs=flatten(model.model))  # -> geo; plug-in component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
dfvalidatemodel = DFValidateModel(model=model.model, validate=Toggle(True))  # -> report; plug-in component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
panel_504 = Panel(dfvalidatemodel)

# ----
# 10. VISUALIZE MODEL ATTRIBUTES
df_room2d_attributes = DFRoom2DAttributes({"Display Name": "display_name", "Simulation Name (Identifier)": "identifier", "Floor-To-Ceiling Height": "floor_to_ceiling_height", "Floor Elevation": "floor_height", "Ceiling Elevation": "ceiling_height", "Is Ground Contact": "is_ground_contact"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}, selected="Construction Set": "properties.energy.construction_set.display_name")  # disabled
pt = Point(Point(1628.379469, -1444.858644, 0))  # disabled
panel_505 = Panel("40")  # disabled
panel_506 = Panel("24")  # disabled
panel_507 = Panel("5")  # disabled
legendpar = LBLegendParameters(num_decimals=panel_507, base_plane=pt, seg_height=panel_505, text_height=panel_506)  # -> leg_par; disabled; plug-in component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
colorroom2dattr = DFColorRoom2DAttributes(df_obj=model.model, attribute=df_room2d_attributes, legend_par=legendpar)  # -> mesh, legend, wire_frame, values, colors; disabled; plug-in component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
boolean_toggle = BooleanToggle(False)  # disabled
boolean_toggle_2 = BooleanToggle(False)  # disabled
boolean_toggle_3 = BooleanToggle(False)  # disabled
falsestart_31 = LBFalseStartToggle(False)  # disabled
panel_508 = Panel("Story")  # disabled
panel_509 = Panel("50")  # disabled
tohoneybee = DFModelToHoneybee(
    model=model.model,
    obj_per_model=panel_508,
    use_multiplier=boolean_toggle,
    add_plenum=boolean_toggle_2,
    ceil_adjacency=boolean_toggle_3,
    shade_dist=panel_509,
    run=falsestart_31)  # -> report, hb_models; disabled; plug-in component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
vizbytype = HBVisualizeByType(hb_objs=tohoneybee.hb_models)  # -> walls, interior_walls, roofs, ceilings, exterior_floors, interior_floors, air_walls, apertures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; disabled; plug-in component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
vizbybc = HBVisualizeByBC(hb_objs=tohoneybee.hb_models)  # -> outdoors, surface, ground, adiabatic, other, wire_frame; disabled; plug-in component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
geo_31 = Geometry(vizbybc.adiabatic)  # disabled
geo_32 = Geometry([vizbytype.apertures, vizbytype.walls])  # disabled

# ----
# ***CHANGE DIRECTORY***
# AND RUN SIMULATION
# 11. RUN SIMULATION
panel_510 = Panel("Circoscrizione_6")
set_path_and_connect = Panel("C:\Simulations\TITLE_HERE")
constrloc = LBConstructLocation(name=panel_510, latitude="45.092972611671904", longitude="7.704043120351258", time_zone="1", elevation=0)  # -> location; plug-in component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
falsestart_32 = LBFalseStartToggle(False)
point = Point(Point(1065.262479, 161.4190954, 0))
togeojson = DFModelToGeoJSON(
    model=model.model,
    location=constrloc,
    point=point,
    use_multiplier=Toggle(True),
    add_plenum=Toggle(False),
    ceil_adjacency=Toggle(True),
    shade_dist="50",
    write=falsestart_32)  # -> report, geojson, net_json, hb_jsons, hb_models; plug-in component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
boolean_toggle_4 = BooleanToggle(True)
simoutput = HBSimulationOutput(zone_energy_use=boolean_toggle_4, system_energy_use=boolean_toggle_4, report_frequency="Daily")  # -> out, sim_output; plug-in component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
shadowcalc = HBShadowCalculation(solar_dist="FullExterior")  # -> shadow_calc; plug-in component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
falsestart_33 = LBFalseStartToggle(False)
simpar = HBSimulationParameter(output=simoutput.sim_output, timestep="4", shadow_calc=shadowcalc)  # -> sim_par; plug-in component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
runurbanopt = DFRunURBANopt(geojson=togeojson.geojson, epw_file=downloadepw.epw_file, sim_par=simpar, cpus="20", run=falsestart_33)  # -> report, scenario, osm, idf, sql, zsz, rdd, html; plug-in component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
